# Grasshopper definition HRCAssembly_dataflow_simulation.ghx (Grasshopper 1.0.7)

panel = Panel("Unload libraries")
bang = Button()
unload = PythonScript(bang=bang)
# ---------- unload: Python ----------
from compas_rhino.utilities.misc import get_tolerance
from compas_rhino.utilities.misc import unload_modules

unload_modules("compas")
unload_modules("compas_fab")
unload_modules("ur_online_control")
unload_modules("roslibpy")
unload_modules("human_robot_collaborative_assembly")
# ---------- end unload ----------

# ----
# ROS - Settings
list = ValueList({"local": 0, "backpack computer": 1}, selected="backpack computer")

# ---- group: ROS client
restart = Button()
# 1.
disconnect = Button()
connect = Button()
ros = PythonScript(restart=restart, connection=list)  # -> ros_client
# ---------- ros: Python ----------
import time
import logging
import scriptcontext as sc

from roslibpy import Ros
from System import TimeSpan
from System.Threading import ManualResetEventSlim

LOGGER = logging.getLogger('roslibpy')

guid = str(ghenv.Component.InstanceGuid)
ros_client_key = "rosclient_" + guid

previous_client = sc.sticky.get(ros_client_key, None)
if previous_client:
    previous_client.terminate()

if connection == 0: #local
    ros_client = Ros('127.0.0.1', 9090) #local, own laptop
elif connection == 1: # backpack computer
    ros_client = Ros('10.181.69.122', 9090) #mabi computer - lan
sc.sticky[ros_client_key] = ros_client

waitLock = ManualResetEventSlim(False) 
ros_client.on_ready(lambda: waitLock.Set()) 

if not waitLock.Wait(TimeSpan.FromSeconds(5)):
    raise Exception('Unable to connect to ROS')

LOGGER.info('ROS connection opened')
# ---------- end ros ----------
connect_2 = PythonScript(ros_client=ros, connect=connect, disconnect=disconnect)  # -> out, ros_client
# ---------- connect_2: Python ----------
import logging
from System import TimeSpan
from System.Threading import ManualResetEventSlim

LOGGER = logging.getLogger('roslibpy')

if connect:
    if not ros_client.is_connected:
        LOGGER.debug('Connecting...')
        waitLock = ManualResetEventSlim(False)
        ros_client.on_ready(lambda: waitLock.Set())
        ros_client.connect()

        if not waitLock.Wait(TimeSpan.FromSeconds(5)):
            raise Exception('Unable to connect to ROS')
        LOGGER.debug('Reconnected')

if disconnect:
    if ros_client.is_connected:
        ros_client.terminate()
        LOGGER.debug('Terminated')
        
       
if (ros_client.is_connected):
    print('connected')
else:
    print('disconnected')
# ---------- end connect_2 ----------
panel_2 = Panel(connect_2.out)

# ----
import = Button(ExpressionNormal="True", ExpressionPressed="False")
# Load initial assembly
# Import initial assembly (first module)
py = PythonScript()  # -> HERE, DATA
# ---------- py: Python ----------
import os

HERE = os.path.dirname(ghdoc.Path)
DATA = os.path.abspath(os.path.join(HERE, "..", "data"))
print(HERE)
print(DATA)
# ---------- end py ----------
initial_assembly = GhPythonScript(DATA=py.DATA, import_from_json=import)  # -> out, assembly; inputs import_from_json: Boolean
# ---------- initial_assembly: Python ----------
import os
import json

from human_robot_collaborative_assembly.assembly import HRCAssembly as Assembly
from human_robot_collaborative_assembly.assembly import HRCElement as Element

#assembly = Assembly()

if import_from_json:
    filename = "hrcassembly_initial.json"
    PATH = os.path.join(DATA, filename)
    assembly = Assembly.from_json(PATH)
# ---------- end initial_assembly ----------

# ----
# Rhino to App:
# ADD OBJECTS
button = Button()
# 2.
ros_service_request = PythonScript(ros_client=connect_2.ros_client, assembly=initial_assembly.assembly, send=button)  # -> out, assembly; inputs send: Boolean
# ---------- ros_service_request: Python ----------
import logging
import roslibpy
from roslibpy import Topic
from roslibpy import ServiceRequest
from roslibpy import Service
from roslibpy import Message
from scriptcontext import sticky

LOGGER = logging.getLogger('roslibpy')    

def ros_msg_add_objects():
    ros_msg = {}
    pose_stamped_array = []
    for key, element in assembly.elements():
        x,y,z,qw,qx,qy,qz = element.get_pose_quaternion()
        pose_stamped_array.append({'header':{'seq': 0, 'stamp':{'secs': 0, 'nsecs': 0}, 'frame_id': str(key)}, 'pose': {'position': {'x': x, 'y': y, 'z': z}, 'orientation': {'x': qx, 'y': qy, 'z': qz, 'w': qw}}})
    ros_msg['poses'] = pose_stamped_array
    return ros_msg


if send:
    print("send")
    if ros_client:
            message = ros_msg_add_objects() #geometry_msgs/PoseStamped[] 
            #message = handle_add_two_bricks()[0] #geometry_msgs/PoseStamped[] 
            print (message)                
            service_name = '/incon/add_objects'
            service_type = '/incon_msgs/add_objects'
            service = roslibpy.Service(ros_client, service_name, service_type)
            request = ServiceRequest(message)
            result = service.call(request) #sending of message
            print(result)
            sticky['result_add_objects'] = result

if 'result_add_objects' in sticky:
    print sticky['result_add_objects']
# ---------- end ros_service_request ----------
panel_3 = Panel(ros_service_request.out)

list_2 = ValueList({"Float32MultiArray": 1, "MarkerArray": 2}, selected="Float32MultiArray")  # disabled
panel_4 = Panel("-0.32, -0.024, 0.024")  # disabled
button_2 = Button()  # disabled
# 3.
elements = Elements()  # -> elem_x, elem_y, elem_z; disabled
# To ROS:
# 
# object_poses = [[key, [position, orientation]]]
object_poses = GhPythonScript(
    assembly=ros_service_request.assembly,
    elem_x=elements.elem_x,
    elem_y=elements.elem_y,
    elem_z=elements.elem_z,
    options_msg_type=list_2,
    p=panel_4,
    add_to_assembly=button_2)  # -> out, assembly, object_poses; inputs options_msg_type: Int32, p: Point3d, add_to_assembly: Boolean; disabled
# ---------- object_poses: Python ----------
import os
import sys
import Rhino.Geometry as rg

from compas.geometry import Translation
from compas.geometry import Plane, Frame

from human_robot_collaborative_assembly.assembly import HRCAssembly as Assembly
from human_robot_collaborative_assembly.assembly import HRCElement as Element

object_poses = []
min_dist = 0.2

#add a new module based on the tracked element's location
if add_to_assembly:
    current_key = assembly.parent_key(p, min_dist) # compute parent key
    e = assembly.element(current_key)
    current_type = e._type

    #compute direction
    axis_map = {'X': 0, 'Y': 1, 'Z': 2}
    if p[axis_map[current_type]] < e.frame.point[axis_map[current_type]]:
        direction = 0
        connector_frame = e.connector_frame_2
    else:
        direction = 1
        connector_frame = e.connector_frame_1

    a = connector_frame.point[axis_map[current_type]]
    b = p[axis_map[current_type]]
    shift_value = abs(a - b)

    type_map = {'X': elem_x, 'Y': elem_y, 'Z': elem_z}

    elem = type_map[current_type]
    assembly.add_element_(elem, current_key, direction, shift_value, placed_by = 'human', on_ground = False, module_index = 0)


#return object poses
for key, element in assembly.elements():
    object_poses.append([key, element.get_pose_quaternion()]) 

print object_poses
# ---------- end object_poses ----------
panel_5 = Panel(object_poses.object_poses)  # disabled

# ----
# App to Rhino SIMULATOR
# All object poses are continuously published via a ROS topic OBJECT_POSES
publish_rhino_object_poses = BooleanToggle(False)  # disabled
publish = PythonScript(ros_client=connect_2.ros_client, publish_topic=publish_rhino_object_poses)  # -> out; disabled
# ---------- publish: Python ----------
import logging
from roslibpy import Topic
from roslibpy import ServiceRequest
from roslibpy import Service
from scriptcontext import sticky

LOGGER = logging.getLogger('roslibpy')

def handle_object_poses():
    pose_array = []
    print(object_poses)
    for i in range(len(object_poses)):
        idx = object_poses[i][0]
        pos_x = object_poses[i][1][0]
        pos_y = object_poses[i][1][1]
        pos_z = object_poses[i][1][2]
        qx = object_poses[i][1][3]
        qy = object_poses[i][1][4]
        qz = object_poses[i][1][5]
        qw = object_poses[i][1][6]
        pose_array.append({'position': {'x': pos_x, 'y': pos_y, 'z': pos_z}, 'orientation': {'x': qx, 'y': qy, 'z': qz, 'w': qw}})
    return pose_array


#key = 'publisher_%s' % str(ghenv.Component.InstanceGuid)

key = 'publisher_object_poses'
print key

if publish_topic:
    print("publish")
    if ros_client and ros_client.is_connected:
        print("publishing")
        publisher = Topic(ros_client, '/rhino/object_poses', 'geometry_msgs/PoseArray')
        sticky[key] = publisher
        #message = topic.publish({'header': {'seq': 0, 'stamp': 1111 , 'frame_id': '/world'}, 'poses': handle_object_poses()})
    else:
        sticky[key] = None
else:
    sticky[key] = None
# ---------- end publish ----------
panel_6 = Panel(publish)  # disabled

start_timer = Button()
stop_timer = Button()
timer = GhPythonScript(start_timer=start_timer, stop_timer=stop_timer, object_poses=object_poses.object_poses)  # -> out, element_frames, element_planes; inputs object_poses: list
# ---------- timer: Python ----------
from scriptcontext import sticky
from compas_ghpython.utilities import update_component
from compas.geometry import Frame

assembly_new = sticky['assembly_new']

guid = str(ghenv.Component.InstanceGuid)
timer_running_key = "timer_running_" + guid


if stop_timer or timer_running_key not in sticky:
    sticky[timer_running_key] = False

if start_timer:
    sticky[timer_running_key] = True

if sticky[timer_running_key]:
    update_component(ghenv, 1)
    

def handle_object_poses():
    pose_array = []
    #print(object_poses)
    for i in range(len(object_poses)):
        idx = object_poses[i][0]
        pos_x = object_poses[i][1][0]
        pos_y = object_poses[i][1][1]
        pos_z = object_poses[i][1][2]
        qx = object_poses[i][1][3]
        qy = object_poses[i][1][4]
        qz = object_poses[i][1][5]
        qw = object_poses[i][1][6]
        pose_array.append({'position': {'x': pos_x, 'y': pos_y, 'z': pos_z}, 'orientation': {'x': qx, 'y': qy, 'z': qz, 'w': qw}})
    return pose_array

def handle_object_options():
    options = assembly_new.current_options
    float_array = []
    for option in options:
        float_array += option
    return float_array, len(options)
    


if 'publisher_object_poses' in sticky:
    if sticky['publisher_object_poses']:
        
        publisher_object_poses = sticky['publisher_object_poses']
        publisher_message_object_poses = publisher_object_poses.publish({'header': {'seq': 0, 'stamp': 1111 , 'frame_id': '/world'}, 'poses': handle_object_poses()})
        print('publishing object poses')
        print(publisher_message_object_poses)
    else:
        print('publisher_object_poses = None')

        
if 'publisher_options2' in sticky:
    if sticky['publisher_options2']:
        
        publisher_options = sticky['publisher_options2']
        float_array, float_size = handle_object_options()
        publisher_message_options = publisher_options.publish({'layout': {'dim': [{'label': 'x', 'size': float_size, 'stride':len(float_array) }, {'label': 'x', 'size': 6, 'stride': 6 }], 'data_offset': 0}, 'data': float_array})

        print('publishing object options2')
        print publisher_message_options
        #print(publisher_message_object_poses)
    else:
        print('publisher_object_poses = None')
        
        
if 'listener_message_object_poses' in sticky:   
    if sticky['listener_message_object_poses']:
        print('listening to object poses')
        listener_message_object_poses = sticky['listener_message_object_poses']
        element_poses = listener_message_object_poses['poses']
        element_frames = [Frame.from_quaternion([p['orientation']['w'],p['orientation']['x'], p['orientation']['y'], p['orientation']['z']], point = [p['position']['x'], p['position']['y'], p['position']['z']] ) for p in element_poses]
        #element_planes = [draw_frame(f) for f in element_frames] 
        len_element_frames = len(element_frames)
        print len_element_frames
        print element_frames
    else:
        print('listener_message_object_poses = None')



"""

if 'message_T_w_i' in sticky:    
    
    msg_T_w_i = sticky['message_T_w_i']
    p = msg_T_w_i['pose']
    
    ARsys_oframe = Frame.from_quaternion([p['orientation']['w'],p['orientation']['x'], p['orientation']['y'], p['orientation']['z']], point = [p['position']['x']*1000, p['position']['y']*1000, p['position']['z']*1000] )
    seq_T_w_i = msg_T_w_i['header']['seq']

if 'message_bposes' in sticky:   
    
    msg_bposes = sticky['message_bposes']
    #print msg_bposes
    bposes = msg_bposes['poses']
    bframes = [Frame.from_quaternion([p['orientation']['w'],p['orientation']['x'], p['orientation']['y'], p['orientation']['z']], point = [p['position']['x']*1000, p['position']['y']*1000, p['position']['z']*1000] ) for p in bposes]
    len_bframes = len(bframes)
    #print len(bframes)
    #print bframes
"""
#bframes = [Frame([0,0,0],[0,1,0],[1,0,0]), Frame([50,0,0],[0,1,0],[1,0,0]), Frame([100,0,0],[0,1,0],[1,0,0])]    
#bframes = [ARsys_oframe]  
#print bframes
# ---------- end timer ----------

# ----
# 1) Detect new object object poses by checking the total number of poses. If list longer new object is added and the subsequent elements are computed.
# 
# 2) Rhino computes the subsequent two and sends a new ROS service request ADD_OBJECTS (pose array msg) to the App
py_2 = PythonScript()  # -> HERE, DATA; same code as py
initial_assembly_2 = GhPythonScript(DATA=py_2.DATA, import_from_json=Toggle(True))  # -> out, assembly_new; inputs import_from_json: Boolean
# ---------- initial_assembly_2: Python ----------
import os
import json

from compas.geometry import Frame, Transformation
from human_robot_collaborative_assembly.assembly import HRCAssembly as Assembly
from human_robot_collaborative_assembly.assembly import HRCElement as Element
from scriptcontext import sticky as st

#assembly = Assembly()

if import_from_json:
    filename = "hrcassembly_ex1.json"
    PATH = os.path.join(DATA, filename)
    assembly_new = Assembly.from_json(PATH)
    assembly_new.triggered = False
    assembly_new.p_key = None
    

    assembly_new.current_options = []
    st['assembly_new'] = assembly_new
# ---------- end initial_assembly_2 ----------

# ----
# 4.
# Rhino receive and compute
subscribe_rhino_object_poses = BooleanToggle(True)
panel_7 = Panel("""Receive:

[element_frames]""")

list_3 = ValueList({"Float32MultiArray": 1, "MarkerArray": 2}, selected="Float32MultiArray")
elements_2 = Elements()  # -> elem_x, elem_y, elem_z
import_object_pose = GhPythonScript(
    assembly_new=initial_assembly_2.assembly_new,
    elem_x=elements_2.elem_x,
    elem_y=elements_2.elem_y,
    elem_z=elements_2.elem_z,
    options_msg_type=list_3,
    element_frames=timer.element_frames)  # -> out, assembly_new, obejct_poses, options; inputs options_msg_type: Int32, element_frames: list
# ---------- import_object_pose: Python ----------
import os
import sys
import Rhino.Geometry as rg
import ast

from scriptcontext import sticky

from compas.geometry import Frame, Plane
from compas.geometry import Vector
from compas.geometry import Transformation, Translation
from compas.geometry import distance_point_point
from compas_ghpython import draw_frame

from human_robot_collaborative_assembly.assembly import HRCAssembly as Assembly
from human_robot_collaborative_assembly.assembly import HRCElement as Element

if 'assembly_new' not in sticky:
    sticky['assembly_new'] = assembly_new


min_dist = 0.2
count = assembly_new.number_of_elements()
print(count)
object_poses = []
options = []

print(assembly_new.triggered)
print(assembly_new.p_key)

if len(element_frames) > count:
    assembly_new.triggered = True
    
    elem_frame = element_frames[-1]
    
    p = elem_frame.point
    
    #add a new module based on the tracked element's location
    
    assembly_new.p_key = assembly_new.parent_key(p, min_dist) # compute parent key
    current_key = assembly_new.p_key
    e = assembly_new.element(current_key)
    current_type = e._type
    
    #compute direction
    axis_map = {'X': 0, 'Y': 1, 'Z': 2}
    if p[axis_map[current_type]] < e.frame.point[axis_map[current_type]]:
        direction = 0
        connector_frame = e.connector_frame_2
    else:
        direction = 1
        connector_frame = e.connector_frame_1

    a = connector_frame.point[axis_map[current_type]]
    b = p[axis_map[current_type]]
    shift_value = abs(a - b)
    
    assembly_new.add_module(elem_x, elem_y, elem_z, current_key, direction, shift_value, on_ground = False)

# Return object poses
for key, element in assembly_new.elements():
    object_poses.append([key, element.get_pose_quaternion()]) 


# Assembly options as Float32MultiArray or MarkerArray
for key, element in assembly_new.elements():
    elem_options = assembly_new.elem_options_vectors(key, 0.5)
    start = element.frame.point
    start_end = []
    for vector in elem_options:
        plane = Plane(start, vector)
        frame = Frame.from_plane(plane)
        orientation = frame.quaternion
        T = Translation(vector)
        end = start.transformed(T)
    if options_msg_type == 1:
        options.append([start[0], start[1], start[2], end[0], end[1], end[2]])
    if options_msg_type == 2:
        options.append([start[0], start[1], start[2], orientation[0], orientation[1], orientation[2], orientation[3]])

#print(options)
#print(obejct_pose)

assembly_new.current_options = options
# ---------- end import_object_pose ----------
draw = GhPythonScript(assembly_new=import_object_pose.assembly_new, show_assembly=Toggle(True), show_options=Toggle(True))  # -> G_assembly, pr, vr
# ---------- draw: Python ----------
import os
import sys
import Rhino.Geometry as rg

from compas.geometry import Frame
from compas_ghpython import draw_frame
from compas_ghpython.artists import MeshArtist

G_assembly = []

vr = []
pr = []

key_index = assembly_new.network.key_index()
keys = [key_index[key] for key in assembly_new.network.nodes()]
elements = [assembly_new.element(key) for key in keys] 

if show_assembly:
    for element in elements:
        artist = MeshArtist(element.mesh)
        mesh = artist.draw_mesh()
        G_assembly.append(mesh)

if show_options:
    for key, element in assembly_new.elements():
        elem_origin = element.frame.point
        elem_vectors = assembly_new.elem_options_vectors(key, 0.5)
        for v in elem_vectors:
            vr.append(rg.Vector3d(*tuple(v)))
            pr.append(rg.Point3d(elem_origin.x, elem_origin.y, elem_origin.z))
# ---------- end draw ----------
vdis = VectorDisplay(Anchor=draw.pr, Vector=draw.vr)

subscribe = PythonScript(ros_client=connect_2.ros_client, subscribe_to_topic=subscribe_rhino_object_poses)  # -> out; inputs subscribe_to_topic: Boolean
# ---------- subscribe: Python ----------
import time
import logging
import datetime
import Grasshopper
from roslibpy import Topic
from scriptcontext import sticky

LOGGER = logging.getLogger('roslibpy')
data = dict(requesting_solution=False)

def expire(grasshopper_doc):
    grasshopper_doc = ghenv.Component.OnPingDocument()
    if grasshopper_doc.SolutionState != Grasshopper.Kernel.GH_ProcessStep.Process:
        data['requesting_solution'] = True
        ghenv.Component.ExpireSolution(False)
        data['requesting_solution'] = False

def receive_message_object_poses(message):
    #sticky['message'] = str(datetime.datetime.now()) + ': ' + str(message)
    print("receiving")
    sticky['listener_message_object_poses'] = message
    

if ros_client:
    print ("connected")
    key = 'listener_%s' % str(ghenv.Component.InstanceGuid)
    if ros_client.is_connected and subscribe_to_topic:
        needs_subscribe = True

        previous_listener = sticky.get(key, None)
        
        if previous_listener and previous_listener.is_subscribed:
            if previous_listener.ros != ros_client:
                LOGGER.debug('Previous subscription linked to different ROS client, will terminate.')
                previous_listener.ros.terminate()
                sticky[key] = None
            else:
                needs_subscribe = False

        LOGGER.info('Needs subscribing? ' + str(needs_subscribe))

        if needs_subscribe:
            LOGGER.debug('Subscribing...')
            try:
                listener = Topic(ros_client, '/object_poses', 'geometry_msgs/PoseArray', compression=None, latch=False, throttle_rate=0, queue_size=1, queue_length=1)
                sticky[key] = listener
    
                def start_receiving():
                    LOGGER.debug('Listening...')
                    listener.subscribe(receive_message_object_poses)
            
                ros_client.on_ready(start_receiving)
            except Exception as e:
                LOGGER.error('error')
                LOGGER.error(e)
                
    elif ros_client.is_connected and subscribe_to_topic == False:
        needs_subscribe = True

        previous_listener = sticky.get(key, None)
        
        if previous_listener and previous_listener.is_subscribed:
            print(previous_listener.is_subscribed)
            LOGGER.debug('ROS client will unsubscribe.')
            previous_listener.unsubscribe()
            #sticky[key] = None
            sticky['listener_message_object_poses'] = None

        LOGGER.info('Needs subscribing? ' + str(needs_subscribe))
        
    else:
        LOGGER.debug('Not connected')
        sticky.pop('message_bposes', None)
else:
    LOGGER.debug('No ROS client found')
# ---------- end subscribe ----------
panel_8 = Panel(timer.out)
panel_9 = Panel(initial_assembly_2.assembly_new)
panel_10 = Panel(subscribe)
# Send:
# 
# Float32MultiArray: options = [[start],[end], [start],[end]]
# or
# MarkerArray: options = [[position], [orientation], [position], [orientation]]
panel_11 = Panel(import_object_pose.out)

start_timer_2 = Button()  # disabled
stop_timer_2 = Button()  # disabled
timer_2 = GhPythonScript(start_timer=start_timer_2, stop_timer=stop_timer_2, options=import_object_pose.options)  # -> out, element_frames, element_planes; inputs options: list; disabled
# ---------- timer_2: Python ----------
from scriptcontext import sticky
from compas_ghpython.utilities import update_component
from compas.geometry import Frame

guid = str(ghenv.Component.InstanceGuid)
timer_running_key = "timer_running_" + guid


assembly_new = sticky['assembly_new']


if stop_timer or timer_running_key not in sticky:
    sticky[timer_running_key] = False

if start_timer:
    sticky[timer_running_key] = True

if sticky[timer_running_key]:
    update_component(ghenv, 1)
    

def handle_object_poses():
    pose_array = []
    #print(object_poses)
    for i in range(len(object_poses)):
        idx = object_poses[i][0]
        pos_x = object_poses[i][1][0]
        pos_y = object_poses[i][1][1]
        pos_z = object_poses[i][1][2]
        qx = object_poses[i][1][3]
        qy = object_poses[i][1][4]
        qz = object_poses[i][1][5]
        qw = object_poses[i][1][6]
        pose_array.append({'position': {'x': pos_x, 'y': pos_y, 'z': pos_z}, 'orientation': {'x': qx, 'y': qy, 'z': qz, 'w': qw}})
    return pose_array


if 'publisher_options' in sticky:
    if sticky['publisher_options']:
        
        publisher_options = sticky['publisher_options']
        publisher_message_options = publisher_options.publish(viz_msg)
        print('publishing object poses')
        #print(publisher_message_object_poses)
    else:
        print('publisher_object_poses = None')
# ---------- end timer_2 ----------

# ----
# !!! MISSING !!! 'Subscribe to topic'
# 5.
# Rhino to App
# All arrows that need to be visualized are published via a ROS topic OPTIONS
publish_rhino_options = BooleanToggle(False)
publish_2 = PythonScript(ros_client=connect_2.ros_client, publish_topic=publish_rhino_options)  # -> out
# ---------- publish_2: Python ----------
import logging
from roslibpy import Topic
from roslibpy import ServiceRequest
from roslibpy import Service
from scriptcontext import sticky

LOGGER = logging.getLogger('roslibpy')


#key = 'publisher_%s' % str(ghenv.Component.InstanceGuid)

key = 'publisher_options2'
print key

if publish_topic:
    print("publish")
    if ros_client and ros_client.is_connected:
        print("publishing")
        publisher = Topic(ros_client, '/rhino/options2', 'std_msgs/Float32MultiArray')
        sticky[key] = publisher
    else:
        sticky[key] = None
else:
    sticky[key] = None
# ---------- end publish_2 ----------
panel_12 = Panel(publish_2)
panel_13 = Panel(timer_2.out)

# ==== cluster Elements

# ----
# Visualise the defined element
show = BooleanToggle(False)
show_2 = BooleanToggle(False)
show_3 = BooleanToggle(False)
elem_def = GhPythonScript()  # -> out, elem_y
# ---------- elem_def: Python ----------
import os
import sys
import json

from compas.geometry import Frame
from compas.geometry import Box
from human_robot_collaborative_assembly.assembly import HRCElement as Element

#element's dimensions
width = 0.024
length = 0.4
height = 0.048
a = 0.048

# element
box_frame = Frame([0, 0, height*1.5], [0, -1, 0], [1, 0, 0]) #center of the box frame 
box = Box(box_frame, length, width, height)
tool_frame = Frame([0, 0, height*2], [0, -1, 0], [1, 0, 0])
conn_frame_1 = Frame([-width, length-a, 0], [1, 0, 0], [0, 1, 0])
conn_frame_2 = Frame([width, -length+a, 0], [1, 0, 0], [0, 1, 0])

elem_y = Element.from_shape(box, box_frame)

#assign attributes
elem_y.tool_frame = tool_frame
elem_y.connector_frame_1 = conn_frame_1
elem_y.connector_frame_2 = conn_frame_2
elem_y._type = 'Y'
elem_y._base_frame = Frame([0, 0, 0], [1, 0, 0], [0, 1, 0])
# ---------- end elem_def ----------
draw = PythonScript(elem=elem_def.elem_y, show=show_2)  # -> M, F, C, B
# ---------- draw: Python ----------
from compas.geometry import Transformation
from compas.geometry import Frame
from compas.datastructures import mesh_transformed
from compas_ghpython.artists import MeshArtist
from compas_ghpython import draw_frame

connectors = []

connectors.append(elem.connector_frame_1)
connectors.append(elem.connector_frame_2)

if show:
    artist = MeshArtist(elem.mesh)
    M = artist.draw_mesh()
    F = draw_frame(elem.tool_frame)
    C = [draw_frame(frame) for frame in connectors]
    B = draw_frame(elem.frame)
# ---------- end draw ----------
elem_def_2 = GhPythonScript()  # -> out, elem_x
# ---------- elem_def_2: Python ----------
import os
import sys
import json

from compas.geometry import Frame
from compas.geometry import Box
from human_robot_collaborative_assembly.assembly import HRCElement as Element

#element'S dimensions
width = 0.024
length = 0.4
height = 0.048
a = 0.048

# element x
box_frame = Frame([0, 0, height/2.], [1, 0, 0], [0, 1, 0]) #center of the box frame 
box = Box(box_frame, length, width, height)
tool_frame =  Frame([0, 0, height], [1, 0, 0], [0, 1, 0])
conn_frame_1 = Frame([length-a, width, 0], [1, 0, 0], [0, 1, 0])
conn_frame_2 = Frame([-length+a, -width, 0], [1, 0, 0], [0, 1, 0])

elem_x = Element.from_shape(box, box_frame)

#assign attributes
elem_x.tool_frame = tool_frame
elem_x.connector_frame_1 = conn_frame_1
elem_x.connector_frame_2 = conn_frame_2
elem_x._type = 'X'
elem_x._base_frame = Frame([0, 0, 0], [1, 0, 0], [0, 1, 0])
# ---------- end elem_def_2 ----------
draw_2 = PythonScript(elem=elem_def_2.elem_x, show=show)  # -> M, F, C, F_2, T
# ---------- draw_2: Python ----------
from compas.geometry import Transformation
from compas.geometry import Frame
from compas.datastructures import mesh_transformed
from compas_ghpython.artists import MeshArtist
from compas_ghpython import draw_frame

connectors = []

connectors.append(elem.connector_frame_1)
connectors.append(elem.connector_frame_2)

if show:
    artist = MeshArtist(elem.mesh)
    M = artist.draw_mesh()
    C = [draw_frame(frame) for frame in connectors]
    F = draw_frame(elem.frame)
    T = draw_frame(elem.tool_frame)
# ---------- end draw_2 ----------
elem_def_3 = GhPythonScript()  # -> out, elem_z
# ---------- elem_def_3: Python ----------
import os
import sys
import json

from compas.geometry import Frame
from compas.geometry import Box
from human_robot_collaborative_assembly.assembly import HRCElement as Element

#element'S dimensions
width = 0.024
length = 0.4
height = 0.048
a = 0.048

# element z
box_frame = Frame([-width, 1.5*width, length/2.], [0, 0, 1], [-1, 0, 0]) #center of the box frame 
box = Box(box_frame, length, width, height)
tool_frame = Frame([-width, 0.5*width, length/2.], [0, 0, 1], [-1, 0, 0])
conn_frame_1 = Frame([width, 0, length-height], [1, 0, 0], [0, 1, 0])
conn_frame_2 = Frame([width, 0, -length + height], [1, 0, 0], [0, 1, 0])

elem_z = Element.from_shape(box, box_frame)

# assign attributes
elem_z.tool_frame = tool_frame
elem_z.connector_frame_1 = conn_frame_1
elem_z.connector_frame_2 = conn_frame_2
elem_z._type = 'Z'
elem_z._base_frame = Frame([0, 0, 0], [1, 0, 0], [0, 1, 0])
# ---------- end elem_def_3 ----------
draw_3 = PythonScript(elem=elem_def_3.elem_z, show=show_3)  # -> M, F, C, B
# ---------- draw_3: Python ----------
from compas.geometry import Transformation
from compas.geometry import Frame
from compas.datastructures import mesh_transformed
from compas_ghpython.artists import MeshArtist
from compas_ghpython import draw_frame

connectors = []

connectors.append(elem.connector_frame_1)
connectors.append(elem.connector_frame_2)

if show:
    artist = MeshArtist(elem.mesh)
    M = artist.draw_mesh()
    F = draw_frame(elem.tool_frame)
    C = [draw_frame(frame) for frame in connectors]
    B = draw_frame(elem._base_frame)
# ---------- end draw_3 ----------

elem_x = ClusterOutput(elem_def_2.elem_x)
elem_y = ClusterOutput(elem_def.elem_y)
elem_z = ClusterOutput(elem_def_3.elem_z)
