# Grasshopper definition ex1_design_tool_orthogonal.ghx (Grasshopper 1.0.7)

panel = Panel("Unload libraries")
# 1.
# Load initial assembly
bang = Button()
unload = PythonScript(bang=bang)
# ---------- unload: Python ----------
from compas_rhino.utilities.misc import get_tolerance
from compas_rhino.utilities.misc import unload_modules

unload_modules("robot_see_robot_do")
# ---------- end unload ----------

import = Button(ExpressionNormal="True", ExpressionPressed="False")
# Import initial assembly (first module)
py = PythonScript(import_from_json=import)  # -> HERE, DATA, import_from_json
# ---------- py: Python ----------
import os
from scriptcontext import sticky as st

HERE = os.path.dirname(ghdoc.Path)
DATA = os.path.abspath(os.path.join(HERE, "..", "data"))
print(HERE)
print(DATA)

st.clear()
st['DATA_PATH'] = DATA
# ---------- end py ----------
initial_assembly = GhPythonScript(DATA=py.DATA, import_from_json=py.import_from_json)  # -> out, assembly; inputs import_from_json: Boolean
# ---------- initial_assembly: Python ----------
import os
import json
from scriptcontext import sticky

from robot_see_robot_do.assembly_orthogonal import Assembly

#assembly = Assembly()

if import_from_json:
    #filename = "hrca/hrcassembly_initial_origin.json"
    #filename = "hrca_aggregation_3.json"
    filename = "json/hrca_current_assembly_2020_09_22_19_32_25.json"
    PATH = os.path.join(DATA, filename)
    assembly = Assembly.from_json(PATH)


#assembly.network.delete_node(6)

if assembly:
    counter = 1
    for key, elem, data in assembly.elements(data=True):
        data['frame_id'] = counter
        counter +=1
    
    sticky['assembly'] = assembly
# ---------- end initial_assembly ----------

x_axis = Curve(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)
y_axis = Curve(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)
plane = PythonScript(plane_axes=[x_axis, y_axis])  # -> plane; inputs plane_axes: list of Curve
# ---------- plane: Python ----------
import Rhino.Geometry as rg

x_axis, y_axis = plane_axes

x_axis = rg.Line(x_axis.PointAtStart, x_axis.PointAtEnd)
y_axis = rg.Line(y_axis.PointAtStart, y_axis.PointAtEnd)

if x_axis.From.DistanceTo(y_axis.From) < 0.01:
    origin = x_axis.From
    xvec = x_axis.Direction
    yvec = y_axis.Direction
elif x_axis.To.DistanceTo(y_axis.To) < 0.01:
    origin = x_axis.To
    xvec = -x_axis.Direction
    yvec = -y_axis.Direction
elif x_axis.From.DistanceTo(y_axis.To) < 0.01:
    origin = x_axis.From
    xvec = x_axis.Direction
    yvec = -y_axis.Direction
elif x_axis.To.DistanceTo(y_axis.From) < 0.01:
    origin = x_axis.To
    xvec = -x_axis.Direction
    yvec = y_axis.Direction

plane = rg.Plane(origin, xvec, yvec)
# ---------- end plane ----------

# ----
# Controls
rotate = Slider(0, range=0..90)
shift = Slider(0, range=-0.25..0.25)
t = Slider(85, range=0..180)
aggregate = Button()
element = Button()
element_2 = Button()
human = Button()
reset = Button()
robot = Button()
add = Button()
list = ValueList({"AA", "AB", "BA", "BB"}, selected="BA")
pts = Point([Point(3.668891747, 0.7107020001, 1.820186629), Point(2.035451837, 1.811883324, 0.1857535972)])

sph = Sphere(Base=pts, Radius=0.05)  # disabled
preview = CustomPreview(Geometry=sph, Material=ColourSwatch(SwatchColor=RGB(255, 92, 92)))  # disabled

# ----
# Assembly Definition
# Create an instance of the HRCElement class by inputing a box geomtry
show = BooleanToggle(False)
# 2.
globals = GhPythonScript()  # -> assembly
# ---------- globals: Python ----------
from robot_see_robot_do.assembly_orthogonal import Assembly

assembly = Assembly()

assembly.globals = {}

assembly.globals['radius'] = 0.01
assembly.globals['height'] = 1.0
assembly.globals['shift_value'] = 0.25
# ---------- end globals ----------
elem_def = GhPythonScript(assembly=globals)  # -> out, assembly, elem_x, elem_y, elem_z
# ---------- elem_def: Python ----------
import os
import sys
import json
import math

from compas.geometry import Frame, Plane, Rotation, Vector
from compas.geometry import Box, Circle, Cylinder, Translation
from compas.datastructures import Mesh

from robot_see_robot_do.assembly_orthogonal import Element

radius = assembly.globals['radius']
height = assembly.globals['height']
shift_value = assembly.globals['shift_value']


def create_rod(frame, elem_type):
    cross_section_plane = Plane.from_frame(Frame(frame.point, frame.yaxis, frame.zaxis))
    cross_section = Circle(cross_section_plane, radius)
    elem_geo = Cylinder(cross_section, height)
    
    T_conn_1 = Translation.from_vector(frame.xaxis*-(shift_value))
    T_conn_2 = Translation.from_vector(frame.xaxis*(shift_value))
    
    R = Rotation.from_axis_and_angle(frame.zaxis, math.radians(0), frame.point)

    elem_conn_frame_1 = frame.transformed(T_conn_1*R)
    elem_conn_frame_2 = frame.transformed(T_conn_2*R)
    
    elem = Element.from_shape(elem_geo, frame)
    
    elem.connector_frame_1 = elem_conn_frame_1
    elem.connector_frame_2 = elem_conn_frame_2
    elem._type = elem_type
    elem._base_frame = Frame([0, 0, 0], [1, 0, 0], [0, 1, 0])
    
    return elem


R1 = Rotation.from_axis_and_angle(Vector.Zaxis(), math.radians(90), [0,0,0])
R2 = Rotation.from_axis_and_angle(Vector.Xaxis(), math.radians(90), [0,0,0])


f1 = Frame.worldXY() #center of the box frame 
f2 = f1.transformed(R1)
f3 = f2.transformed(R2)


elem_x = create_rod(f1, 'X')
elem_y = create_rod(f2, 'Y')
elem_z = create_rod(f3, 'Z')

Tx = Translation.from_vector([height*shift_value, 0, radius*1.0])
Ty = Translation.from_vector([0, height*shift_value, radius*3.0])
Tz = Translation.from_vector([radius*2., radius*2.,height*shift_value])

elem_x.global_trnsf = Tx
elem_y.global_trnsf = Ty
elem_z.global_trnsf = Tz
# ---------- end elem_def ----------
draw = PythonScript(elements=elem_def.elem_x, show=show)  # -> M, F, C; inputs elements: list
# ---------- draw: Python ----------
from compas.artists import Artist

M = []
C = []
F = []
T = []
connectors = []

if show:
    for elem in elements:
        connectors.append(elem.connector_frame_1)
        connectors.append(elem.connector_frame_2)
        M += [Artist(elem._mesh).draw([0,0,1,1])]
        C += [Artist(frame).draw() for frame in connectors]
        F += [Artist(elem.frame).draw()]
        T += [Artist(elem.tool_frame).draw()]
# ---------- end draw ----------
pln = Plane(draw.F)
pln_2 = Plane(draw.C)

mesh = Mesh(draw.M)

custom_preview = CustomPreview(Geometry=mesh, Material=ColourSwatch(SwatchColor=RGB(221, 0, 0)))

# ----
# 3.
# Design Generation
initial_configuration = GhPythonScript(assembly=elem_def.assembly, elem_x=elem_def.elem_x, elem_y=elem_def.elem_y, elem_z=elem_def.elem_z)  # -> out, assembly, connector_planes
# ---------- initial_configuration: Python ----------
import Rhino.Geometry as rg
import math

from compas.geometry import Frame
from compas.geometry import Transformation
from compas.geometry import Rotation, Vector
from compas.geometry import Translation
from compas.geometry import Point

from compas.artists import Artist


radius = assembly.globals['radius']
height = assembly.globals['height']
shift_value = assembly.globals['shift_value']

# just for vizualisation
connector_planes = []



my_elem_x = elem_x.copy()
my_elem_y = elem_y.copy()
my_elem_z = elem_z.copy()

my_elem_x.connector_1_state = False
my_elem_y.connector_1_state = False
my_elem_z.connector_1_state = False

Tx = Translation.from_vector([height*shift_value, 0, 0])
Ty = Translation.from_vector([0, height*shift_value, radius*2])
Tz = Translation.from_vector([radius*2., radius*2.,height*shift_value])

my_elem_x.transform(Tx)
my_elem_y.transform(Ty)
my_elem_z.transform(Tz)


assembly.add_element(my_elem_x, elem_type = 'X', placed_by = 'human', frame_id=None)
assembly.add_element(my_elem_y, elem_type = 'Y', placed_by = 'human', frame_id=None)
assembly.add_element(my_elem_z, elem_type = 'Z', placed_by = 'human', frame_id=None)

assembly.network.add_edge(0, 1, edge_of = 'parent')
assembly.network.add_edge(0, 2, edge_of = 'parent')
assembly.network.add_edge(1, 2, edge_of = 'parent')

print assembly.connectors(state='open')

for connector in assembly.connectors(state='open'):
    for c in connector:
        connector_planes.append(Artist(c).draw())
# ---------- end initial_configuration ----------
pln_3 = Plane(initial_configuration.connector_planes)

# ----
# Transform Assembly
y_axis_2 = Curve(<curve referenced from the Rhino model>)
x_axis_2 = Curve(<curve referenced from the Rhino model>)
plane_2 = PythonScript(plane_axes=[x_axis_2, y_axis_2])  # -> plane; inputs plane_axes: list of Curve; same code as plane
transform = GhPythonScript(assembly=initial_configuration.assembly, transform=Toggle(True), trnsf_plane=plane_2)  # -> out, assembly
# ---------- transform: Python ----------
from compas.geometry import Frame
from compas.geometry import Transformation

if transform:
    T = Transformation.from_frame_to_frame(Frame.worldXY(), Frame(trnsf_plane.Origin, trnsf_plane.XAxis, trnsf_plane.YAxis))
    assembly.transform(T)
# ---------- end transform ----------

generate_assembly = GhPythonScript(
    assembly=transform.assembly,
    robot_base_plane=plane,
    angle_threshold=t,
    targets=pts,
    elem_up=element,
    elem_down=element_2,
    reset=reset,
    flip=list,
    shift_value=shift,
    angle=rotate,
    add_two=add,
    robot_adds=robot,
    human_adds=human,
    aggregate=aggregate)  # -> out, assembly, current_key, coll_mesh, tool_planes; inputs robot_base_plane: Plane, targets: list of Point3d
# ---------- generate_assembly: Python ----------
import Rhino.Geometry as rg
import rhinoscriptsyntax as rs
import math
import random
from scriptcontext import sticky as st
import sys

import ghpythonlib.components as ghcomp

from compas.geometry import Frame, Box, Point
from compas.geometry import Vector, Translation, angle_vectors
from compas.datastructures import mesh_offset
from compas.artists import Artist


from compas.rpc import Proxy

tool_planes = []                     # Tool planes
base_planes = [] 
filtered_keys = []
options = []

#bp = robot_base_plane
#robot_base_frame = Frame(bp.Origin, bp.XAxis, bp.YAxis)

L = list(assembly.elements())

def range_filter(options, robot_base_plane):
    ur_range_max = 1.2
    ur_range_min = 0.75
        
    base_point= Point(robot_base_plane.Origin.X, robot_base_plane.Origin.Y, robot_base_plane.Origin.Z)
    filtered_options = []
    for key, elem_origin, option_vector in options:
        v = Vector.from_start_end(elem_origin, base_point)
        dist = v.length
        if ur_range_min <= dist <= ur_range_max:
            filtered_options.append((key, elem_origin, option_vector))
    return filtered_options

def filter_options(all_options, target_points):
    tps = [Point(p.X, p.Y, p.Z) for p in target_points]
    filtered_options = []
    for tp in tps:
        for key, elem_origin, option_vector in all_options:
            v = Vector.from_start_end(elem_origin, tp)
            angle = angle_vectors(option_vector, v, deg=True)
            if angle < angle_threshold:
                filtered_options.append((key, elem_origin, option_vector))
    return filtered_options

all_options = []

for key, element in assembly.elements():
    for origin, vector in element.options_vectors(0.40):
        all_options.append((key, origin, vector))

assembly.all_options = all_options

filtered_options = filter_options(all_options, targets)
filtered_keys = []
#for option in filtered_options:
#    filtered_keys.append(option[0])
for option in all_options:
    filtered_keys.append(option[0])
    
filtered_keys = list(set(filtered_keys))
print filtered_keys

assembly.current_options = filtered_options


# store data in component
guid = str(ghenv.Component.InstanceGuid)
element_key = "elem_" + guid

if element_key not in st:
    st[element_key] = 0

if reset:
    st[element_key] = 0

if elem_up:
    if st[element_key] < len(filtered_keys) - 1:
        st[element_key] += 1

if elem_down:
    if st[element_key] <= len(filtered_keys) - 1:
        st[element_key] -= 1

    if st[element_key] < 1:
        st[element_key] = 0


current_key = filtered_keys[st[element_key]]
current_elem = assembly.network.node[current_key]['element']


# Robot adds first element
if robot_adds:
    assembly.add_unit_element(current_key, flip, shift_value, angle=90, placed_by ='robot', on_ground=True, unit_index=0)
    
# Human adds second element element
if human_adds:
    assembly.add_unit_element(current_key, flip, shift_value, angle=90, placed_by ='human', on_ground=True, unit_index=1)

# Add two elements
if add_two:
    assembly.close_unit(current_key, flip, shift_value, angle=90, on_ground = False)
    
if aggregate:
    for i in range (20):
        key_index = assembly.network.key_index()
        keys = [key_index[key] for key in assembly.network.nodes()]
        index = random.randint(0, len(keys)-1)
        shift_value = random.uniform(-0.25, 0.25)
        current_key = keys[index]
        current_elem = assembly.network.node[current_key]['element']
        elem_connector = assembly.element(current_key).connectors(state='open')
        if current_elem.connector_1_state or current_elem.connector_2_state:
            flip_index = random.randint(0, 3)
            flip = ['AA', 'AB', 'BA', 'BB'][flip_index]
            #random_angle = random.uniform(0., 360.)
            random_angle = 90
            assembly.close_unit(current_key, flip, shift_value, random_angle, on_ground = False)
            #assembly.range_filter(base_frame)
        else:
            print 'No open connectors'

key_index = assembly.network.key_index()
keys = [key_index[key] for key in assembly.network.nodes()]
new_keys = keys[-2:]
print(new_keys)

for key in keys:
    element = assembly.element(key)
    base_planes.append(Artist(element._base_frame).draw())
    tool_planes.append(Artist(element.tool_frame).draw())
    #print key, ':', assembly.network.node_attribute(key, 'elem_type')

"""

#Collision_check test
T = Translation.from_vector([0.1, -0.024 , 0])
new_elem = elem_x.transformed(T)
coll_mesh = Artist(new_elem.mesh).draw()

c = assembly.collision_check(new_elem, tolerance = -0.001)
#print c



### UNSOLVED: Error loading compas_cgal intersection module's .dll file ###

collision_func = Proxy('assembly_information_model.assembly.collision', python = 'C://Users//lidet//anaconda3//envs//cgal//python.exe')

print collision_func._python

collision_func.stop_server()
collision_func.start_server()

test = collision_func.collision_check_cgal(assembly, new_elem)
print test
"""
# ---------- end generate_assembly ----------
current_key = Panel(generate_assembly.current_key)
mesh_2 = Mesh(generate_assembly.coll_mesh)
pln_4 = Plane(generate_assembly.tool_planes)

# ----
# Visualization
# 1. Visualize assembly.
# 2. Visualize selected element & selected connector.
# 3. Visuilize all options.
# 4. Visuilize filtered options.
show_2 = BooleanToggle(True)
show_3 = BooleanToggle(True)
show_4 = BooleanToggle(True)
show_5 = BooleanToggle(False)
draw_2 = PythonScript(
    assembly=generate_assembly.assembly,
    show_assembly=show_2,
    show_selected=show_4,
    show_all_options=show_3,
    show_filtered_options=show_5,
    current_key=generate_assembly.current_key,
    flip=list,
    shift_value=shift)  # -> out, G_assembly, G_selected, G_option_human, G_option_robot, connector_planes, pr, vr, elem_option_robot; inputs current_key: Int32
# ---------- draw_2: Python ----------
import os
import sys
from scriptcontext import sticky as st
import Rhino.Geometry as rg
import rhinoscriptsyntax as rs

import math
from math import pi

from compas.artists import Artist
from compas.geometry import Frame
from compas.geometry import Transformation, Vector, Plane, Translation
from compas.geometry import distance_point_point


connector_planes = []
G_assembly = []
G_selected = []
G_option_robot = []
G_option_human = []
vr = []
pr = []
radius = assembly.globals['radius']

#shift_value = assembly.globals['shift_value']


key_index = assembly.network.key_index()
keys = [key_index[key] for key in assembly.network.nodes()]

current_element = assembly.element(current_key)
elem_options = assembly.element(current_key).options_elements(flip, radius, shift_value, angle=90)
elem_option_robot = elem_options[0] # elem for planning robot routine

if len(elem_options) != 0:
    elem_option = elem_options[0]
current_elem_type = current_element._type

robot_keys = list(assembly.network.nodes_where({'placed_by':'robot'}))
human_keys = list(assembly.network.nodes_where({'placed_by':'human'}))

robot_elements = [assembly.element(key) for key in robot_keys] 
human_elements = [assembly.element(key) for key in human_keys] 

def show(element, output_geo, color):
    mesh = Artist(element.mesh).draw(color)
    output_geo.append(mesh)

def show_multiple(elements, output_geo, color):
    for element in elements:
        mesh = Artist(element.mesh).draw(color)
        output_geo.append(mesh)

# Get all open connectors 
connectors = assembly.connectors(state = 'open')
# Visualize the open connector planes
connector_planes = [Artist(frame).draw() for elem_connectors in connectors for frame in elem_connectors]

# Visualise assembly
if show_assembly:
    for element in robot_elements:
        mesh = Artist(element.mesh).draw([0.7,0.7,0.7,0.1])
        G_assembly.append(mesh)
    for element in human_elements:
        mesh = Artist(element.mesh).draw([1.,0.7,0.65,0.1])
        G_assembly.append(mesh)

# Visualise current connector 
if show_selected:
    #show(current_element, G_selected, [0.3,0.4,1,1])
    if elem_options:
        #show_multiple(elem_options, G_options, [0.8,0.2,0.1,0.1])
        show(elem_options[0], G_option_robot, [0.8,0.2,0.1,0.1])
        show(elem_options[1], G_option_human, [0.5,0.7,0.65,0.5])
    else:
        connector_id = "no open connectors"

# Visualize all options
if show_all_options and not show_filtered_options:
    for key, origin, vector in assembly.all_options:
        vr.append(rg.Vector3d(*tuple(vector)))
        pr.append(rg.Point3d(origin.x, origin.y, origin.z))

# Visualize filtered options
if show_filtered_options and not show_all_options:
    for key, o, v in assembly.current_options:
        vr.append(rg.Vector3d(*tuple(v)))
        pr.append(rg.Point3d(o.x, o.y, o.z))
# ---------- end draw_2 ----------
mesh_3 = Mesh(draw_2.G_assembly)
mesh_4 = Mesh(draw_2.G_selected)
mesh_5 = Mesh(draw_2.G_option_human)
mesh_6 = Mesh(draw_2.G_option_robot)
pln_5 = Plane(draw_2.connector_planes)
pt = Point(draw_2.pr)
vec = Vector(draw_2.vr)
vdis = VectorDisplay(Anchor=pt, Vector=vec)
custom_preview_2 = CustomPreview(Geometry=mesh_3, Material=ColourSwatch(SwatchColor=RGB(255, 196, 196)))
preview_2 = CustomPreview(Geometry=mesh_6, Material=ColourSwatch(SwatchColor=RGB(255, 92, 92)))
custom_preview_3 = CustomPreview(Geometry=mesh_5, Material=ColourSwatch(SwatchColor=RGBA(178, 219, 212, 164)))

# ----
# Network Viz
number_slider = Slider(0, range=0..47)
show_6 = BooleanToggle(False)
network_viz = GhPythonScript(assembly=generate_assembly.assembly, show_network=show_6, key=number_slider)  # -> out, nodes, edges, current_node, current_node_neighbors; inputs key: Int32
# ---------- network_viz: Python ----------
import sys, os
import ghpythonlib.components as ghcomp
import compas
from compas.datastructures import Network
from compas_ghpython.artists import NetworkArtist
from compas_rhino.geometry import RhinoLine

import compas_ghpython
import Rhino.Geometry as rg


data = assembly.network.to_data()
network = Network.from_data(data)

print assembly.network.number_of_nodes()

def draw_network(network):
    """Draw a network in Grasshopper.
    """
    points = []
    for key, attr in network.nodes(True):
        points.append({
            'pos': network.node_coordinates(key),
        })

    lines = []
    for (u, v), attr in network.edges(True):
        lines.append({
            'start': network.node_coordinates(u),
            'end': network.node_coordinates(v),
        })

    points_rg = compas_ghpython.draw_points(points)
    lines_rg = compas_ghpython.draw_lines(lines)

    return points_rg, lines_rg

if show_network:
    nodes, edges = draw_network(network)
    
    current_node = {'pos': network.node_coordinates(key), 'radius': 0.03}
    current_node = compas_ghpython.draw_spheres([current_node])
    
    current_node_neighbors_keys = network.neighbors(key)
    current_node_neighbors = [{'pos': network.node_coordinates(key), 'radius': 0.02} for key in current_node_neighbors_keys]
    current_node_neighbors = compas_ghpython.draw_spheres(current_node_neighbors)
# ---------- end network_viz ----------
pt_2 = Point(network_viz.nodes)
line = Line(network_viz.edges)
brep = Brep(network_viz.current_node)
brep_2 = Brep(network_viz.current_node_neighbors)
preview_3 = CustomPreview(Geometry=brep_2, Material=ColourSwatch(SwatchColor=RGB(255, 207, 207)))
preview_4 = CustomPreview(Geometry=[brep, line], Material=ColourSwatch(SwatchColor=RGB(0, 0, 0)))

# ----
# Export .json
export = Button()
export_2 = Button()
py_2 = PythonScript()  # -> HERE, DATA
# ---------- py_2: Python ----------
import os

HERE = os.path.dirname(ghdoc.Path)
DATA = os.path.abspath(os.path.join(HERE, "..", "data"))
print(HERE)
print(DATA)
# ---------- end py_2 ----------
export_3 = PythonScript(DATA=py_2.DATA, assembly=generate_assembly.assembly, export_to_json=export, export_to_json_unity=export_2)
# ---------- export_3: Python ----------
import os
from compas.datastructures.mesh import mesh_quads_to_triangles
from compas.datastructures.mesh import mesh_unify_cycles

if export_to_json:
    
    filename = "rsrd_assembly.json"
    PATH = os.path.join(DATA, filename)
    
    # the assembly has to be serialized such that it can be called from CPython, True to enable pretty print
    assembly.to_json(PATH, True)
    

if export_to_json_unity:
    
    for key, e in assembly.elements():
    
        #convert to trimesh
        mesh_quads_to_triangles(e._mesh, check_angles=False)
        #mesh_unify_cycles(e._mesh)
        #print e._mesh.faces
        #print e._mesh.face_vertices(list(e._mesh.faces())[0])

    filename = "rsrd_assembly.json"
    PATH = os.path.join(DATA, filename)
    assembly.to_json(PATH)
# ---------- end export_3 ----------
