# Grasshopper definition ex2_design_tool_reciprocal.ghx (Grasshopper 1.0.7)

panel = Panel("Unload libraries")
bang = Button()
unload = PythonScript(bang=bang)
# ---------- unload: Python ----------
from compas_rhino.utilities.misc import get_tolerance
from compas_rhino.utilities.misc import unload_modules

unload_modules("robot_see_robot_do")
# ---------- end unload ----------

# ----
# Assembly Definition
# Create an element object.
reset = Button()
show = BooleanToggle(False)
globals = GhPythonScript(reset=reset)  # -> out, assembly
# ---------- globals: Python ----------
from robot_see_robot_do.assembly_reciprocal import Assembly

# create assembly
assembly = Assembly()

# create a dictionary to store global value in 
assembly.globals = {}

# define global values
assembly.globals['radius'] = 0.01
assembly.globals['height'] = 1.0
assembly.globals['rf_unit_offset'] = 0.30
assembly.globals['rf_unit_radius'] = 0.1

print assembly.globals
# ---------- end globals ----------
assembly_globals = Panel(globals.out)
pln = Plane(Plane(origin=(0.2976344104, -0.05, -0.03759997007), x=(-0.9921147013, 0, 0.1253332336), y=(0, 1, 0)))
pln_2 = Plane(Plane(origin=(-0.2976344104, 0.05, -0.03759997007), x=(-0.9921147013, 0, -0.1253332336), y=(0, -1, 0)))
elem_def = GhPythonScript(assembly=globals.assembly, conn_1=pln, conn_2=pln_2)  # -> assembly, elem
# ---------- elem_def: Python ----------
import os
import sys
import json
import math

from compas.geometry import Frame, Plane, Rotation, Vector, Point
from compas.geometry import Circle, Cylinder, Translation
from compas.artists import Artist

from robot_see_robot_do.assembly_reciprocal import Element

rf_unit_offset = assembly.globals['rf_unit_offset']
rf_unit_radius = assembly.globals['rf_unit_radius']
radius = assembly.globals['radius']
height = assembly.globals['height']

cross_section_plane = Plane.from_frame(Frame.worldYZ())
cross_section = Circle(cross_section_plane, radius)
elem_geo = Cylinder(cross_section, height)

elem = Element.from_shape(elem_geo, Frame.worldXY())

elem.connector_frame_1 = Frame(conn_1.Origin, conn_1.XAxis, conn_1.YAxis)
elem.connector_frame_2 = Frame(conn_2.Origin, conn_2.XAxis, conn_2.YAxis)

#elem.connector_frame_2 = Frame(Point(0.295, -0.050, -0.075), Vector(0.992, 0.000, -0.125), Vector(0.000, 1.000, 0.000))
# ---------- end elem_def ----------
draw = PythonScript(elements=elem_def.elem, show=show)  # -> M, F, C; inputs elements: list
# ---------- draw: Python ----------
from compas.artists import Artist

M = []
C = []
F = []
T = []
connectors = []

if show:
    for elem in elements:
        connectors.append(elem.connector_frame_1)
        connectors.append(elem.connector_frame_2)
        M += [Artist(elem._mesh).draw([0,0,1,1])]
        #C += [Artist(frame).draw() for frame in connectors]
        F += [Artist(elem.frame).draw()]
        T += [Artist(elem.tool_frame).draw()]
# ---------- end draw ----------
mesh = Mesh(draw.M)
pln_3 = Plane(draw.F)
pln_4 = Plane(draw.C)
custom_preview = CustomPreview(Geometry=mesh, Material=ColourSwatch(SwatchColor=RGB(221, 0, 0)))

py = PythonScript()  # -> HERE, DATA
# ---------- py: Python ----------
import os

HERE = os.path.dirname(ghdoc.Path)
DATA = os.path.abspath(os.path.join(HERE, "..", "data"))
print(HERE)
print(DATA)
# ---------- end py ----------

# ----
# Load assembly
# Import assembly from .json.
import = Button(ExpressionNormal="True", ExpressionPressed="False")
initial_assembly = GhPythonScript(DATA=py.DATA, import_from_json=import)  # -> out, assembly; inputs import_from_json: Boolean
# ---------- initial_assembly: Python ----------
import os
import json
from scriptcontext import sticky

from robot_see_robot_do.assembly_reciprocal import Assembly

if import_from_json:
    filename = "rsrd_assembly_2_rods.json"
    PATH = os.path.join(DATA, filename)
    assembly = Assembly.from_json(PATH)
# ---------- end initial_assembly ----------

show_2 = BooleanToggle(False)

x_axis = Curve(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)
y_axis = Curve(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)
plane = PythonScript(plane_axes=[x_axis, y_axis])  # -> plane; inputs plane_axes: list of Curve
# ---------- plane: Python ----------
import Rhino.Geometry as rg

x_axis, y_axis = plane_axes

x_axis = rg.Line(x_axis.PointAtStart, x_axis.PointAtEnd)
y_axis = rg.Line(y_axis.PointAtStart, y_axis.PointAtEnd)

if x_axis.From.DistanceTo(y_axis.From) < 0.01:
    origin = x_axis.From
    xvec = x_axis.Direction
    yvec = y_axis.Direction
elif x_axis.To.DistanceTo(y_axis.To) < 0.01:
    origin = x_axis.To
    xvec = -x_axis.Direction
    yvec = -y_axis.Direction
elif x_axis.From.DistanceTo(y_axis.To) < 0.01:
    origin = x_axis.From
    xvec = x_axis.Direction
    yvec = -y_axis.Direction
elif x_axis.To.DistanceTo(y_axis.From) < 0.01:
    origin = x_axis.To
    xvec = -x_axis.Direction
    yvec = y_axis.Direction

plane = rg.Plane(origin, xvec, yvec)
# ---------- end plane ----------

# ----
# Controls
rotate2 = Slider(258.32, range=0..360)
t = Slider(93, range=0..180)
human_adds = Button()
robot_adds = Button()
aggregate = Button()
element = Button()
element_2 = Button()
reset_key = Button()
add_two = Button()
filter = BooleanToggle(True)
flip = BooleanToggle(True)
list = ValueList({"1-1": "AA", "1-2": "AB", "2-1": "BA", "2-2": "BB"}, selected="1-2")
pts = Point([Point(0.6575132187, 2.950100609, 1.820186629), Point(-1.947109743, 1.886344314, 0.1857535972)])
angle1 = Number(120)

# ----
# Design Generation
initial_configuration = GhPythonScript(assembly=elem_def.assembly, elem=elem_def.elem)  # -> out, assembly, connector_planes
# ---------- initial_configuration: Python ----------
import Rhino.Geometry as rg
import math
from scriptcontext import sticky as st

from compas.geometry import Frame, Vector
from compas.geometry import Rotation, Translation, Transformation
from compas.geometry import Point
from compas.artists import Artist


# just for vizualisation
connector_planes = []

radius = assembly.globals['radius']
height = assembly.globals['height']
rf_unit_offset = assembly.globals['rf_unit_offset']
rf_unit_radius = assembly.globals['rf_unit_radius']

T = Translation.from_vector([-rf_unit_offset, rf_unit_radius/2., 0])
elem_1 = elem.transformed(T)

R_elem = Rotation.from_axis_and_angle(elem_1.frame.yaxis, math.radians(-7.2), elem_1.frame.point)
elem_1.transform(R_elem)

R1 = Rotation.from_axis_and_angle(Vector.Zaxis(), math.radians(120), [0,0,0])
R2 = Rotation.from_axis_and_angle(Vector.Zaxis(), math.radians(240), [0,0,0])

elem_2 = elem_1.transformed(R1)
elem_3 = elem_1.transformed(R2)

elem_1.connector_1_state = False
elem_1.connector_2_state = True

elem_2.connector_1_state = False
elem_2.connector_2_state = False

elem_3.connector_1_state = False
elem_3.connector_2_state = False


assembly.add_element(elem_1, placed_by = 'initial', frame_id=None)
assembly.add_element(elem_2, placed_by = 'initial', frame_id=None)
assembly.add_element(elem_3, placed_by = 'initial', frame_id=None)

assembly.network.add_edge(0, 1, edge_of = 'parent')
assembly.network.add_edge(0, 2, edge_of = 'parent')
assembly.network.add_edge(1, 2, edge_of = 'parent')


options = assembly.element(1).options_vectors(0.4)


vr=[]
pr=[]

print options
for o, v in options:
    start = assembly.element(0).frame.point
    vr.append(rg.Vector3d(*tuple(v)))
    pr.append(rg.Point3d(o.x, o.y, o.z))


print assembly.connectors(state='open')

connector_planes = [Artist(connector).draw() for connectors in assembly.connectors(state='open') for connector in connectors]
# ---------- end initial_configuration ----------
pln_5 = Plane(initial_configuration.connector_planes)

# ----
# Transform Assembly
pt = Point(Point(0.8066418178, -0.2191574706, 0.4222242235))
x = Curve(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)
y = Curve(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)
pl = ConstructPlane(Origin=pt, XAxis=x, YAxis=y)
transform = GhPythonScript(assembly=initial_configuration.assembly, transform=Toggle(True), trnsf_plane=pl)  # -> out, assembly, planes
# ---------- transform: Python ----------
from compas.geometry import Frame
from compas.geometry import Transformation, Translation
import Rhino.Geometry as rg

from compas.artists import Artist

planes = []

trnsf_plane.Transform(rg.Transform.Translation(0.03,0,0))

if transform:
    T = Transformation.from_frame_to_frame(Frame.worldXY(), Frame(trnsf_plane.Origin, trnsf_plane.XAxis, trnsf_plane.YAxis))
    assembly.transform(T)
    assembly.network.transform(T)
    
    
for key, element in assembly.elements():
    planes.append(Artist(element.frame).draw())
# ---------- end transform ----------

# ----
# Add support
toggle = BooleanToggle(True)
pln_6 = Plane(Plane(origin=(0.8284965546, -0.116329934, 0.3446181635), x=(0.5836778286, 0.5396858127, -0.6066790058), y=(0.6788954185, -0.7342349834, 0)))
support = GhPythonScript(assembly=transform.assembly, add_support=toggle, elem=elem_def.elem, support_plane=pln_6)  # -> out, support_geo, assembly, elem_plane
# ---------- support: Python ----------
from compas.geometry import Frame, Transformation
from compas.artists import Artist
import Rhino.Geometry as rg

support_plane.Transform(rg.Transform.Translation(0.03,0,0))

T_support = Transformation.from_frame(Frame(support_plane.Origin, -support_plane.XAxis, support_plane.YAxis))
added_support_elem = elem.transformed(T_support)

if add_support:
    support_geo = Artist(added_support_elem.mesh).draw()

added_support_elem.connector_frame_1 = Frame.worldXY()
added_support_elem.connector_frame_2 = Frame.worldXY()

added_support_elem.connector_1_state = False
added_support_elem.connector_2_state = False

assembly.add_element(added_support_elem, placed_by = 'initial', frame_id=None)

elem_plane = Artist(added_support_elem.frame).draw()
# ---------- end support ----------
pln_7 = Plane(support.elem_plane)
mesh_2 = Mesh(support.support_geo)

generate_assembly = GhPythonScript(
    assembly=support.assembly,
    robot_base_plane=plane,
    angle_threshold=t,
    targets=pts,
    filter_options=filter,
    element_up=element_2,
    element_down=element,
    reset=reset_key,
    flip=list,
    angle1=angle1,
    angle2=rotate2,
    flip_human_robot=flip,
    add_two=add_two,
    robot_adds=robot_adds,
    human_adds=human_adds,
    aggregate=aggregate)  # -> out, assembly, current_key, coll_mesh; inputs robot_base_plane: Plane, targets: list of Point3d
# ---------- generate_assembly: Python ----------
import Rhino.Geometry as rg
import rhinoscriptsyntax as rs
import math
import random
from scriptcontext import sticky as st
import sys

import ghpythonlib.components as ghcomp

from compas.geometry import Frame, Box, Point
from compas.geometry import Vector, Translation, angle_vectors
from compas.datastructures import mesh_offset
from compas.artists import Artist

from compas.rpc import Proxy

all_options = []
filtered_keys = []
current_keys = []

L = list(assembly.elements())

def range_filter(options, robot_base_plane):
    ur_range_max = 1.2
    ur_range_min = 0.75
        
    base_point= Point(robot_base_plane.Origin.X, robot_base_plane.Origin.Y, robot_base_plane.Origin.Z)
    filtered_options = []
    for key, elem_origin, option_vector in options:
        v = Vector.from_start_end(elem_origin, base_point)
        dist = v.length
        if ur_range_min <= dist <= ur_range_max:
            filtered_options.append((key, elem_origin, option_vector))
    return filtered_options

def options_filter(all_options, target_points):
    tps = [Point(p.X, p.Y, p.Z) for p in target_points]
    filtered_options = []
    for tp in tps:
        for key, elem_origin, option_vector in all_options:
            v = Vector.from_start_end(elem_origin, tp)
            angle = angle_vectors(option_vector, v, deg=True)
            if angle < angle_threshold:
                filtered_options.append((key, elem_origin, option_vector))
    return filtered_options

for key, element in assembly.elements():
    for origin, vector in element.options_vectors(0.40):
        all_options.append((key, origin, vector))

#####   OPTIONS   #####
# all options
assembly.all_options = all_options

# filtered options
filtered_options = options_filter(all_options, targets)
assembly.filtered_options = filtered_options

# current options
current_options_map = {0:all_options, 1: filtered_options}

assembly.current_options = current_options_map[filter_options]

for option in current_options_map[filter_options]:
    current_keys.append(option[0])

current_keys = list(set(current_keys))
print 'Current keys:', current_keys

##### SELECTION #####
guid = str(ghenv.Component.InstanceGuid)
element_key = "elem_" + guid

if element_key not in st:
    st[element_key] = 0

if reset:
    st[element_key] = 0

if element_up:
    if st[element_key] < len(current_keys) - 1:
        st[element_key] += 1

if element_down:
    if st[element_key] <= len(current_keys) - 1:
        st[element_key] -= 1

    if st[element_key] < 1:
        st[element_key] = 0

if len(current_keys):
    current_key = current_keys[st[element_key]]
    current_elem = assembly.network.node[current_key]['element']
else:
    current_key = None
    current_elem = None

    
# Robot adds first element
if robot_adds:
    assembly.add_unit_element(current_key, flip, angle1, angle2, placed_by ='robot', on_ground=False, unit_index=0)
    
# Human adds second element element
if human_adds:
    assembly.add_unit_element(current_key, flip, angle1, angle2, placed_by ='human', on_ground=False, unit_index=1)

# Add two elements
if add_two:
    assembly.close_unit(current_key, flip, angle1, angle2, on_ground = False)

# random growth
if aggregate:
    for i in range (20):
        key_index = assembly.network.key_index()
        keys = [key_index[key] for key in assembly.network.nodes()]
        index = random.randint(0, len(keys)-1)
        current_key = keys[index]
        current_elem = assembly.network.node[current_key]['element']
        elem_connector = assembly.element(current_key).connectors(state='open')
        if current_elem.connector_1_state or current_elem.connector_2_state:
            flip_index = random.randint(0, 3)
            flip = ['AA', 'AB', 'BA', 'BB'][flip_index]
            random_angle1 = random.uniform(0., 360.)
            random_angle2 = random.uniform(0., 360.)
            #random_angle1 = 0
            #random_angle2 = 0
            assembly.close_unit(current_key, flip, random_angle1, random_angle2, on_ground = False)
            #assembly.range_filter(robot_base_frame)
        else:
            print 'No open connectors'

key_index = assembly.network.key_index()
keys = [key_index[key] for key in assembly.network.nodes()]
new_keys = keys[-2:]
print 'Last added keys:', new_keys

for key in keys:
    element = assembly.element(key)


"""
#Collision_check test
T = Translation.from_vector([0.1, -0.024 , 0])
new_elem = elem_x.transformed(T)
coll_mesh = Artist(new_elem.mesh).draw()

c = assembly.collision_check(new_elem, tolerance = -0.001)
#print c


### UNSOLVED: Error loading compas_cgal intersection module's .dll file ###

collision_func = Proxy('assembly_information_model.assembly.collision', python = 'C://Users//lidet//anaconda3//envs//cgal//python.exe')

print collision_func._python

collision_func.stop_server()
collision_func.start_server()

test = collision_func.collision_check_cgal(assembly, new_elem)
print test
"""
# ---------- end generate_assembly ----------
current_key = Panel(generate_assembly.current_key)
mesh_3 = Mesh(generate_assembly.coll_mesh)
status_update = Panel(generate_assembly.out)

# ----
# Visualization
# 1. Visualize assembly.
# 2. Visualize selected option.
# 3. Visuilize current options (all/filtered).
show_3 = BooleanToggle(True)
show_4 = BooleanToggle(True)
show_5 = BooleanToggle(True)
draw_2 = PythonScript(
    assembly=generate_assembly.assembly,
    show_assembly=show_3,
    show_option=show_4,
    show_arrows=show_5,
    show_keys=show_2,
    filter_options=filter,
    current_key=generate_assembly.current_key,
    flip=list,
    angle1=angle1,
    angle2=rotate2,
    flip_human_robot=flip)  # -> out, G_initial, G_built_by_human, G_built_by_robot, G_selected, G_option_human, G_option_robot, connector_planes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; inputs current_key: Int32
# ---------- draw_2: Python ----------
import os
import sys
from scriptcontext import sticky as st
import Rhino.Geometry as rg

import math
from math import pi

from compas.artists import Artist

connector_planes = []
G_initial = []
G_built_by_human = []
G_built_by_robot = []
G_option_robot = []
G_option_human = []
vr = []
pr = []

tag_text = []
tag_point = []

radius = assembly.globals['radius']

def show(element, output_geo, color):
    mesh = Artist(element.mesh).draw(color)
    output_geo.append(mesh)

def show_multiple(elements, output_geo, color):
    for element in elements:
        mesh = Artist(element.mesh).draw(color)
        output_geo.append(mesh)
        
if current_key != None:
    current_element = assembly.element(current_key)
    elem_options = assembly.element(current_key).options_elements(flip, angle1, angle2)
else:
    current_element = None
    elem_options = []

if len(elem_options) != 0:
    elem_option = elem_options[0]

if flip_human_robot:
    elem_options.reverse()

print elem_options

robot_keys = list(assembly.network.nodes_where({'placed_by':'robot'}))
human_keys = list(assembly.network.nodes_where({'placed_by':'human'}))
initial_keys = list(assembly.network.nodes_where({'placed_by':'initial'}))

robot_elements = [assembly.element(key) for key in robot_keys] 
human_elements = [assembly.element(key) for key in human_keys] 
initial_elements = [assembly.element(key) for key in initial_keys] 

# Visualize all open connector frames
connector_planes = [Artist(frame).draw() for elem_connectors in assembly.connectors(state='open') for frame in elem_connectors]

# Visualize assembly
if show_assembly:
    for element in robot_elements:
        mesh = Artist(element.mesh).draw([0.7,0.7,0.75,0.1])
        G_built_by_robot.append(mesh)
    for element in human_elements:
        mesh = Artist(element.mesh).draw([1.,0.7,0.65,0.1])
        G_built_by_human.append(mesh)
    for element in initial_elements:
        mesh = Artist(element.mesh).draw([0.8,0.8,0.8,0.1])
        G_initial.append(mesh)

# Visualise current connector 
if show_option and show_assembly:
    if elem_options:
        show(elem_options[0], G_option_robot, [0.7,0.9,0.9,0.8])
        show(elem_options[1], G_option_human, [0.8,0.2,0.1,0.1])
    else:
        print('No open connectors')

# Visualize all options
if show_arrows and show_assembly:
    if filter_options:
        for key, o, v in assembly.current_options:
            vr.append(rg.Vector3d(*tuple(v)))
            pr.append(rg.Point3d(o.x, o.y, o.z))
    else:
        for key, origin, vector in assembly.all_options:
            vr.append(rg.Vector3d(*tuple(vector)))
            pr.append(rg.Point3d(origin.x, origin.y, origin.z))

elem_option_robot = elem_options[0] # elem for planning robot routine


if show_keys:
    for key, element in assembly.elements():
        tag_text.append(str(key))
        tag_point.append(Artist(element.frame).draw().Origin)
# ---------- end draw_2 ----------
vec = Vector(draw_2.vr)
tag = TextTag(Location=draw_2.tag_point, Text=draw_2.tag_text)
mesh_4 = Mesh(draw_2.G_built_by_human)
mesh_5 = Mesh(draw_2.G_built_by_robot)
mesh_6 = Mesh(draw_2.G_selected)
mesh_7 = Mesh(draw_2.G_option_human)
mesh_8 = Mesh(draw_2.G_option_robot)
pln_8 = Plane(draw_2.connector_planes)
pt_2 = Point(draw_2.pr)
mesh_9 = Mesh(draw_2.G_initial)
vdis = VectorDisplay(Anchor=pt_2, Vector=vec)
custom_preview_2 = CustomPreview(Geometry=mesh_9, Material=ColourSwatch(SwatchColor=RGBA(189, 189, 189, 197)))
custom_preview_3 = CustomPreview(Geometry=mesh_4, Material=ColourSwatch(SwatchColor=RGB(255, 196, 196)))
custom_preview_4 = CustomPreview(Geometry=mesh_5, Material=ColourSwatch(SwatchColor=RGBA(154, 196, 212, 164)))
preview = CustomPreview(Geometry=mesh_7, Material=ColourSwatch(SwatchColor=RGB(255, 92, 92)))
custom_preview_5 = CustomPreview(Geometry=mesh_8, Material=ColourSwatch(SwatchColor=RGBA(178, 219, 212, 164)))

# ----
# Network Viz
number_slider = Slider(0, range=0..47)
show_6 = BooleanToggle(False)
network_viz = GhPythonScript(assembly=generate_assembly.assembly, show_network=show_6, key=number_slider)  # -> out, nodes, edges, current_node, current_node_neighbors; inputs key: Int32
# ---------- network_viz: Python ----------
import sys, os
import ghpythonlib.components as ghcomp
from compas.datastructures import Network
from compas_ghpython.artists import NetworkArtist
from compas_rhino.geometry import RhinoLine

import compas_ghpython
import Rhino.Geometry as rg


data = assembly.network.to_data()
network = Network.from_data(data)

print assembly.network.number_of_nodes()

def draw_network(network):
    """Draw a network in Grasshopper.
    """
    points = []
    for key, attr in network.nodes(True):
        points.append({
            'pos': network.node_coordinates(key),
        })

    lines = []
    for (u, v), attr in network.edges(True):
        lines.append({
            'start': network.node_coordinates(u),
            'end': network.node_coordinates(v),
        })

    points_rg = compas_ghpython.draw_points(points)
    lines_rg = compas_ghpython.draw_lines(lines)

    return points_rg, lines_rg

if show_network:
    nodes, edges = draw_network(network)
    
    current_node = {'pos': network.node_coordinates(key), 'radius': 0.03}
    current_node = compas_ghpython.draw_spheres([current_node])
    
    current_node_neighbors_keys = network.neighbors(key)
    current_node_neighbors = [{'pos': network.node_coordinates(key), 'radius': 0.02} for key in current_node_neighbors_keys]
    current_node_neighbors = compas_ghpython.draw_spheres(current_node_neighbors)
# ---------- end network_viz ----------
pt_3 = Point(network_viz.nodes)
line = Line(network_viz.edges)
brep = Brep(network_viz.current_node)
brep_2 = Brep(network_viz.current_node_neighbors)
preview_2 = CustomPreview(Geometry=[brep, line], Material=ColourSwatch(SwatchColor=RGB(0, 0, 0)))
preview_3 = CustomPreview(Geometry=brep_2, Material=ColourSwatch(SwatchColor=RGB(255, 207, 207)))

# ----
# Export .json
export = Button()
export_2 = Button()
export_3 = PythonScript(DATA=py.DATA, assembly=generate_assembly.assembly, export_to_json=export, export_to_json_unity=export_2)
# ---------- export_3: Python ----------
import os
from compas.datastructures.mesh import mesh_quads_to_triangles
from compas.datastructures.mesh import mesh_unify_cycles



if export_to_json:
    filename = "rsrd_assembly_initial.json"
    PATH = os.path.join(DATA, filename)
    
    # the assembly has to be serialized such that it can be called from CPython, True to enable pretty print
    assembly.to_json(PATH, True)
    

if export_to_json_unity:
    
    for key, e in assembly.elements():
    
        #convert to trimesh
        mesh_quads_to_triangles(e._mesh, check_angles=False)
        #mesh_unify_cycles(e._mesh)
        #print e._mesh.faces
        #print e._mesh.face_vertices(list(e._mesh.faces())[0])

    filename = "rsrd_assembly.json"
    PATH = os.path.join(DATA, filename)
    assembly.to_json(PATH)
# ---------- end export_3 ----------
