# Grasshopper definition ex2_ur_moveit_simulation_playground.ghx (Grasshopper 1.0.7)

disconnect = Button()
connect = Button()

# ----
# Load robot from local package
list = ValueList({"ur_description", "ur_e_description", "ur_setups"}, selected="ur_e_description")
list_2 = ValueList({"ur3.urdf", "ur3_rot.urdf", "ur5.urdf", "ur10.urdf", "ur3e.urdf", "ur5e.urdf", "ur10e.urdf", "ur10e_rot.urdf"}, selected="ur10e_rot.urdf")
list_3 = ValueList({"ur3.srdf", "ur5.srdf", "ur10.srdf", "ur3e.srdf", "ur5e.srdf", "ur10e.srdf"}, selected="ur10e.srdf")
py = PythonScript()  # -> DATA
# ---------- py: Python ----------
import os
import getpass

username = getpass.getuser()
USER_FOLDER = os.path.abspath(os.path.join("C:/Users/", username))
DATA = os.path.abspath(os.path.join(USER_FOLDER,"workspace/projects/ur_fabrication_control/data"))

print(USER_FOLDER)
print(DATA)
# ---------- end py ----------
py_2 = PythonScript(data_path=py, package=list, urdf_name=list_2, srdf_name=list_3)  # -> loaders, urdf_filename, srdf_filename
# ---------- py_2: Python ----------
import os
from compas.robots import LocalPackageMeshLoader

path = os.path.join(data_path, "robot_description")

#loaders
packages = ["ur_description", "ur_e_description", "ur_end_effectors", "ur_setups"]
loaders = [LocalPackageMeshLoader(path, pck) for pck in packages]

#files
package_path = os.path.join(path, package)
print package_path

urdf_filename = os.path.join(package_path, "urdf", urdf_name)
srdf_filename = os.path.join(package_path, srdf_name)

assert os.path.isfile(urdf_filename)
assert os.path.isfile(srdf_filename)
# ---------- end py_2 ----------

plate = Brep(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)

# ----
# Input
pt = Point(Point(0.4148048473, 0.0806959495, 0.2818520837))
pt_2 = Point(Point(0.62116715, 0.5299532239, 0.3015280014))
panel = Panel("Start plane")
panel_2 = Panel("End plane")
py_3 = GhPythonScript(pt=pt)  # -> pln
# ---------- py_3: Python ----------
import Rhino.Geometry as rg

pln = rg.Plane(pt, -rg.Vector3d.ZAxis)
# ---------- end py_3 ----------
py_4 = GhPythonScript(pt=pt_2)  # -> pln; same code as py_3
end_plane = Plane(py_3)
start_plane = Plane(py_4)

# ----
# Tool
list_4 = ValueList({"measurement_tool": 0, "air_pick_15mm": 1, "area_gripper": 2, "parallel_gripper": 3}, selected="measurement_tool")
panel_3 = Panel("Attach a custom tool")
show = BooleanToggle(False)
python = PythonScript(data_path=py, tool=list_4, show=show)  # -> tool, M, compas_mesh
# ---------- python: Python ----------
import os, math
from compas.geometry import Frame, Rotation
from compas.datastructures import Mesh
from compas_ghpython.artists import MeshArtist
from compas_fab.robots import Tool

tolerance = 0


if tool == 0:
    filename = 'measurement_tool_zaxis.stl'
    ee_frame = Frame([0, 0, 0.109], [1, 0, 0], [0, 1, 0])

elif tool == 1:
    filename = 'airpick_15.stl'
    ee_frame = Frame([0, 0, 0.158 + tolerance], [1, 0, 0], [0, 1, 0])
    
elif tool == 2:
    filename = 'airpick_40.stl'
    ee_frame = Frame([0, 0, 0.158 + tolerance], [1, 0, 0], [0, 1, 0])

elif tool == 3:
    filename = 'area_gripper_zaxis.stl'
    ee_frame = Frame([0, 0, 0.10219 + tolerance], [1, 0, 0], [0, 1, 0])

elif tool == 4:
    filename = 'parallel_gripper_zaxis.stl'
    ee_frame = Frame([0, 0, 0.176 + tolerance], [1, 0, 0], [0, 1, 0])    
    
data_path = os.path.join(data_path, "tool_geometry")
fullfilename = os.path.join(data_path, filename)
print fullfilename

ee_mesh = Mesh.from_stl(fullfilename)

#R = Rotation.from_axis_and_angle(ee_frame.zaxis, math.radians(180), point=ee_frame.point)
#ee_frame.transform(R)

if show:
    artist = MeshArtist(ee_mesh)
    M = artist.draw()

tool = Tool(ee_mesh, ee_frame)
compas_mesh = ee_mesh
# ---------- end python ----------

# ---- group: ROS client
list_5 = ValueList({"local": 0, "linux computer": 1}, selected="local")

# ----
connect_2 = PythonScript(ip=list_5, connect=connect, disconnect=disconnect)  # -> out, ros_client
# ---------- connect_2: Python ----------
import sys
import scriptcontext as sc
from compas_fab.backends import RosClient

key = 'rosclient_%s' % str(ghenv.Component.InstanceGuid)
previous_client = sc.sticky.get(key, None)

if previous_client and (connect or disconnect):
    previous_client.close()

if connect:
    if ip == 0: #local, own laptop
        ros_client = RosClient('127.0.0.1', 9090)
    elif ip == 1: # linux computer
        ros_client = RosClient('10.181.163.92', 9090)
    sc.sticky[key] = ros_client
    ros_client.run(5)

ros_client = sc.sticky.get(key, None)
print('ROS connected: {}'.format(ros_client.is_connected if ros_client else 'False'))
# ---------- end connect_2 ----------

# ---- group: ROS client (continued)
is_connected = Panel(connect_2.out)
ros_client = Data(connect_2.ros_client)

# ----
# Robot
units = ValueList({"m": 1, "cm": 100, "mm": 1000}, selected="m")
load = Button()
create = PythonScript(load=load, loaders=py_2.loaders, urdf_filename=py_2.urdf_filename, srdf_filename=py_2.srdf_filename, scale_factor=units)  # -> out, robot; inputs load: Boolean, loaders: list
# ---------- create: Python ----------
import os
from scriptcontext import sticky as st

import compas

from compas.robots import RobotModel
from compas.robots import LocalPackageMeshLoader

from compas_fab.robots import Robot
from compas_fab.robots import RobotSemantics

from compas_fab.ghpython import RobotArtist

compas.PRECISION = '12f'

# store robot in component
guid = str(ghenv.Component.InstanceGuid)
robot_key = "robot_" + guid

if robot_key not in st:
    st[robot_key] = None

print loaders
if load:
    model = RobotModel.from_urdf_file(urdf_filename)
    
    model.load_geometry(*loaders)
    artist = RobotArtist(model)
    semantics = RobotSemantics.from_srdf_file(srdf_filename, model)
    robot = Robot(model, artist, semantics, client=None)

    
    st[robot_key] = robot

robot = st[robot_key]


if robot:
    robot.scale(scale_factor)
# ---------- end create ----------
set = PythonScript(robot=create.robot, client=ros_client)  # -> robot
# ---------- set: Python ----------
if robot and client:
    robot.client = client
# ---------- end set ----------
robot = Data(set)

# ----
# Base
x_axis = Curve(<curve referenced from the Rhino model>)
y_axis = Curve(<curve referenced from the Rhino model>)
x_axis_2 = Curve(<curve referenced from the Rhino model>)
y_axis_2 = Curve(<curve referenced from the Rhino model>)
plane = PythonScript(plane_axes=[x_axis, y_axis])  # -> plane; inputs plane_axes: list of Curve
# ---------- plane: Python ----------
import Rhino.Geometry as rg

x_axis, y_axis = plane_axes

x_axis = rg.Line(x_axis.PointAtStart, x_axis.PointAtEnd)
y_axis = rg.Line(y_axis.PointAtStart, y_axis.PointAtEnd)

if x_axis.From.DistanceTo(y_axis.From) < 0.01:
    origin = x_axis.From
    xvec = x_axis.Direction
    yvec = y_axis.Direction
elif x_axis.To.DistanceTo(y_axis.To) < 0.01:
    origin = x_axis.To
    xvec = -x_axis.Direction
    yvec = -y_axis.Direction
elif x_axis.From.DistanceTo(y_axis.To) < 0.01:
    origin = x_axis.From
    xvec = x_axis.Direction
    yvec = -y_axis.Direction
elif x_axis.To.DistanceTo(y_axis.From) < 0.01:
    origin = x_axis.To
    xvec = -x_axis.Direction
    yvec = y_axis.Direction

plane = rg.Plane(origin, xvec, yvec)
# ---------- end plane ----------
plane_2 = PythonScript(plane_axes=[x_axis_2, y_axis_2])  # -> plane; inputs plane_axes: list of Curve; same code as plane
geo = Geometry([<brep referenced from the Rhino model> x39, <curve referenced from the Rhino model>, <brep referenced from the Rhino model> x4])
base = PythonScript(base_plane=plane, pickup_plane=plane_2)  # -> base_frame, pick_frame
# ---------- base: Python ----------
from compas.geometry import Frame
from compas.geometry import Transformation, Rotation
from compas_ghpython import draw_frame
import math
import Rhino.Geometry as rg



base_frame = Frame(base_plane.Origin, base_plane.XAxis, base_plane.YAxis)

pickup_frame = Frame(pickup_plane.Origin, pickup_plane.XAxis, pickup_plane.YAxis)
# ---------- end base ----------
py_5 = PythonScript(robot=robot, base_frame=base.base_frame, base_geo=geo, pickup_frame=base.pick_frame, set_to_base_frame=Toggle(False))  # -> a; inputs base_geo: list, set_to_base_frame: Boolean
# ---------- py_5: Python ----------
from compas_ghpython import draw_frame
from compas.geometry import Frame, Point, Vector, Transformation



frame_zero = Frame(Point(0.000, 0.000, 0.000), Vector(1.000, 0.000, 0.000), Vector(0.000, 1.000, 0.000))
print base_frame

if set_to_base_frame == True:
    #print robot.model.get_link_by_name(robot.get_base_link_name()).parent_joint
    #robot.model.get_link_by_name(robot.get_base_link_name()).parent_joint.origin = base_frame
    robot.model.base_frame_temp = base_frame
else:
    #robot.model.get_link_by_name(robot.get_base_link_name()).parent_joint.origin = frame_zero
    robot.model.base_frame_temp = frame_zero

#print robot.transformation_RCF_WCF()
#print robot.get_base_frame(group=None, full_configuration=None)

robot.model.base_geo_temp = base_geo
robot.model.pickup_frame_temp = pickup_frame



"""
print robot.model.links[0].name

frame = Frame(Point(0.300, 1.000, 0.000), Vector(1.000, 0.000, 0.000), Vector(0.000, 1.000, 0.000))
T = Transformation.from_frame(frame)

#robot.model.get_link_by_name(robot.get_base_link_name()).parent_joint.transform(T)
#robot.model.get_link_by_name(robot.get_base_link_name()).joints[0].origin = frame
#robot.model.get_link_by_name('shoulder_link').parent_joint.transform(T)
print robot.model.get_link_by_name('shoulder_link').parent_joint.origin
print robot.model.get_link_by_name(robot.get_base_link_name()).parent_joint.origin

print robot.get_configurable_joint_names()

print robot.model.links[0]

print robot.get_base_link_name(group=None)
print robot.get_base_frame(group=None, full_configuration=None)

print robot.get_end_effector_link_name(group=None)
print robot.get_link_names()

"""

#f = robot.model.joints[0].origin
#p = draw_frame(f)
# ---------- end py_5 ----------

py_6 = PythonScript(robot=robot, tool=python.tool, attach=Toggle(True))  # -> a
# ---------- py_6: Python ----------
if attach:
    robot.attach_tool(tool)
else:
    robot.detach_tool()
# ---------- end py_6 ----------

# ----
# Planning scene
scene = PythonScript(robot=robot)  # -> scene
# ---------- scene: Python ----------
from scriptcontext import sticky as st

from compas_fab.robots import PlanningScene

# store scene in component
guid = str(ghenv.Component.InstanceGuid)
scene_key = "scene_" + guid

if scene_key not in st:
    st[scene_key] = None

if robot:
    st[scene_key] = PlanningScene(robot)

scene = st[scene_key]
# ---------- end scene ----------

# ----
# Attach an collision object
# Select link name to attach
# Select the links the object is allowed to touch
yz = YZPlane(Origin=Point(0, 0, 0))
cone = Cone(Base=yz, Radius=0.035, Length=0.1)  # -> Cone, Tip
mesh = Mesh(cone.Cone)
mesh_2 = PythonScript(mesh=mesh)  # -> compas_mesh
# ---------- mesh_2: Python ----------
from compas.datastructures import Mesh
from compas_rhino.geometry import RhinoMesh

compas_mesh = RhinoMesh.from_guid(mesh).to_compas()
# ---------- end mesh_2 ----------
idxs = Data([3, 4, 5, 6, 7])
py_7 = PythonScript(robot=robot, idx=Slider(7, range=0..7))  # -> link_name; inputs idx: Int32
# ---------- py_7: Python ----------
if robot:
    link_names = robot.get_link_names()
    #print link_names
    link_name = link_names[idx]
# ---------- end py_7 ----------
panel_4 = Panel(py_7)
py_8 = PythonScript(robot=robot, idxs=idxs)  # -> touch_links; inputs idxs: list of Int32
# ---------- py_8: Python ----------
if robot:
    link_names = robot.get_link_names()
    touch_links = [link_names[i] for i in idxs]
# ---------- end py_8 ----------
panel_5 = Panel(py_8)
remove = Button()
scale = BooleanToggle(False)
add = Button()
attached = PythonScript(
    scene=scene,
    compas_mesh=python.compas_mesh,
    scale=scale,
    id="tip",
    link_name=py_7,
    touch_links=py_8,
    add=add,
    remove=remove)  # -> acm, out; inputs touch_links: list
# ---------- attached: Python ----------
from compas_fab.robots import CollisionMesh
from compas_fab.robots import AttachedCollisionMesh

cm = CollisionMesh(compas_mesh, id)
acm = AttachedCollisionMesh(cm, link_name, touch_links)

if scene:
    if add:
        scene.add_attached_collision_mesh(acm, scale)
    if remove:
        scene.remove_attached_collision_mesh(id)
        scene.remove_collision_mesh(id)
# ---------- end attached ----------

# ----
# Info
info = PythonScript(robot=robot)  # -> out, main_group_name
# ---------- info: Python ----------
if robot:
    robot.info()
    main_group_name = robot.main_group_name
# ---------- end info ----------
panel_6 = Panel(info.out)

# ---- group: forward kinematics
a5 = Slider(-90, range=-360..360)
a1 = Slider(0, range=-360..360)
a2 = Slider(-90, range=-360..360)
a3 = Slider(90, range=-360..360)
a6 = Slider(90, range=-360..360)
a4 = Slider(-90, range=-360..360)
jp = GhPythonScript()  # -> joint_positions
# ---------- jp: Python ----------
import math

joint_positions = [0,-90,90,-90,-90,90]
joint_positions = [math.radians(a) for a in joint_positions]
#joint_positions = [-3.136, -0.328, -1.218, 3.129, 0.852, 0.008]
#joint_positions = [0] * 6

print joint_positions
# ---------- end jp ----------
forward_kinematics = PythonScript(robot=robot, set_joint_positions=Button(), joint_positions=jp, a1=a1, a2=a2, a3=a3, a4=a4, a5=a5, a6=a6)  # -> full_configuration; inputs joint_positions: list
# ---------- forward_kinematics: Python ----------
import math
import Grasshopper
from compas.robots import Joint
from compas_fab.robots import Configuration

if set_joint_positions:

    j = 0
    for i in range(ghenv.Component.Params.Input.Count):
        nslider = ghenv.Component.Params.Input[i].Sources[0]
        if nslider.GetType() == Grasshopper.Kernel.Special.GH_NumberSlider:
            nslider.TrySetSliderValue(math.degrees(joint_positions[j]))
            j += 1

if robot:
    joint_positions = [a1, a2, a3, a4, a5, a6]
    joint_types = robot.get_configurable_joint_types()
    for i, joint_type in enumerate(joint_types):
        if joint_type == Joint.REVOLUTE:
            joint_positions[i] = math.radians(joint_positions[i])
    full_configuration = Configuration(joint_positions, joint_types)

print(full_configuration)
# ---------- end forward_kinematics ----------

# ----
panel_7 = Panel("Define an obstacle")
brep = Brep(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)
preview = CustomPreview(Geometry=brep, Shader=ColourSwatch(SwatchColor=RGB(255, 156, 156)))
mesh_3 = Mesh(brep)
remove_2 = Button()
scale_2 = BooleanToggle(False)
add_2 = Button()

mesh_4 = PythonScript(mesh=mesh_3)  # -> compas_mesh; same code as mesh_2

collision = PythonScript(scene=scene, compas_mesh=mesh_4, scale=scale_2, id="box", add=add_2, remove=remove_2)  # -> out
# ---------- collision: Python ----------
from compas_fab.robots import CollisionMesh

cm = CollisionMesh(compas_mesh, id)

if scene:
    if add:
        scene.add_collision_mesh(cm, scale)
    if remove:
        scene.remove_collision_mesh(id)
# ---------- end collision ----------
panel_8 = Panel(collision)

# ----
# Configuration
# TODO Example:
# Add path constraints
main_planning_group = Text(info.main_group_name)
compute = Button()

# ---- group: inverse kinematics
py_9 = PythonScript(robot=robot)  # -> configuration
# ---------- py_9: Python ----------
from compas_fab.robots import Configuration

if robot:
    types = robot.get_configurable_joint_types()
    values = [0] * len(types)
    configuration = Configuration(values, types)
    print configuration
    print robot.get_configurable_joint_names()
# ---------- end py_9 ----------
start_configuration = Data(forward_kinematics)
list_6 = ValueList({"0", "1"}, selected="0")
filter = StreamFilter(Gate=list_6, Stream0=start_configuration, Stream1=py_9)
inverse = PythonScript(robot=robot, group=main_planning_group, start_configuration=filter, plane=start_plane)  # -> out, configuration
# ---------- inverse: Python ----------
import scriptcontext as sc
import logging

from compas.geometry import Frame

from compas_fab.backends.ros import RosError
from compas_fab.robots import Configuration

LOGGER = logging.getLogger('roslibpy')

if robot:
    if robot.client:
        if robot.client.is_connected:
            frame = Frame(plane.Origin, plane.XAxis, plane.YAxis)
            configuration = robot.inverse_kinematics(frame, start_configuration, group)
            print(configuration)
        else:
            print("Robot is not connected")
# ---------- end inverse ----------

# ---- group: cartesian motion
# Plan cartesian motion
group = Data(main_planning_group)
list_7 = ValueList({"don't use attached collision mesh": 0, "use attached collision mesh": 1}, selected="don't use attached collision mesh")
py_10 = PythonScript(robot=robot)  # -> configuration
# ---------- py_10: Python ----------
from compas_fab.robots import Configuration

if robot:
    types = robot.get_configurable_joint_types()
    values = [0] * len(types)

    configuration = Configuration(values, types)
    print configuration
# ---------- end py_10 ----------
start_configuration_2 = Data(inverse.configuration)
list_8 = ValueList({"0", "1"}, selected="0")
avoid_collisions = BooleanToggle(False)
py_11 = PythonScript(start_plane=start_plane, end_plane=end_plane)  # -> planes
# ---------- py_11: Python ----------
planes = [start_plane, end_plane]
print planes
# ---------- end py_11 ----------
compute_2 = Button()
filter_2 = StreamFilter(Gate=list_8, Stream0=start_configuration_2, Stream1=py_10)
filter_3 = StreamFilter(Gate=list_7, Stream1=attached.acm)
plan_cartesian_motion = PythonScript(
    robot=robot,
    group=group,
    planes=py_11,
    start_configuration=filter_2,
    max_step=Slider(0.01, range=0..0.01),
    avoid_collisions=avoid_collisions,
    attached_collision_meshes=filter_3,
    compute=compute_2)  # -> out, trajectory; inputs planes: list, avoid_collisions: Boolean, attached_collision_meshes: list
# ---------- plan_cartesian_motion: Python ----------
"""Calculates a cartesian motion path (linear in tool space).
    Inputs:
        robot: The robot
        group: str, optional
            The planning group used for calculation. Defaults to the robot's
            main planning group.
        planes: The planes in world coordinate frame through which the path is defined.
        start_configuration: :class:`compas_fab.robots.Configuration`, optional
            The robot's full configuration, i.e. values for all configurable
            joints of the entire robot cell, at the starting position. Defaults
            to the all-zero configuration.
        max_step: float
            The approximate distance between the calculated points. (Defined in
            the robot's units)
        avoid_collisions: bool, optional
            Whether or not to avoid collisions. Defaults to True.
        attached_collision_meshes: list of :class:`compas_fab.robots.AttachedCollisionMesh`
            Defaults to None.
        compute: bool
            Press to calculate solution.
    Output:
        :class:`compas_fab.robots.JointTrajectory`
            The calculated trajectory.
"""
from __future__ import print_function
import logging
import scriptcontext as sc

from compas.geometry import Frame

LOGGER = logging.getLogger('roslibpy')

guid = str(ghenv.Component.InstanceGuid)
response_key = "response_" + guid
if response_key not in sc.sticky:
    sc.sticky[response_key] = None

frames_WCF = [Frame(plane.Origin, plane.XAxis, plane.YAxis) for plane in planes]
frames_RCF = [robot.to_local_coordinates(frame_WCF, group=None) for frame_WCF in frames_WCF]
if robot.attached_tool:
    frames_RCF = [robot.from_tcf_to_t0cf([frame])[0] for frame in frames_RCF]


if robot and robot.client and start_configuration and compute:
    if robot.client.is_connected:
        """
        sc.sticky[response_key] = robot.plan_cartesian_motion(frames,
                                                              start_configuration=start_configuration,
                                                              group=group,
                                                              options={
                                                                'max_step': float(max_step),
                                                                'avoid_collisions': bool(avoid_collisions),
                                                                'attached_collision_meshes': list(attached_collision_meshes),
                                                              })"""
        sc.sticky[response_key] = robot.plan_cartesian_motion(frames_RCF,
                                                              start_configuration=start_configuration,
                                                              group=group,
                                                              max_step=float(max_step),
                                                              avoid_collisions=bool(avoid_collisions),
                                                              attached_collision_meshes=list(attached_collision_meshes),
                                                              )
    else:
        print("Robot client is not connected")

trajectory = sc.sticky[response_key]
# ---------- end plan_cartesian_motion ----------
vis = PythonScript(response=plan_cartesian_motion.trajectory)  # -> P, V, A
# ---------- vis: Python ----------
from compas_ghpython import list_to_ghtree

if response:
    #print response.points
    positions = []
    velocities = []
    accelerations = []

    for p in response.points:
        positions.append(p.positions)
        velocities.append(p.velocities)
        accelerations.append(p.accelerations)
    #print positions
    P = list_to_ghtree(list(zip(*positions)))
    V = list_to_ghtree(list(zip(*velocities)))
    A = list_to_ghtree(list(zip(*accelerations)))
# ---------- end vis ----------
prismatic = QuickGraph(vis.P, SortOrder=0)
panel_9 = Panel("positions")
py_12 = PythonScript(robot=robot, group=group, trajectory=plan_cartesian_motion.trajectory)  # -> configurations, full_configurations, frames, planes, fraction, time
# ---------- py_12: Python ----------
from compas_ghpython import draw_frame

joint_positions = []

if trajectory:
    configurations = trajectory.points
    start_configuration = trajectory.start_configuration
    fraction = trajectory.fraction
    time = trajectory.time_from_start
    full_configurations = [robot.merge_group_with_full_configuration(c, trajectory.start_configuration, group) for c in configurations]
    frames = [robot.forward_kinematics(c, group, options=dict(solver='model')) for c in full_configurations]
    planes = [draw_frame(frame) for frame in frames]
    P = [plane.Origin for plane in planes]
# ---------- end py_12 ----------
fraction = Panel(py_12.fraction)
panel_10 = Panel(plan_cartesian_motion.out)
graph = QuickGraph(vis.V, SortOrder=0)
graph_2 = QuickGraph(vis.A, SortOrder=0)
panel_11 = Panel("velocities")
panel_12 = Panel("accelerations")
pline = PolyLine(Vertices=py_12.planes, Closed=False)
preview_2 = CustomPreview(Geometry=pline, Material=ColourSwatch(SwatchColor=RGB(59, 137, 161)))
start = Button()
reset = Button()
step = Button()
counter = CountThroughList(L=py_12.full_configurations, start=start, step=step, reset=reset)  # -> item; inputs L: list, start: Boolean
# ---------- counter: Python ----------
from scriptcontext import sticky as st
from compas_ghpython.utilities import update_component


interval = 1

# store data in component
guid = str(ghenv.Component.InstanceGuid)
counter_key = "counter_" + guid
running_key = "running_" + guid

if counter_key not in st:
    st[counter_key] = 0

if running_key not in st:
    st[running_key] = False

if start:
    st[running_key] = True

if step:
    if st[counter_key] < len(L) - 1:
        st[counter_key] += 1
    
if len(L):
    item = L[st[counter_key]]

if st[running_key]:
    if st[counter_key] < len(L) - 1:
        st[counter_key] += 1
        update_component(ghenv, interval)
    else:
        st[counter_key] = 0
        st[running_key] = False
# ---------- end counter ----------

# ---- group: forward kinematics
forward = PythonScript(robot=robot, group=main_planning_group, full_configuration=forward_kinematics)  # -> out, frame_WCF
# ---------- forward: Python ----------
"""Calculate the robot's forward kinematic.
    Inputs:
        robot: :class:`compas_fab.robots.Robot`
            The robot.
        group: str, optional
            The planning group used for calculation. Defaults to the robot's
            main planning group.
        full_configuration : :class:`compas_fab.robots.Configuration`
            The full configuration to calculate the forward kinematic for. If no
            full configuration is passed, the zero-joint state for the other
            configurable joints is assumed.
    Output:
        :class:`Frame`
            The frame in the world coordinate frame (WCF).
"""
from __future__ import print_function
import logging

import compas_fab
print(compas_fab.__version__)

LOGGER = logging.getLogger('roslibpy')

if robot and robot.client and full_configuration:
    if robot.client.is_connected:
        frame_WCF = robot.forward_kinematics(full_configuration, group, options={'backend':'model'})
        #frame_WCF = robot.forward_kinematics(full_configuration, group, backend='model')
        print(frame_WCF)
    else:
        print("Robot is not connected")
# ---------- end forward ----------
panel_13 = Panel(forward.out)

# ----
draw = GhPythonScript(frames=forward.frame_WCF, scale=Slider(0.2, range=0..1))  # -> P, V, C, W; inputs frames: list
# ---------- draw: Python ----------
from System.Drawing import Color
from compas_ghpython.utilities import draw_frame

red = Color.FromArgb(255, 0, 0)
green = Color.FromArgb(0, 255, 0)
blue = Color.FromArgb(0, 0, 255)

P = []
V = []
C = []

scale = float(scale)

for frame in frames:
    if not frame:
        continue
    plane = draw_frame(frame)
    P += [plane.Origin] * 3
    V.append(plane.XAxis * scale)
    V.append(plane.YAxis * scale)
    V.append(plane.ZAxis * scale)
    C += [red, green, blue]

W = 3
# ---------- end draw ----------
vdisex = VectorDisplayEx(Point=draw.P, Vector=draw.V, Colour=draw.C, Width=draw.W)

# ---- group: plan motion
# Plan motion
# If you specify the tolerance vector with [360, 1, 1], it means that
#     the frame's y-axis and z-axis are allowed to rotate about the x-axis by an
#     angle of 360 degrees, whereas the x-axis can only change 1 degree.
number_slider = Slider(1, range=1..360)
group_2 = Data(main_planning_group)
py_13 = PythonScript(robot=robot)  # -> configuration; same code as py_10
python_2 = PythonScript(
    robot=robot,
    group=group_2,
    goal_plane=end_plane,
    tolerance_position=Slider(0.001, range=0..0.001),
    tolerance_xaxis_deg=number_slider,
    tolerance_yaxis_deg=Slider(1, range=1..360),
    tolerance_zaxis_deg=Slider(1, range=1..360))  # -> goal_constraints
# ---------- python_2: Python ----------
import math
from compas.geometry import Frame



frame_WCF = Frame(goal_plane.Origin, goal_plane.XAxis, goal_plane.YAxis)
frame_RCF = robot.to_local_coordinates(frame_WCF, group=None)

if robot.attached_tool:
    frame_RCF = robot.from_tcf_to_t0cf([frame_RCF])[0]

tolerances_axes = [math.radians(tolerance_xaxis_deg), math.radians(tolerance_yaxis_deg), math.radians(tolerance_zaxis_deg)]

if robot:
    goal_constraints = robot.constraints_from_frame(frame_RCF, tolerance_position, tolerances_axes, group)
# ---------- end python_2 ----------
start_configuration_3 = Data(inverse.configuration)
list_9 = ValueList({"don't use attached collision mesh": 0, "use attached collision mesh": 1}, selected="use attached collision mesh")
list_10 = ValueList({"0", "1"}, selected="0")
filter_4 = StreamFilter(Gate=list_10, Stream0=start_configuration_3, Stream1=py_13)
filter_5 = StreamFilter(Gate=list_9, Stream1=attached.acm)
list_11 = ValueList({"RRT", "RRT*": "RRTStar", "EST", "PRM": "RPM", "PRM*": "RPMStar", "SPARS"}, selected="RRT")
start_2 = Button()
reset_2 = Button()
step_2 = Button()

# ----
plan_motion = PythonScript(
    robot=robot,
    group=group_2,
    start_configuration=filter_4,
    goal_constraints=python_2,
    planner_id=list_11,
    attached_collision_meshes=filter_5,
    compute=compute)  # -> out, trajectory; inputs goal_constraints: list, attached_collision_meshes: list
# ---------- plan_motion: Python ----------
"""Calculates a motion path.
    Inputs:
        robot: The robot
        group: str, optional
            The planning group used for calculation. Defaults to the robot's
            main planning group.
        start_configuration: :class:`compas_fab.robots.Configuration`, optional
            The robot's full configuration, i.e. values for all configurable
            joints of the entire robot cell, at the starting position. Defaults
            to the all-zero configuration.
        goal_constraints: list of :class:`compas_fab.robots.Constraint`
            The goal to be achieved, defined in a set of constraints.
            Constraints can be very specific, for example defining value domains
            for each joint, such that the goal configuration is included,
            or defining a volume in space, to which a specific robot link (e.g.
            the end-effector) is required to move to.
        planner_id: str
            The name of the algorithm used for path planning. Defaults to 'RRT'.
        attached_collision_meshes: list of :class:`compas_fab.robots.AttachedCollisionMesh`
            Defaults to None.
        compute: bool
            Press to calculate solution.
    Output:
        :class:`compas_fab.robots.JointTrajectory`
            The calculated trajectory.
"""
from __future__ import print_function
import logging
import scriptcontext as sc

guid = str(ghenv.Component.InstanceGuid)
response_key = "response_" + guid
if response_key not in sc.sticky:
    sc.sticky[response_key] = None

LOGGER = logging.getLogger('roslibpy')

if robot and robot.client and start_configuration and compute:
    if robot.client.is_connected:
        """
        sc.sticky[response_key] = robot.plan_motion(goal_constraints,
                                                    start_configuration,
                                                    group,
                                                    options={
                                                        'planner_id': str(planner_id),
                                                        'attached_collision_meshes': list(attached_collision_meshes),
                                                    })"""
        sc.sticky[response_key] = robot.plan_motion(goal_constraints,
                                                    start_configuration,
                                                    group,
                                                    planner_id=str(planner_id),
                                                    attached_collision_meshes=list(attached_collision_meshes),
                                                    )
    else:
        print("Robot client is not connected.")

trajectory = sc.sticky[response_key]
# ---------- end plan_motion ----------
panel_17 = Panel(plan_motion.out)

# ---- group: plan motion (continued)
vis_2 = PythonScript(response=plan_motion.trajectory)  # -> P, V, A, time
# ---------- vis_2: Python ----------
from compas_ghpython import list_to_ghtree

if response:

    positions = []
    velocities = []
    accelerations = []
    time_from_start = []

    for p in response.points:
        positions.append(p.positions)
        velocities.append(p.velocities)
        accelerations.append(p.accelerations)
        time_from_start.append(p.time_from_start.seconds)

    P = list_to_ghtree(list(zip(*positions)))
    V = list_to_ghtree(list(zip(*velocities)))
    A = list_to_ghtree(list(zip(*accelerations)))

    time = time_from_start[-1]
    print time
# ---------- end vis_2 ----------
time_s = Panel(vis_2.time)
prismatic_2 = QuickGraph(vis_2.P, SortOrder=0)
py_14 = PythonScript(robot=robot, group=group_2, trajectory=plan_motion.trajectory)  # -> start_configuration, configurations, full_configurations, frames, planes; same code as py_12
pline_2 = PolyLine(Vertices=py_14.planes, Closed=False)
graph_3 = QuickGraph(vis_2.V, SortOrder=0)
graph_4 = QuickGraph(vis_2.A, SortOrder=0)
preview_3 = CustomPreview(Geometry=pline_2, Material=ColourSwatch(SwatchColor=RGB(139, 59, 161)))
counter_2 = CountThroughList(L=py_14.full_configurations, start=start_2, step=step_2, reset=reset_2)  # -> item; inputs L: list, start: Boolean; same code as counter

# ----
list_12 = ValueList({"0 forward_kinematics": 0, "1 inverse_kinematics": 1, "2 cartesian motion": 2, "3 free-space motion": 3}, selected="0 forward_kinematics")
filter_6 = StreamFilter(Gate=list_12, Stream0=forward_kinematics, Stream1=inverse.configuration, Stream2=counter, Stream3=counter_2)

# ----
# Visualisation
# Select configuration input: from fk, ik, path, or from real robot
show_end_effector_frame = BooleanToggle(False)
show_base_frame = BooleanToggle(True)
show_collision = BooleanToggle(False)
show_frames = BooleanToggle(False)
show_visual = BooleanToggle(True)
show_acm = BooleanToggle(False)
visualize = PythonScript(
    robot=robot,
    group=main_planning_group,
    configuration=filter_6,
    redraw=[py_6, py_5],
    show_visual=show_visual,
    show_collision=show_collision,
    show_end_effector_frame=show_end_effector_frame,
    show_frames=show_frames,
    show_base_frame=show_base_frame,
    show_acm=show_acm)  # -> out, robot, visual, collision, attached_meshes, frames, ee_frame, base_frame; inputs redraw: list, attached_collision_meshes: list
# ---------- visualize: Python ----------
from compas.geometry import Vector
from compas.geometry import Point
from compas.geometry import Transformation
from compas.geometry import Frame
from compas_ghpython.artists import MeshArtist
from compas_fab.robots import Configuration

import ghpythonlib.components as ghcomp
from compas_rhino.conversions import xform_to_rhino

print(configuration)


if robot and configuration:
    
    robot.update(configuration, visual=show_visual, collision=show_collision)
    #T = robot.transformation_RCF_WCF()
    T = Transformation.from_change_of_basis(robot.model.base_frame_temp, Frame.worldXY())
    print T

    if show_visual:
        visual = robot.artist.draw_visual()
        visual += robot.model.base_geo_temp
        visual = ghcomp.Transform(visual, xform_to_rhino(T))

    if show_collision:
        collision = robot.artist.draw_collision()
        collision = ghcomp.Transform(collision, xform_to_rhino(T))
    
    if show_frames:
        axes = robot.transformed_axes(configuration)
        frames = robot.transformed_frames(configuration)
        [f.transform(T) for f in frames[1:]]

    if show_base_frame:
        #base_frame = robot.get_base_frame(group, configuration)
        base_frame = robot.model.base_frame_temp

    if show_end_effector_frame:
        ee_frame = robot.forward_kinematics(configuration, group)
        print("End-effector", ee_frame)
        ee_frame.transform(T)

    frame = robot.forward_kinematics(configuration, options=dict(solver='model', link_name=robot.attached_tool.link_name))
    robot.artist.update_tool(visual=visual, collision=collision, transformation=Transformation.from_frame_to_frame(Frame.worldXY(), frame))
    
    if show_acm:
        M = []
        for acm in attached_collision_meshes:
            frame = robot.forward_kinematics(configuration, options=dict(solver='model', link_name=acm.link_name))
            T = Transformation.from_frame_to_frame(Frame.worldXY(), frame)
            mesh = acm.collision_mesh.mesh.transformed(T)
            M.append(MeshArtist(mesh).draw())
        attached_meshes = M
# ---------- end visualize ----------
geo_2 = Geometry(visualize.visual)
geo_3 = Geometry(visualize.collision)
draw_2 = GhPythonScript(frames=[visualize.frames, visualize.ee_frame, visualize.base_frame], scale=Slider(0.2, range=0..1))  # -> P, V, C, W; inputs frames: list; same code as draw
vdisex_2 = VectorDisplayEx(Point=draw_2.P, Vector=draw_2.V, Colour=draw_2.C, Width=draw_2.W)
preview_4 = CustomPreview(Geometry=geo_2, Shader=ColourSwatch(SwatchColor=RGB(105, 105, 105)))
preview_5 = CustomPreview(Geometry=visualize.attached_meshes, Shader=ColourSwatch(SwatchColor=RGB(255, 255, 255)))
