# Grasshopper definition ex3_ur_moveit_simulation_playground_with_design_tool.ghx (Grasshopper 1.0.7)

disconnect = Button()
connect = Button()

# ----
# Load robot from local package
list = ValueList({"ur_description", "ur_e_description", "ur_setups"}, selected="ur_e_description")
list_2 = ValueList({"ur3.urdf", "ur3_rot.urdf", "ur5.urdf", "ur10.urdf", "ur3e.urdf", "ur5e.urdf", "ur10e.urdf", "ur10e_rot.urdf"}, selected="ur10e_rot.urdf")
list_3 = ValueList({"ur3.srdf", "ur5.srdf", "ur10.srdf", "ur3e.srdf", "ur5e.srdf", "ur10e.srdf"}, selected="ur10e.srdf")
py = PythonScript()  # -> DATA
# ---------- py: Python ----------
import os
import getpass

username = getpass.getuser()
USER_FOLDER = os.path.abspath(os.path.join("C:/Users/", username))
DATA = os.path.abspath(os.path.join(USER_FOLDER,"workspace/projects/ur_fabrication_control/data"))

print(USER_FOLDER)
print(DATA)
# ---------- end py ----------
py_2 = PythonScript(data_path=py, package=list, urdf_name=list_2, srdf_name=list_3)  # -> loaders, urdf_filename, srdf_filename
# ---------- py_2: Python ----------
import os
from compas.robots import LocalPackageMeshLoader

path = os.path.join(data_path, "robot_description")

#loaders
packages = ["ur_description", "ur_e_description", "ur_end_effectors", "ur_setups"]
loaders = [LocalPackageMeshLoader(path, pck) for pck in packages]

#files
package_path = os.path.join(path, package)
print package_path

urdf_filename = os.path.join(package_path, "urdf", urdf_name)
srdf_filename = os.path.join(package_path, srdf_name)

assert os.path.isfile(urdf_filename)
assert os.path.isfile(srdf_filename)
# ---------- end py_2 ----------

panel = Panel("Unload libraries")
# 1.
# Load initial assembly
bang = Button()
unload = PythonScript(bang=bang)
# ---------- unload: Python ----------
from compas_rhino.utilities.misc import get_tolerance
from compas_rhino.utilities.misc import unload_modules

unload_modules("robot_see_robot_do")
# ---------- end unload ----------

import = Button(ExpressionNormal="True", ExpressionPressed="False")
# Import initial assembly (first module)
py_3 = PythonScript(import_from_json=import)  # -> HERE, DATA, import_from_json
# ---------- py_3: Python ----------
import os
from scriptcontext import sticky as st

HERE = os.path.dirname(ghdoc.Path)
DATA = os.path.abspath(os.path.join(HERE, "..", "data"))
print(HERE)
print(DATA)

st.clear()
st['DATA_PATH'] = DATA
# ---------- end py_3 ----------
initial_assembly = GhPythonScript(DATA=py_3.DATA, import_from_json=py_3.import_from_json)  # -> out, assembly; inputs import_from_json: Boolean
# ---------- initial_assembly: Python ----------
import os
import json
from scriptcontext import sticky

from robot_see_robot_do.assembly_orthogonal import Assembly

#assembly = Assembly()

if import_from_json:
    #filename = "hrca/hrcassembly_initial_origin.json"
    #filename = "hrca_aggregation_3.json"
    filename = "json/hrca_current_assembly_2020_09_22_19_32_25.json"
    PATH = os.path.join(DATA, filename)
    assembly = Assembly.from_json(PATH)


#assembly.network.delete_node(6)

if assembly:
    counter = 1
    for key, elem, data in assembly.elements(data=True):
        data['frame_id'] = counter
        counter +=1
    
    sticky['assembly'] = assembly
# ---------- end initial_assembly ----------

plate = Brep(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)

# ----
# Input
panel_2 = Panel("Start plane")
pt = Point(Point(0.62116715, 0.5299532239, 0.3015280014))
panel_3 = Panel("End plane")
pt_2 = Point(Point(0.4148048473, 0.0806959495, 0.2818520837))
py_4 = GhPythonScript(pt=pt_2)  # -> pln
# ---------- py_4: Python ----------
import Rhino.Geometry as rg

pln = rg.Plane(pt, -rg.Vector3d.ZAxis)
# ---------- end py_4 ----------
py_5 = GhPythonScript(pt=pt)  # -> pln; same code as py_4
end_plane = Plane(py_4)
start_plane = Plane(py_5)

x_axis = Curve(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)
y_axis = Curve(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)
plane = PythonScript(plane_axes=[x_axis, y_axis])  # -> plane; inputs plane_axes: list of Curve
# ---------- plane: Python ----------
import Rhino.Geometry as rg

x_axis, y_axis = plane_axes

x_axis = rg.Line(x_axis.PointAtStart, x_axis.PointAtEnd)
y_axis = rg.Line(y_axis.PointAtStart, y_axis.PointAtEnd)

if x_axis.From.DistanceTo(y_axis.From) < 0.01:
    origin = x_axis.From
    xvec = x_axis.Direction
    yvec = y_axis.Direction
elif x_axis.To.DistanceTo(y_axis.To) < 0.01:
    origin = x_axis.To
    xvec = -x_axis.Direction
    yvec = -y_axis.Direction
elif x_axis.From.DistanceTo(y_axis.To) < 0.01:
    origin = x_axis.From
    xvec = x_axis.Direction
    yvec = -y_axis.Direction
elif x_axis.To.DistanceTo(y_axis.From) < 0.01:
    origin = x_axis.To
    xvec = -x_axis.Direction
    yvec = y_axis.Direction

plane = rg.Plane(origin, xvec, yvec)
# ---------- end plane ----------

# ----
# Controls
rotate = Slider(0, range=0..90)
shift = Slider(0.1, range=-0.25..0.25)
t = Slider(85, range=0..180)
aggregate = Button()
element = Button()
element_2 = Button()
human = Button()
reset = Button()
robot = Button()
add = Button()
list_4 = ValueList({"AA", "AB", "BA", "BB"}, selected="BA")
pts = Point([Point(-3.124561898, 0.3619678053, 1.820186629), Point(2.035451837, -1.828229709, 0.1857535972)])

sph = Sphere(Base=pts, Radius=0.05)  # disabled
preview = CustomPreview(Geometry=sph, Material=ColourSwatch(SwatchColor=RGB(255, 92, 92)))  # disabled

# ----
# Parallel Gripper Switch
open = BooleanToggle(True)
digital_out = PythonScript(open=open)  # -> urscript
# ---------- digital_out: Python ----------
from ur_fabrication_control.direct_control import URScript
from ur_fabrication_control.direct_control.mixins import ParallelGripMixins

class URScript_ParallelGrip(URScript, ParallelGripMixins):
    pass

urscript = URScript_ParallelGrip()
urscript.start()

if open:
    # Open State
    urscript.parallelgrip_open()
else: 
    # Closed State
    urscript.parallelgrip_close()

urscript.end()
urscript = urscript.generate()
print(urscript)
# ---------- end digital_out ----------
send = Button()
send_2 = GhPythonScript(urscript=digital_out, send=send)  # -> out; inputs send: Boolean
# ---------- send_2: Python ----------
from scriptcontext import sticky as st
from ur_fabrication_control.direct_control import send_script

ur_ip = st["ur_ip"]
ur_port = st["ur_port"]

if send:
    send_script(urscript, ur_ip, ur_port)
# ---------- end send_2 ----------

# ----
# Stop
stop = Button()
stop_2 = PythonScript(stop=stop)
# ---------- stop_2: Python ----------
from scriptcontext import sticky as st
from ur_fabrication_control.direct_control.common import send_stop

ur_ip = st["ur_ip"]
ur_port = st["ur_port"]

if stop:
    send_stop(ur_ip, ur_port)
# ---------- end stop_2 ----------

# ----
# Set Digital Out
number = Slider(6, range=0..10)
value = BooleanToggle(False)
digital_out_2 = PythonScript(number=number, value=value)  # -> urscript; inputs number: Int32, value: Boolean
# ---------- digital_out_2: Python ----------
from ur_fabrication_control.direct_control import URScript

urscript = URScript()
urscript.start()
urscript.add_line("\tset_digital_out({}, {})".format(number, value))
urscript.end()
urscript = urscript.generate()

print(urscript)
# ---------- end digital_out_2 ----------
send_3 = Button()
send_4 = GhPythonScript(urscript=digital_out_2, send=send_3)  # -> out; inputs send: Boolean; same code as send_2

# ----
# Grippers
# Area Gripper Switch
suction = BooleanToggle(True)
blow_off = BooleanToggle(True)
digital_out_3 = PythonScript(suction=suction, blow_off=blow_off)  # -> urscript
# ---------- digital_out_3: Python ----------
from ur_fabrication_control.direct_control import URScript
from ur_fabrication_control.direct_control.mixins import AreaGripMixins

class URScript_AreaGrip(URScript, AreaGripMixins):
    pass

urscript = URScript_AreaGrip()
urscript.start()

if suction == True and blow_off == False:
    urscript.areagrip_on()
elif blow_off == True:
    urscript.areagrip_blowoff()
elif suction == False and blow_off == False:
    urscript.areagrip_off()

urscript.end()
urscript = urscript.generate()
print(urscript)
# ---------- end digital_out_3 ----------
send_5 = Button()
send_6 = GhPythonScript(urscript=digital_out_3, send=send_5)  # -> out; inputs send: Boolean; same code as send_2

crv = Curve(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)
hframes = HorizontalFrames(Curve=crv, Count=10)  # -> Frames, Parameters

# ----
# Move Cartesian
idx = Slider(0, range=0..100)
list_5 = ValueList({"send all positions": 0, "send only one position": 1}, selected="send all positions")
item = ListItem(List=hframes.Frames, Index=idx, Wrap=True)
filter = StreamFilter(Gate=list_5, Stream0=hframes.Frames, Stream1=item)
radius = Slider(0, range=0..0.5)
movel = PythonScript(planes_WCS=filter, velocity=Slider(0.1, range=0..0.5), radius=radius)  # -> urscript; inputs planes_WCS: list
# ---------- movel: Python ----------
import Rhino.Geometry as rg
from compas.geometry import Frame
from compas.geometry import Transformation, Rotation
from compas_ghpython import draw_frame
from compas_fab.robots import robot
from ur_fabrication_control import direct_control 
import math

from scriptcontext import sticky as st
from ur_fabrication_control.direct_control import URScript

robot = st["robot"]

# retrieve the current tool frame in axis angle format
if robot.attached_tool:
    tool_angle_axis = list(robot.attached_tool.frame.point) + list(robot.attached_tool.frame.axis_angle_vector)
else:
    tool0_frame = Frame([0, 0, 0], [1, 0, 0], [0, 1, 0])
    tool_angle_axis = list(tool0_frame.point) + list(tool0_frame.axis_angle_vector)

move_commands = []
for plane_WCS in planes_WCS:
    frame_WCS = Frame(plane_WCS.Origin, plane_WCS.XAxis, plane_WCS.YAxis)
    frame_RCS = robot.to_local_coordinates(frame_WCS)
    cmd = list(frame_RCS.point) + list(frame_RCS.axis_angle_vector) + [velocity, radius]
    move_commands.append(cmd)

urscript = URScript()
urscript.start()
for mc in move_commands:
    urscript.move_linear(mc)
urscript.end()

urscript = urscript.generate()

print(urscript)
# ---------- end movel ----------
send_7 = Button()
send_8 = GhPythonScript(urscript=movel, send=send_7)  # -> out; inputs send: Boolean; same code as send_2

# ----
# Get Pose Cartesian
get = Button()
pose = PythonScript(get=get)  # -> pose_cartesian, frame_WCS, plane_WCS
# ---------- pose: Python ----------
from scriptcontext import sticky as st
from ur_fabrication_control.direct_control.common import get_current_pose_cartesian


robot = st["robot"]

server_address = st["server_address"]
server_port = st["server_port"]
ur_port = st["ur_port"]
ur_ip = st["ur_ip"]


# retrieve the current tool frame in axis angle format
if robot.attached_tool:
    tool_angle_axis = list(robot.attached_tool.frame.point) + list(robot.attached_tool.frame.axis_angle_vector)
else:
    tool0_frame = Frame([0, 0, 0], [1, 0, 0], [0, 1, 0])
    tool_angle_axis = list(tool0_frame.point) + list(tool0_frame.axis_angle_vector)

print(tool_angle_axis)

guid = str(ghenv.Component.InstanceGuid)
pose_cartesian_key = "pose_cartesian" + guid


if get:
    st[pose_cartesian_key] = get_current_pose_cartesian(tool_angle_axis, server_address, server_port, ur_ip, ur_port, send=True)

if pose_cartesian_key not in st:
    pose_cartesian = []
else:
    pose_cartesian = st[pose_cartesian_key]

print(pose_cartesian)

# get frame and plane of the current pose cartesian in world coordinates for visualization
if pose_cartesian:
    frame_RCS = Frame.from_axis_angle_vector(axis_angle_vector=pose_cartesian[3:], point=pose_cartesian[:3])
    frame_WCS = robot.to_world_coords(frame_RCS)
    plane_WCS  = draw_frame(frame_WCS)
    print frame_RCS
# ---------- end pose ----------
draw = GhPythonScript(frames=pose.frame_WCS, scale=Slider(0.1, range=0..1))  # -> P, V, W; inputs frames: list
# ---------- draw: Python ----------
from System.Drawing import Color
from compas_ghpython.utilities import draw_frame

red = Color.FromArgb(255, 0, 0)
green = Color.FromArgb(0, 255, 0)
blue = Color.FromArgb(0, 0, 255)

P = []
V = []
C = []

scale = float(scale)

for frame in frames:
    if not frame:
        continue
    plane = draw_frame(frame)
    P += [plane.Origin] * 3
    V.append(plane.XAxis * scale)
    V.append(plane.YAxis * scale)
    V.append(plane.ZAxis * scale)
    C += [red, green, blue]

W = 3
# ---------- end draw ----------
vdisex = VectorDisplayEx(Point=draw.P, Vector=draw.V, Colour=RGB(0, 0, 0), Width=draw.W)
panel_4 = Panel(pose.pose_cartesian)

# ----
# Get Pose Joint
get_2 = Button()
pose_2 = PythonScript(get=get_2)  # -> configuration, pose_joints
# ---------- pose_2: Python ----------
from scriptcontext import sticky as st
from ur_fabrication_control.direct_control.common import get_current_pose_joints
from compas_fab.robots import Configuration


robot = st["robot"]

server_address = st["server_address"]
server_port = st["server_port"]
ur_port = st["ur_port"]
ur_ip = st["ur_ip"]


# retrieve the current tool frame in axis angle format
if robot.attached_tool:
    tool_angle_axis = list(robot.attached_tool.frame.point) + list(robot.attached_tool.frame.axis_angle_vector)
else:
    tool0_frame = Frame([0, 0, 0], [1, 0, 0], [0, 1, 0])
    tool_angle_axis = list(tool0_frame.point) + list(tool0_frame.axis_angle_vector)

print(tool_angle_axis)

guid = str(ghenv.Component.InstanceGuid)
pose_joints_key = "pose_joints" + guid


# send script to the robot to receive the current joint configuration
if get:
    st[pose_joints_key] = get_current_pose_joints(tool_angle_axis, server_address, server_port, ur_ip, ur_port, send=True)

if pose_joints_key not in st:
    configuration = Configuration.from_revolute_values([0,0,0,0,0,0])
else:
    configuration = Configuration.from_revolute_values(st[pose_joints_key])

pose_joints = configuration.values
# ---------- end pose_2 ----------
panel_5 = Panel(pose_2.pose_joints)

# ----
# Calculate Basis - 3-Point Method
# Measure basis:
# 1. Clear the recorded poses
# 2. Move robot to origin and press "get pose"
# 3. Move robot to point in positive x-axis and press "get pose"
# 4. Move robot to an other point in your basis and press "get pose"
# (The further away these positions are, the better)
# 
# 5. Alternatively change the order in the component calc base
# 6. Copy output into base component (TODO: check if it has to be inverted)
list_6 = ValueList({"o, pos.x-axis, xy pl": 0, "o, pos.y-axis, xy pl": 1}, selected="o, pos.x-axis, xy pl")
clear = Button()
rec = PythonScript(msg=pose.pose_cartesian, rec=get, clear=clear)  # -> rec; inputs msg: list
# ---------- rec: Python ----------
from scriptcontext import sticky as st

guid = str(ghenv.Component.InstanceGuid)
recorded_key =  "recorded_" + guid
just_cleared_key = "just_cleared_" + guid


if recorded_key not in st:
    st[recorded_key] = []

if just_cleared_key not in st:
    st[just_cleared_key] = False

if clear:
    st[recorded_key] = []
    st[just_cleared_key] = True
else:
    if len(msg):
        if msg != [None] and not st[just_cleared_key] and rec:
            st[recorded_key].append(msg)
    st[just_cleared_key] = False
        


rec = st[recorded_key]

print rec
# ---------- end rec ----------
calc_base = PythonScript(poses=rec, input_type=list_6)  # -> out, base_plane; inputs poses: list
# ---------- calc_base: Python ----------
import Rhino.Geometry as rg
import math


if len(poses) > 2:
    
    O = poses[0]
    P1 = poses[1]
    P2 = poses[2]
    
    if input_type == 0:
        # origin, pt on positive x-axis, pt in xy plane
        origin = rg.Point3d(O[0], O[1], O[2])
        pt_on_xaxis = rg.Point3d(P1[0], P1[1], P1[2])
        pt_in_xyplane = rg.Point3d(P2[0], P2[1], P2[2])
        
        xaxis = pt_on_xaxis - origin
        xaxis.Unitize()
        
        v = pt_in_xyplane - origin
        zaxis = rg.Vector3d.CrossProduct(v, xaxis)
        zaxis.Unitize()
        
        # zaxis must look up!
        if math.acos(rg.Vector3d.ZAxis * zaxis) > math.acos(rg.Vector3d.ZAxis * -zaxis):
            zaxis = -zaxis
        
        yaxis = rg.Vector3d.CrossProduct(zaxis, xaxis)
    
    elif input_type == 1:
        # origin, pt on positive y-axis, pt in xy plane
        origin = rg.Point3d(O[0], O[1], O[2])
        pt_on_yaxis = rg.Point3d(P1[0], P1[1], P1[2])
        pt_in_xyplane = rg.Point3d(P2[0], P2[1], P2[2])
        
        yaxis = pt_on_yaxis - origin
        yaxis.Unitize()
        
        v = pt_in_xyplane - origin
        zaxis = rg.Vector3d.CrossProduct(v, yaxis)
        zaxis.Unitize()
        
        # zaxis must look up!
        if math.acos(rg.Vector3d.ZAxis * zaxis) > math.acos(rg.Vector3d.ZAxis * -zaxis):
            zaxis = -zaxis
        
        xaxis = rg.Vector3d.CrossProduct(yaxis, zaxis)
        
        
    print "Copy the following into base component:"
    print " "
    print "origin = [%.2f, %.2f, %.2f]" % tuple(list(origin))
    print "xaxis = [%.5f, %.5f, %.5f]" % tuple(list(xaxis))
    print "yaxis = [%.5f, %.5f, %.5f]" % tuple(list(yaxis))
    

#print rg.Vector3d.CrossProduct(rg.Vector3d.YAxis, rg.Vector3d.ZAxis)
#print rg.Vector3d.CrossProduct(rg.Vector3d.ZAxis, rg.Vector3d.XAxis)

    base_plane = rg.Plane(origin, xaxis, xaxis)
# ---------- end calc_base ----------
panel_6 = Panel(rec)
panel_7 = Panel(calc_base.out)

# ----
# Direct UR Control
config = GhPythonScript()  # -> out, joint_configs
# ---------- config: Python ----------
from compas_fab.robots import Configuration

values=[-0.737876, -1.64531, 1.740348, -0.367801, -0.37385, -0.110741]
joint_configs = [Configuration.from_revolute_values(values)]
# ---------- end config ----------
pln = Plane(calc_base.base_plane)

# ----
# Move Joints
idx_2 = Slider(0, range=0..100)
list_7 = ValueList({"send all positions": 0, "send only one position": 1, "from inverse": 2}, selected="from inverse")
item_2 = ListItem(List=config.joint_configs, Index=idx_2, Wrap=True)
filter_2 = StreamFilter(Gate=list_7, Stream0=config.joint_configs, Stream1=item_2)
movej = PythonScript(joint_configurations=filter_2, velocity=Slider(0.1, range=0..0.5))  # -> urscript, values; inputs joint_configurations: list
# ---------- movej: Python ----------
from ur_fabrication_control.direct_control import URScript
import math


"""
for c in joint_configurations:
    for i,v in enumerate(c.values):
        #print v
        if v>math.pi:
            v-=2*math.pi
        if v<-math.pi:
            v+=2*math.pi
        c.values[i]=v
print joint_configurations
values = joint_configurations[0].values
print([math.degrees(v) for v in values])
"""

#joint_config = ["movej({}, v={})".format(c.values, velocity/10) for c in joint_configurations]

urscript = URScript()
urscript.start()
for jc in joint_configurations:
    urscript.move_joint(jc, velocity)
urscript.end()

urscript = urscript.generate()

print(urscript)
# ---------- end movej ----------
send_9 = Button()
send_10 = GhPythonScript(urscript=movej.urscript, send=send_9)  # -> out; inputs send: Boolean; same code as send_2

# ----
# Calculate Basis - Point fitting method via RPC
toggle = BooleanToggle(False)
plane_init_guess = Plane(Plane(origin=(0, 0, 0), x=(0, -1, 0), y=(1, 0, 0)))
pt_3 = Point([<point referenced from the Rhino model> x3])
calc_base_2 = PythonScript(poses=rec, pts_cad=pt_3, base_plane_init_guess=plane_init_guess, calc=toggle)  # -> out, pts_mtip_init_guess, pts_mtip_fit, base_plane_fit; inputs poses: list, pts_cad: list of Point3d, base_plane_init_guess: Plane
# ---------- calc_base_2: Python ----------
import ghpythonlib.components as ghcomp
import Rhino.Geometry as rg
from scriptcontext import sticky as st
from compas.geometry import Frame
import math as m
import sys
from compas.rpc import Proxy # for calling the numpy function in CPython


if len(poses):
    
    # get points from poses
    pts_mtip = [rg.Point3d(p[0], p[1], p[2]) for p in poses]
    
    T_W_R_init_guess = rg.Transform.PlaneToPlane(rg.Plane.WorldXY, base_plane_init_guess)
    pts_mtip_init_guess = [ghcomp.Transform(pt, T_W_R_init_guess) for pt in pts_mtip]
    
    # format Rhino transformation
    T_W_R_init_guess_flattened = [float(f) for f in T_W_R_init_guess.ToFloatArray(True)]
    T_W_R_init_guess_list = [T_W_R_init_guess_flattened[i:(i + 4)] for i in range(0, len(T_W_R_init_guess_flattened), 4)]  

    # format ptsA and ptsB
    dataB = [list(pt) for pt in pts_cad]
    dataA = [list(pt) for pt in pts_mtip]
    
    # call the function
    max_iterations = 100
    
    if calc:
        icp_func = Proxy('ur_fabrication_control.optimisation.icp', python = 'C://Users//kathrind//anaconda3//envs//ur_fab//python.exe')
        
        print icp_func._python

        transformation, distances = icp_func.icp(dataA, dataB, init_guess=T_W_R_init_guess_list, max_iterations=max_iterations, tolerance=0.000001)
        
        print "distances", distances
        
        # format result
        T = rg.Transform.Identity
        for i in range(4):
            for j in range(4):
                code = "T.M%i%i = %f" % (i, j, transformation[i][j])
                print code
                exec(code)
        #print T
        
        # now transform the points with the transformation calculated
        pts_mtip_fit = [ghcomp.Transform(pt, T) for pt in pts_mtip]
        base_plane_fit = ghcomp.Transform(rg.Plane.WorldXY, T)
        
        
        #f = Frame(base_plane_fit)
        #print f.get_pose_quaternion()
        
        # correct the zvalue
        #base_plane_fit = ghcomp.Transform(base_plane_fit, rg.Transform.Translation(0,0,-3))
# ---------- end calc_base_2 ----------
pt_4 = Point(calc_base_2.pts_mtip_init_guess)
pt_5 = Point(calc_base_2.pts_mtip_fit)
pln_2 = Plane(calc_base_2.base_plane_fit)

# ----
# Tool
list_8 = ValueList({"measurement_tool": 0, "air_pick_15mm": 1, "area_gripper": 2, "parallel_gripper": 3}, selected="measurement_tool")
panel_8 = Panel("Attach a custom tool")
show = BooleanToggle(False)
python = PythonScript(data_path=py, tool=list_8, show=show)  # -> tool, M, compas_mesh
# ---------- python: Python ----------
import os, math
from compas.geometry import Frame, Rotation
from compas.datastructures import Mesh
from compas_ghpython.artists import MeshArtist
from compas_fab.robots import Tool

tolerance = 0


if tool == 0:
    filename = 'measurement_tool_zaxis.stl'
    ee_frame = Frame([0, 0, 0.109], [1, 0, 0], [0, 1, 0])

elif tool == 1:
    filename = 'airpick_15.stl'
    ee_frame = Frame([0, 0, 0.158 + tolerance], [1, 0, 0], [0, 1, 0])
    
elif tool == 2:
    filename = 'airpick_40.stl'
    ee_frame = Frame([0, 0, 0.158 + tolerance], [1, 0, 0], [0, 1, 0])

elif tool == 3:
    filename = 'area_gripper_zaxis.stl'
    ee_frame = Frame([0, 0, 0.10219 + tolerance], [1, 0, 0], [0, 1, 0])

elif tool == 4:
    filename = 'parallel_gripper_zaxis.stl'
    ee_frame = Frame([0, 0, 0.176 + tolerance], [1, 0, 0], [0, 1, 0])    
    
data_path = os.path.join(data_path, "tool_geometry")
fullfilename = os.path.join(data_path, filename)
print fullfilename

ee_mesh = Mesh.from_stl(fullfilename)

#R = Rotation.from_axis_and_angle(ee_frame.zaxis, math.radians(180), point=ee_frame.point)
#ee_frame.transform(R)

if show:
    artist = MeshArtist(ee_mesh)
    M = artist.draw()

tool = Tool(ee_mesh, ee_frame)
compas_mesh = ee_mesh
# ---------- end python ----------

# ---- group: ROS client
list_9 = ValueList({"local": 0, "linux computer": 1}, selected="local")

# ----
connect_2 = PythonScript(ip=list_9, connect=connect, disconnect=disconnect)  # -> out, ros_client
# ---------- connect_2: Python ----------
import sys
import scriptcontext as sc
from compas_fab.backends import RosClient

key = 'rosclient_%s' % str(ghenv.Component.InstanceGuid)
previous_client = sc.sticky.get(key, None)

if previous_client and (connect or disconnect):
    previous_client.close()

if connect:
    if ip == 0: #local, own laptop
        ros_client = RosClient('127.0.0.1', 9090)
    elif ip == 1: # linux computer
        ros_client = RosClient('10.181.163.92', 9090)
    sc.sticky[key] = ros_client
    ros_client.run(5)

ros_client = sc.sticky.get(key, None)
print('ROS connected: {}'.format(ros_client.is_connected if ros_client else 'False'))
# ---------- end connect_2 ----------

# ---- group: ROS client (continued)
is_connected = Panel(connect_2.out)
ros_client = Data(connect_2.ros_client)

# ----
# Robot
units = ValueList({"m": 1, "cm": 100, "mm": 1000}, selected="m")
load = Button()
create = PythonScript(load=load, loaders=py_2.loaders, urdf_filename=py_2.urdf_filename, srdf_filename=py_2.srdf_filename, scale_factor=units)  # -> out, robot; inputs load: Boolean, loaders: list
# ---------- create: Python ----------
import os
from scriptcontext import sticky as st

import compas

from compas.robots import RobotModel
from compas.robots import LocalPackageMeshLoader

from compas_fab.robots import Robot
from compas_fab.robots import RobotSemantics

from compas_fab.ghpython import RobotArtist

compas.PRECISION = '12f'

# store robot in component
guid = str(ghenv.Component.InstanceGuid)
robot_key = "robot_" + guid

if robot_key not in st:
    st[robot_key] = None

print loaders
if load:
    model = RobotModel.from_urdf_file(urdf_filename)
    
    model.load_geometry(*loaders)
    artist = RobotArtist(model)
    semantics = RobotSemantics.from_srdf_file(srdf_filename, model)
    robot = Robot(model, artist, semantics, client=None)

    
    st[robot_key] = robot

robot = st[robot_key]


if robot:
    robot.scale(scale_factor)
# ---------- end create ----------
set = PythonScript(robot=create.robot, client=ros_client)  # -> robot
# ---------- set: Python ----------
if robot and client:
    robot.client = client
# ---------- end set ----------
robot_2 = Data(set)

# ----
# Base
x_axis_2 = Curve(<curve referenced from the Rhino model>)
y_axis_2 = Curve(<curve referenced from the Rhino model>)
x_axis_3 = Curve(<curve referenced from the Rhino model>)
y_axis_3 = Curve(<curve referenced from the Rhino model>)
plane_2 = PythonScript(plane_axes=[x_axis_2, y_axis_2])  # -> plane; inputs plane_axes: list of Curve; same code as plane
plane_3 = PythonScript(plane_axes=[x_axis_3, y_axis_3])  # -> plane; inputs plane_axes: list of Curve; same code as plane
geo = Geometry([<brep referenced from the Rhino model> x39, <curve referenced from the Rhino model>, <brep referenced from the Rhino model> x4])
base = PythonScript(base_plane=plane_2, pickup_plane=plane_3)  # -> base_frame, pick_frame
# ---------- base: Python ----------
from compas.geometry import Frame
from compas.geometry import Transformation, Rotation
from compas_ghpython import draw_frame
import math
import Rhino.Geometry as rg



base_frame = Frame(base_plane.Origin, base_plane.XAxis, base_plane.YAxis)

pickup_frame = Frame(pickup_plane.Origin, pickup_plane.XAxis, pickup_plane.YAxis)
# ---------- end base ----------
py_6 = PythonScript(robot=robot_2, base_frame=base.base_frame, base_geo=geo, pickup_frame=base.pick_frame, set_to_base_frame=Toggle(True))  # -> a; inputs base_geo: list, set_to_base_frame: Boolean
# ---------- py_6: Python ----------
from compas_ghpython import draw_frame
from compas.geometry import Frame, Point, Vector, Transformation



frame_zero = Frame(Point(0.000, 0.000, 0.000), Vector(1.000, 0.000, 0.000), Vector(0.000, 1.000, 0.000))
print base_frame

if set_to_base_frame == True:
    #print robot.model.get_link_by_name(robot.get_base_link_name()).parent_joint
    #robot.model.get_link_by_name(robot.get_base_link_name()).parent_joint.origin = base_frame
    robot.model.base_frame_temp = base_frame
else:
    #robot.model.get_link_by_name(robot.get_base_link_name()).parent_joint.origin = frame_zero
    robot.model.base_frame_temp = frame_zero

#print robot.transformation_RCF_WCF()
#print robot.get_base_frame(group=None, full_configuration=None)

robot.model.base_geo_temp = base_geo
robot.model.pickup_frame_temp = base_geo



"""
print robot.model.links[0].name

frame = Frame(Point(0.300, 1.000, 0.000), Vector(1.000, 0.000, 0.000), Vector(0.000, 1.000, 0.000))
T = Transformation.from_frame(frame)

#robot.model.get_link_by_name(robot.get_base_link_name()).parent_joint.transform(T)
#robot.model.get_link_by_name(robot.get_base_link_name()).joints[0].origin = frame
#robot.model.get_link_by_name('shoulder_link').parent_joint.transform(T)
print robot.model.get_link_by_name('shoulder_link').parent_joint.origin
print robot.model.get_link_by_name(robot.get_base_link_name()).parent_joint.origin

print robot.get_configurable_joint_names()

print robot.model.links[0]

print robot.get_base_link_name(group=None)
print robot.get_base_frame(group=None, full_configuration=None)

print robot.get_end_effector_link_name(group=None)
print robot.get_link_names()

"""

#f = robot.model.joints[0].origin
#p = draw_frame(f)
# ---------- end py_6 ----------

py_7 = PythonScript(robot=robot_2, tool=python.tool, attach=Toggle(True))  # -> a
# ---------- py_7: Python ----------
if attach:
    robot.attach_tool(tool)
else:
    robot.detach_tool()
# ---------- end py_7 ----------

# ----
# Planning scene
scene = PythonScript(robot=robot_2)  # -> scene
# ---------- scene: Python ----------
from scriptcontext import sticky as st

from compas_fab.robots import PlanningScene

# store scene in component
guid = str(ghenv.Component.InstanceGuid)
scene_key = "scene_" + guid

if scene_key not in st:
    st[scene_key] = None

if robot:
    st[scene_key] = PlanningScene(robot)

scene = st[scene_key]
# ---------- end scene ----------

# ----
# Attach an collision object
# Select link name to attach
# Select the links the object is allowed to touch
yz = YZPlane(Origin=Point(0, 0, 0))
cone = Cone(Base=yz, Radius=0.035, Length=0.1)  # -> Cone, Tip
mesh = Mesh(cone.Cone)
mesh_2 = PythonScript(mesh=mesh)  # -> compas_mesh
# ---------- mesh_2: Python ----------
from compas.datastructures import Mesh
from compas_rhino.geometry import RhinoMesh

compas_mesh = RhinoMesh.from_guid(mesh).to_compas()
# ---------- end mesh_2 ----------
idxs = Data([3, 4, 5, 6, 7])
py_8 = PythonScript(robot=robot_2, idx=Slider(7, range=0..7))  # -> link_name; inputs idx: Int32
# ---------- py_8: Python ----------
if robot:
    link_names = robot.get_link_names()
    #print link_names
    link_name = link_names[idx]
# ---------- end py_8 ----------
panel_9 = Panel(py_8)
py_9 = PythonScript(robot=robot_2, idxs=idxs)  # -> touch_links; inputs idxs: list of Int32
# ---------- py_9: Python ----------
if robot:
    link_names = robot.get_link_names()
    touch_links = [link_names[i] for i in idxs]
# ---------- end py_9 ----------
panel_10 = Panel(py_9)
remove = Button()
scale = BooleanToggle(False)
add_2 = Button()
attached = PythonScript(
    scene=scene,
    compas_mesh=python.compas_mesh,
    scale=scale,
    id="tip",
    link_name=py_8,
    touch_links=py_9,
    add=add_2,
    remove=remove)  # -> acm, out; inputs touch_links: list
# ---------- attached: Python ----------
from compas_fab.robots import CollisionMesh
from compas_fab.robots import AttachedCollisionMesh

cm = CollisionMesh(compas_mesh, id)
acm = AttachedCollisionMesh(cm, link_name, touch_links)

if scene:
    if add:
        scene.add_attached_collision_mesh(acm, scale)
    if remove:
        scene.remove_attached_collision_mesh(id)
        scene.remove_collision_mesh(id)
# ---------- end attached ----------

# ----
# Info
info = PythonScript(robot=robot_2)  # -> out, main_group_name
# ---------- info: Python ----------
if robot:
    robot.info()
    main_group_name = robot.main_group_name
# ---------- end info ----------
panel_11 = Panel(info.out)

# ---- group: forward kinematics
a5 = Slider(-90, range=-360..360)
a1 = Slider(0, range=-360..360)
a2 = Slider(-90, range=-360..360)
a3 = Slider(90, range=-360..360)
a6 = Slider(90, range=-360..360)
a4 = Slider(-90, range=-360..360)
jp = GhPythonScript()  # -> joint_positions
# ---------- jp: Python ----------
import math

joint_positions = [0,-90,90,-90,-90,90]
joint_positions = [math.radians(a) for a in joint_positions]
#joint_positions = [-3.136, -0.328, -1.218, 3.129, 0.852, 0.008]
#joint_positions = [0] * 6

print joint_positions
# ---------- end jp ----------
forward_kinematics = PythonScript(robot=robot_2, set_joint_positions=Button(), joint_positions=jp, a1=a1, a2=a2, a3=a3, a4=a4, a5=a5, a6=a6)  # -> full_configuration; inputs joint_positions: list
# ---------- forward_kinematics: Python ----------
import math
import Grasshopper
from compas.robots import Joint
from compas_fab.robots import Configuration

if set_joint_positions:

    j = 0
    for i in range(ghenv.Component.Params.Input.Count):
        nslider = ghenv.Component.Params.Input[i].Sources[0]
        if nslider.GetType() == Grasshopper.Kernel.Special.GH_NumberSlider:
            nslider.TrySetSliderValue(math.degrees(joint_positions[j]))
            j += 1

if robot:
    joint_positions = [a1, a2, a3, a4, a5, a6]
    joint_types = robot.get_configurable_joint_types()
    for i, joint_type in enumerate(joint_types):
        if joint_type == Joint.REVOLUTE:
            joint_positions[i] = math.radians(joint_positions[i])
    full_configuration = Configuration(joint_positions, joint_types)

print(full_configuration)
# ---------- end forward_kinematics ----------

# ----
# IP Settings
server_ip = ValueList({"192.168.10.44", "192.168.10.12", "192.168.10.11", "192.168.10.10", "192.168.10.2", "127.0.0.1", "192.168.10.111"}, selected="192.168.10.10")
ur_ip = ValueList({"192.168.10.10", "192.168.10.20", "192.168.10.11", "192.168.10.12", "127.0.0.1", "192.168.10.111"}, selected="192.168.10.20")
server_port = ValueList({"50002", "50003", "50004", "50005"}, selected="50002")
ur_port = ValueList({"30002"}, selected="30002")
globals = PythonScript(server_address=server_ip, server_port=server_port, ur_ip=ur_ip, ur_port=ur_port, robot=robot_2)  # inputs server_port: Int32
# ---------- globals: Python ----------
from scriptcontext import sticky as st

st["server_address"] = server_address
st["server_port"] = server_port

st["ur_ip"] = ur_ip
st["ur_port"] = ur_port

st["robot"] = robot


"""
if clear:
    st.clear()
"""
# ---------- end globals ----------

# ----
# Check robot availability
ping = Button()
py_10 = PythonScript(ip=ur_ip, ping=ping)  # -> out, trigger
# ---------- py_10: Python ----------
from scriptcontext import sticky as st
from ur_fabrication_control.direct_control import is_available

guid = str(ghenv.Component.InstanceGuid)
txt_key = "txt_" + guid
if txt_key not in st:
    st[txt_key] = ""

if ping:
    
    available = is_available(ip)
    
    if available:
        st[txt_key] = "%s is up!" % ip
        trigger = True
    else:
        st[txt_key] = "%s is down!" % ip
        trigger = False

print(st[txt_key])
# ---------- end py_10 ----------
panel_12 = Panel(py_10.out)

panel_13 = Panel("Define an obstacle")
brep = Brep(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)
preview_2 = CustomPreview(Geometry=brep, Shader=ColourSwatch(SwatchColor=RGB(255, 156, 156)))
mesh_3 = Mesh(brep)
remove_2 = Button()
scale_2 = BooleanToggle(False)
add_3 = Button()

mesh_4 = PythonScript(mesh=mesh_3)  # -> compas_mesh; same code as mesh_2

collision = PythonScript(scene=scene, compas_mesh=mesh_4, scale=scale_2, id="box", add=add_3, remove=remove_2)  # -> out
# ---------- collision: Python ----------
from compas_fab.robots import CollisionMesh

cm = CollisionMesh(compas_mesh, id)

if scene:
    if add:
        scene.add_collision_mesh(cm, scale)
    if remove:
        scene.remove_collision_mesh(id)
# ---------- end collision ----------
panel_14 = Panel(collision)

# ----
# Elements
# Create an instance of the HRCElement class by inputing a box geomtry
show_2 = BooleanToggle(False)
# 2.
globals_2 = GhPythonScript()  # -> assembly
# ---------- globals_2: Python ----------
from robot_see_robot_do.assembly_orthogonal import Assembly

assembly = Assembly()

assembly.globals = {}

assembly.globals['radius'] = 0.01
assembly.globals['height'] = 1.0
assembly.globals['shift_value'] = 0.25
# ---------- end globals_2 ----------
elem_def = GhPythonScript(assembly=globals_2)  # -> out, assembly, elem_x, elem_y, elem_z
# ---------- elem_def: Python ----------
import os
import sys
import json
import math

from compas.geometry import Frame, Plane, Rotation, Vector
from compas.geometry import Box, Circle, Cylinder, Translation
from compas.datastructures import Mesh

from robot_see_robot_do.assembly_orthogonal import Element

radius = assembly.globals['radius']
height = assembly.globals['height']
shift_value = assembly.globals['shift_value']


def create_rod(frame, elem_type):
    cross_section_plane = Plane.from_frame(Frame(frame.point, frame.yaxis, frame.zaxis))
    cross_section = Circle(cross_section_plane, radius)
    elem_geo = Cylinder(cross_section, height)
    
    T_conn_1 = Translation.from_vector(frame.xaxis*-(shift_value))
    T_conn_2 = Translation.from_vector(frame.xaxis*(shift_value))
    
    R = Rotation.from_axis_and_angle(frame.zaxis, math.radians(0), frame.point)

    elem_conn_frame_1 = frame.transformed(T_conn_1*R)
    elem_conn_frame_2 = frame.transformed(T_conn_2*R)
    
    elem = Element.from_shape(elem_geo, frame)
    
    elem.connector_frame_1 = elem_conn_frame_1
    elem.connector_frame_2 = elem_conn_frame_2
    elem._type = elem_type
    elem._base_frame = Frame([0, 0, 0], [1, 0, 0], [0, 1, 0])
    
    return elem


R1 = Rotation.from_axis_and_angle(Vector.Zaxis(), math.radians(90), [0,0,0])
R2 = Rotation.from_axis_and_angle(Vector.Xaxis(), math.radians(90), [0,0,0])


f1 = Frame.worldXY() #center of the box frame 
f2 = f1.transformed(R1)
f3 = f2.transformed(R2)


elem_x = create_rod(f1, 'X')
elem_y = create_rod(f2, 'Y')
elem_z = create_rod(f3, 'Z')

Tx = Translation.from_vector([height*shift_value, 0, radius*1.0])
Ty = Translation.from_vector([0, height*shift_value, radius*3.0])
Tz = Translation.from_vector([radius*2., radius*2.,height*shift_value])

elem_x.global_trnsf = Tx
elem_y.global_trnsf = Ty
elem_z.global_trnsf = Tz
# ---------- end elem_def ----------
draw_2 = PythonScript(elements=elem_def.elem_x, show=show_2)  # -> M, F, C; inputs elements: list
# ---------- draw_2: Python ----------
from compas.artists import Artist

M = []
C = []
F = []
T = []
connectors = []

if show:
    for elem in elements:
        connectors.append(elem.connector_frame_1)
        connectors.append(elem.connector_frame_2)
        M += [Artist(elem._mesh).draw([0,0,1,1])]
        C += [Artist(frame).draw() for frame in connectors]
        F += [Artist(elem.frame).draw()]
        T += [Artist(elem.tool_frame).draw()]
# ---------- end draw_2 ----------
pln_3 = Plane(draw_2.F)
pln_4 = Plane(draw_2.C)

mesh_5 = Mesh(draw_2.M)

custom_preview = CustomPreview(Geometry=mesh_5, Material=ColourSwatch(SwatchColor=RGB(221, 0, 0)))

# ----
# 3.
# Assembly
toggle_2 = BooleanToggle(False)
cp = Plane(PlaneXY(0, 0, 0))
ct = Plane(PlaneXY(0.9066824631, 0.07990622859, -0.6182883432))
initial_configuration = GhPythonScript(
    assembly=elem_def.assembly,
    centerplane=cp,
    transform=toggle_2,
    ptransf=ct,
    elem_x=elem_def.elem_x,
    elem_y=elem_def.elem_y,
    elem_z=elem_def.elem_z)  # -> out, assembly, connector_planes; inputs transform: Boolean
# ---------- initial_configuration: Python ----------
import Rhino.Geometry as rg
import math

from compas.geometry import Frame
from compas.geometry import Transformation
from compas.geometry import Rotation, Vector
from compas.geometry import Translation
from compas.geometry import Point

from compas.artists import Artist


radius = assembly.globals['radius']
height = assembly.globals['height']
shift_value = assembly.globals['shift_value']

# just for vizualisation
connector_planes = []

cp = centerplane

cf = Frame(cp.Origin, cp.XAxis, cp.YAxis)

my_elem_x = elem_x.copy()
my_elem_y = elem_y.copy()
my_elem_z = elem_z.copy()

my_elem_x.connector_1_state = False
my_elem_y.connector_1_state = False
my_elem_z.connector_1_state = False

Tx = Translation.from_vector([height*shift_value, 0, 0])
Ty = Translation.from_vector([0, height*shift_value, radius*2])
Tz = Translation.from_vector([radius*2., radius*2.,height*shift_value])

my_elem_x.transform(Tx)
my_elem_y.transform(Ty)
my_elem_z.transform(Tz)


assembly.add_element(my_elem_x, elem_type = 'X', placed_by = 'human', frame_id=None)
assembly.add_element(my_elem_y, elem_type = 'Y', placed_by = 'human', frame_id=None)
assembly.add_element(my_elem_z, elem_type = 'Z', placed_by = 'human', frame_id=None)

assembly.network.add_edge(0, 1, edge_of = 'parent')
assembly.network.add_edge(0, 2, edge_of = 'parent')
assembly.network.add_edge(1, 2, edge_of = 'parent')

print assembly.connectors(state='open')

for connector in assembly.connectors(state='open'):
    for c in connector:
        connector_planes.append(Artist(c).draw())

if transform:
    T = Transformation.from_frame_to_frame(cf, Frame(ptransf.Origin, ptransf.XAxis, ptransf.YAxis))
    assembly.transform(T)
# ---------- end initial_configuration ----------
panel_15 = Panel("Initial assembly")
pln_5 = Plane(initial_configuration.connector_planes)
generate_assembly = GhPythonScript(
    assembly=initial_configuration.assembly,
    robot_base_plane=plane,
    angle_threshold=t,
    targets=pts,
    elem_up=element,
    elem_down=element_2,
    reset=reset,
    flip=list_4,
    shift_value=shift,
    angle=rotate,
    add_two=add,
    robot_adds=robot,
    human_adds=human,
    aggregate=aggregate)  # -> out, assembly, current_key, coll_mesh, tool_planes; inputs robot_base_plane: Plane, targets: list of Point3d
# ---------- generate_assembly: Python ----------
import Rhino.Geometry as rg
import rhinoscriptsyntax as rs
import math
import random
from scriptcontext import sticky as st
import sys

import ghpythonlib.components as ghcomp

from compas.geometry import Frame, Box, Point
from compas.geometry import Vector, Translation, angle_vectors
from compas.datastructures import mesh_offset
from compas.artists import Artist


from compas.rpc import Proxy

tool_planes = []                     # Tool planes
base_planes = [] 
filtered_keys = []
options = []

#bp = robot_base_plane
#robot_base_frame = Frame(bp.Origin, bp.XAxis, bp.YAxis)

L = list(assembly.elements())

def range_filter(options, robot_base_plane):
    ur_range_max = 1.2
    ur_range_min = 0.75
        
    base_point= Point(robot_base_plane.Origin.X, robot_base_plane.Origin.Y, robot_base_plane.Origin.Z)
    filtered_options = []
    for key, elem_origin, option_vector in options:
        v = Vector.from_start_end(elem_origin, base_point)
        dist = v.length
        if ur_range_min <= dist <= ur_range_max:
            filtered_options.append((key, elem_origin, option_vector))
    return filtered_options

def filter_options(all_options, target_points):
    tps = [Point(p.X, p.Y, p.Z) for p in target_points]
    filtered_options = []
    for tp in tps:
        for key, elem_origin, option_vector in all_options:
            v = Vector.from_start_end(elem_origin, tp)
            angle = angle_vectors(option_vector, v, deg=True)
            if angle < angle_threshold:
                filtered_options.append((key, elem_origin, option_vector))
    return filtered_options

all_options = []

for key, element in assembly.elements():
    for origin, vector in element.options_vectors(0.40):
        all_options.append((key, origin, vector))

assembly.all_options = all_options

filtered_options = filter_options(all_options, targets)
filtered_keys = []
#for option in filtered_options:
#    filtered_keys.append(option[0])
for option in all_options:
    filtered_keys.append(option[0])
    
filtered_keys = list(set(filtered_keys))
print filtered_keys

assembly.current_options = filtered_options


# store data in component
guid = str(ghenv.Component.InstanceGuid)
element_key = "elem_" + guid

if element_key not in st:
    st[element_key] = 0

if reset:
    st[element_key] = 0

if elem_up:
    if st[element_key] < len(filtered_keys) - 1:
        st[element_key] += 1

if elem_down:
    if st[element_key] <= len(filtered_keys) - 1:
        st[element_key] -= 1

    if st[element_key] < 1:
        st[element_key] = 0


current_key = filtered_keys[st[element_key]]
current_elem = assembly.network.node[current_key]['element']


# Robot adds first element
if robot_adds:
    assembly.add_unit_element(current_key, flip, shift_value, angle=90, placed_by ='robot', on_ground=True, unit_index=0)
    
# Human adds second element element
if human_adds:
    assembly.add_unit_element(current_key, flip, shift_value, angle=90, placed_by ='human', on_ground=True, unit_index=1)

# Add two elements
if add_two:
    assembly.close_unit(current_key, flip, shift_value, angle=90, on_ground = False)
    
if aggregate:
    for i in range (20):
        key_index = assembly.network.key_index()
        keys = [key_index[key] for key in assembly.network.nodes()]
        index = random.randint(0, len(keys)-1)
        shift_value = random.uniform(-0.25, 0.25)
        current_key = keys[index]
        current_elem = assembly.network.node[current_key]['element']
        elem_connector = assembly.element(current_key).connectors(state='open')
        if current_elem.connector_1_state or current_elem.connector_2_state:
            flip_index = random.randint(0, 3)
            flip = ['AA', 'AB', 'BA', 'BB'][flip_index]
            #random_angle = random.uniform(0., 360.)
            random_angle = 90
            assembly.close_unit(current_key, flip, shift_value, random_angle, on_ground = False)
            #assembly.range_filter(base_frame)
        else:
            print 'No open connectors'

key_index = assembly.network.key_index()
keys = [key_index[key] for key in assembly.network.nodes()]
new_keys = keys[-2:]
print(new_keys)

for key in keys:
    element = assembly.element(key)
    base_planes.append(Artist(element._base_frame).draw())
    tool_planes.append(Artist(element.tool_frame).draw())
    #print key, ':', assembly.network.node_attribute(key, 'elem_type')

"""

#Collision_check test
T = Translation.from_vector([0.1, -0.024 , 0])
new_elem = elem_x.transformed(T)
coll_mesh = Artist(new_elem.mesh).draw()

c = assembly.collision_check(new_elem, tolerance = -0.001)
#print c



### UNSOLVED: Error loading compas_cgal intersection module's .dll file ###

collision_func = Proxy('assembly_information_model.assembly.collision', python = 'C://Users//lidet//anaconda3//envs//cgal//python.exe')

print collision_func._python

collision_func.stop_server()
collision_func.start_server()

test = collision_func.collision_check_cgal(assembly, new_elem)
print test
"""
# ---------- end generate_assembly ----------
current_key = Panel(generate_assembly.current_key)
mesh_6 = Mesh(generate_assembly.coll_mesh)
pln_6 = Plane(generate_assembly.tool_planes)

# ----
# Network Viz
number_slider = Slider(0, range=0..47)
show_3 = BooleanToggle(True)
network_viz = GhPythonScript(assembly=generate_assembly.assembly, show_network=show_3, key=number_slider)  # -> out, nodes, edges, current_node, current_node_neighbors; inputs key: Int32
# ---------- network_viz: Python ----------
import sys, os
import ghpythonlib.components as ghcomp
import compas
from compas.datastructures import Network
from compas_ghpython.artists import NetworkArtist
from compas_rhino.geometry import RhinoLine

import compas_ghpython
import Rhino.Geometry as rg


data = assembly.network.to_data()
network = Network.from_data(data)

print assembly.network.number_of_nodes()

def draw_network(network):
    """Draw a network in Grasshopper.
    """
    points = []
    for key, attr in network.nodes(True):
        points.append({
            'pos': network.node_coordinates(key),
        })

    lines = []
    for (u, v), attr in network.edges(True):
        lines.append({
            'start': network.node_coordinates(u),
            'end': network.node_coordinates(v),
        })

    points_rg = compas_ghpython.draw_points(points)
    lines_rg = compas_ghpython.draw_lines(lines)

    return points_rg, lines_rg

if show_network:
    nodes, edges = draw_network(network)
    
    current_node = {'pos': network.node_coordinates(key), 'radius': 0.03}
    current_node = compas_ghpython.draw_spheres([current_node])
    
    current_node_neighbors_keys = network.neighbors(key)
    current_node_neighbors = [{'pos': network.node_coordinates(key), 'radius': 0.02} for key in current_node_neighbors_keys]
    current_node_neighbors = compas_ghpython.draw_spheres(current_node_neighbors)
# ---------- end network_viz ----------
pt_6 = Point(network_viz.nodes)
line = Line(network_viz.edges)
brep_2 = Brep(network_viz.current_node)
brep_3 = Brep(network_viz.current_node_neighbors)
preview_3 = CustomPreview(Geometry=brep_3, Material=ColourSwatch(SwatchColor=RGB(255, 207, 207)))
preview_4 = CustomPreview(Geometry=[brep_2, line], Material=ColourSwatch(SwatchColor=RGB(0, 0, 0)))

# ----
# Export .json
export = Button()
export_2 = Button()
py_11 = PythonScript()  # -> HERE, DATA
# ---------- py_11: Python ----------
import os

HERE = os.path.dirname(ghdoc.Path)
DATA = os.path.abspath(os.path.join(HERE, "..", "data"))
print(HERE)
print(DATA)
# ---------- end py_11 ----------
export_3 = PythonScript(DATA=py_11.DATA, assembly=generate_assembly.assembly, export_to_json=export, export_to_json_unity=export_2)
# ---------- export_3: Python ----------
import os
from compas.datastructures.mesh import mesh_quads_to_triangles
from compas.datastructures.mesh import mesh_unify_cycles

if export_to_json:
    
    filename = "rsrd_assembly.json"
    PATH = os.path.join(DATA, filename)
    
    # the assembly has to be serialized such that it can be called from CPython, True to enable pretty print
    assembly.to_json(PATH, True)
    

if export_to_json_unity:
    
    for key, e in assembly.elements():
    
        #convert to trimesh
        mesh_quads_to_triangles(e._mesh, check_angles=False)
        #mesh_unify_cycles(e._mesh)
        #print e._mesh.faces
        #print e._mesh.face_vertices(list(e._mesh.faces())[0])

    filename = "rsrd_assembly.json"
    PATH = os.path.join(DATA, filename)
    assembly.to_json(PATH)
# ---------- end export_3 ----------

# ----
# Configuration
# TODO Example:
# Add path constraints
main_planning_group = Text(info.main_group_name)
compute = Button()

# ---- group: inverse kinematics
py_12 = PythonScript(robot=robot_2)  # -> configuration
# ---------- py_12: Python ----------
from compas_fab.robots import Configuration

if robot:
    types = robot.get_configurable_joint_types()
    values = [0] * len(types)
    configuration = Configuration(values, types)
    print configuration
    print robot.get_configurable_joint_names()
# ---------- end py_12 ----------
start_configuration = Data(forward_kinematics)
list_10 = ValueList({"0", "1"}, selected="0")
filter_3 = StreamFilter(Gate=list_10, Stream0=start_configuration, Stream1=py_12)
inverse = PythonScript(robot=robot_2, group=main_planning_group, start_configuration=filter_3, plane=start_plane)  # -> out, configuration
# ---------- inverse: Python ----------
import scriptcontext as sc
import logging

from compas.geometry import Frame

from compas_fab.backends.ros import RosError
from compas_fab.robots import Configuration

LOGGER = logging.getLogger('roslibpy')

if robot:
    if robot.client:
        if robot.client.is_connected:
            frame = Frame(plane.Origin, plane.XAxis, plane.YAxis)
            configuration = robot.inverse_kinematics(frame, start_configuration, group)
            print(configuration)
        else:
            print("Robot is not connected")
# ---------- end inverse ----------

# ---- group: cartesian motion
# Plan cartesian motion
group = Data(main_planning_group)
list_11 = ValueList({"don't use attached collision mesh": 0, "use attached collision mesh": 1}, selected="don't use attached collision mesh")
py_13 = PythonScript(robot=robot_2)  # -> configuration
# ---------- py_13: Python ----------
from compas_fab.robots import Configuration

if robot:
    types = robot.get_configurable_joint_types()
    values = [0] * len(types)

    configuration = Configuration(values, types)
    print configuration
# ---------- end py_13 ----------
start_configuration_2 = Data(inverse.configuration)
list_12 = ValueList({"0", "1"}, selected="0")
avoid_collisions = BooleanToggle(False)
py_14 = PythonScript(start_plane=start_plane, end_plane=end_plane)  # -> planes
# ---------- py_14: Python ----------
planes = [start_plane, end_plane]
print planes
# ---------- end py_14 ----------
compute_2 = Button()
filter_4 = StreamFilter(Gate=list_12, Stream0=start_configuration_2, Stream1=py_13)
filter_5 = StreamFilter(Gate=list_11, Stream1=attached.acm)
plan_cartesian_motion = PythonScript(
    robot=robot_2,
    group=group,
    planes=py_14,
    start_configuration=filter_4,
    max_step=Slider(0.01, range=0..0.01),
    avoid_collisions=avoid_collisions,
    attached_collision_meshes=filter_5,
    compute=compute_2)  # -> out, trajectory; inputs planes: list, avoid_collisions: Boolean, attached_collision_meshes: list
# ---------- plan_cartesian_motion: Python ----------
"""Calculates a cartesian motion path (linear in tool space).
    Inputs:
        robot: The robot
        group: str, optional
            The planning group used for calculation. Defaults to the robot's
            main planning group.
        planes: The planes in world coordinate frame through which the path is defined.
        start_configuration: :class:`compas_fab.robots.Configuration`, optional
            The robot's full configuration, i.e. values for all configurable
            joints of the entire robot cell, at the starting position. Defaults
            to the all-zero configuration.
        max_step: float
            The approximate distance between the calculated points. (Defined in
            the robot's units)
        avoid_collisions: bool, optional
            Whether or not to avoid collisions. Defaults to True.
        attached_collision_meshes: list of :class:`compas_fab.robots.AttachedCollisionMesh`
            Defaults to None.
        compute: bool
            Press to calculate solution.
    Output:
        :class:`compas_fab.robots.JointTrajectory`
            The calculated trajectory.
"""
from __future__ import print_function
import logging
import scriptcontext as sc

from compas.geometry import Frame

LOGGER = logging.getLogger('roslibpy')

guid = str(ghenv.Component.InstanceGuid)
response_key = "response_" + guid
if response_key not in sc.sticky:
    sc.sticky[response_key] = None

frames_WCF = [Frame(plane.Origin, plane.XAxis, plane.YAxis) for plane in planes]
frames_RCF = [robot.to_local_coordinates(frame_WCF, group=None) for frame_WCF in frames_WCF]
if robot.attached_tool:
    frames_RCF = [robot.from_tcf_to_t0cf([frame])[0] for frame in frames_RCF]


if robot and robot.client and start_configuration and compute:
    if robot.client.is_connected:
        """
        sc.sticky[response_key] = robot.plan_cartesian_motion(frames,
                                                              start_configuration=start_configuration,
                                                              group=group,
                                                              options={
                                                                'max_step': float(max_step),
                                                                'avoid_collisions': bool(avoid_collisions),
                                                                'attached_collision_meshes': list(attached_collision_meshes),
                                                              })"""
        sc.sticky[response_key] = robot.plan_cartesian_motion(frames_RCF,
                                                              start_configuration=start_configuration,
                                                              group=group,
                                                              max_step=float(max_step),
                                                              avoid_collisions=bool(avoid_collisions),
                                                              attached_collision_meshes=list(attached_collision_meshes),
                                                              )
    else:
        print("Robot client is not connected")

trajectory = sc.sticky[response_key]
# ---------- end plan_cartesian_motion ----------
vis = PythonScript(response=plan_cartesian_motion.trajectory)  # -> P, V, A
# ---------- vis: Python ----------
from compas_ghpython import list_to_ghtree

if response:
    #print response.points
    positions = []
    velocities = []
    accelerations = []

    for p in response.points:
        positions.append(p.positions)
        velocities.append(p.velocities)
        accelerations.append(p.accelerations)
    #print positions
    P = list_to_ghtree(list(zip(*positions)))
    V = list_to_ghtree(list(zip(*velocities)))
    A = list_to_ghtree(list(zip(*accelerations)))
# ---------- end vis ----------
prismatic = QuickGraph(vis.P, SortOrder=0)
panel_16 = Panel("positions")
py_15 = PythonScript(robot=robot_2, group=group, trajectory=plan_cartesian_motion.trajectory)  # -> configurations, full_configurations, frames, planes, fraction, time
# ---------- py_15: Python ----------
from compas_ghpython import draw_frame

joint_positions = []

if trajectory:
    configurations = trajectory.points
    start_configuration = trajectory.start_configuration
    fraction = trajectory.fraction
    time = trajectory.time_from_start
    full_configurations = [robot.merge_group_with_full_configuration(c, trajectory.start_configuration, group) for c in configurations]
    frames = [robot.forward_kinematics(c, group, options=dict(solver='model')) for c in full_configurations]
    planes = [draw_frame(frame) for frame in frames]
    P = [plane.Origin for plane in planes]
# ---------- end py_15 ----------
fraction = Panel(py_15.fraction)
panel_17 = Panel(plan_cartesian_motion.out)
graph = QuickGraph(vis.V, SortOrder=0)
graph_2 = QuickGraph(vis.A, SortOrder=0)
panel_18 = Panel("velocities")
panel_19 = Panel("accelerations")
pline = PolyLine(Vertices=py_15.planes, Closed=False)
preview_5 = CustomPreview(Geometry=pline, Material=ColourSwatch(SwatchColor=RGB(59, 137, 161)))
start = Button()
reset_2 = Button()
step = Button()
counter = CountThroughList(L=py_15.full_configurations, start=start, step=step, reset=reset_2)  # -> item; inputs L: list, start: Boolean
# ---------- counter: Python ----------
from scriptcontext import sticky as st
from compas_ghpython.utilities import update_component


interval = 1

# store data in component
guid = str(ghenv.Component.InstanceGuid)
counter_key = "counter_" + guid
running_key = "running_" + guid

if counter_key not in st:
    st[counter_key] = 0

if running_key not in st:
    st[running_key] = False

if start:
    st[running_key] = True

if step:
    if st[counter_key] < len(L) - 1:
        st[counter_key] += 1
    
if len(L):
    item = L[st[counter_key]]

if st[running_key]:
    if st[counter_key] < len(L) - 1:
        st[counter_key] += 1
        update_component(ghenv, interval)
    else:
        st[counter_key] = 0
        st[running_key] = False
# ---------- end counter ----------

# ---- group: forward kinematics
forward = PythonScript(robot=robot_2, group=main_planning_group, full_configuration=forward_kinematics)  # -> out, frame_WCF
# ---------- forward: Python ----------
"""Calculate the robot's forward kinematic.
    Inputs:
        robot: :class:`compas_fab.robots.Robot`
            The robot.
        group: str, optional
            The planning group used for calculation. Defaults to the robot's
            main planning group.
        full_configuration : :class:`compas_fab.robots.Configuration`
            The full configuration to calculate the forward kinematic for. If no
            full configuration is passed, the zero-joint state for the other
            configurable joints is assumed.
    Output:
        :class:`Frame`
            The frame in the world coordinate frame (WCF).
"""
from __future__ import print_function
import logging

import compas_fab
print(compas_fab.__version__)

LOGGER = logging.getLogger('roslibpy')

if robot and robot.client and full_configuration:
    if robot.client.is_connected:
        #frame_WCF = robot.forward_kinematics(full_configuration, group, options={'backend':'model'})
        frame_WCF = robot.forward_kinematics(full_configuration, group, backend='model')
        print(frame_WCF)
    else:
        print("Robot is not connected")
# ---------- end forward ----------
panel_20 = Panel(forward.out)

# ---- group: plan motion
# Plan motion
# If you specify the tolerance vector with [360, 1, 1], it means that
#     the frame's y-axis and z-axis are allowed to rotate about the x-axis by an
#     angle of 360 degrees, whereas the x-axis can only change 1 degree.
number_slider_2 = Slider(1, range=1..360)
group_2 = Data(main_planning_group)
py_16 = PythonScript(robot=robot_2)  # -> configuration; same code as py_13
python_2 = PythonScript(
    robot=robot_2,
    group=group_2,
    goal_plane=end_plane,
    tolerance_position=Slider(0.001, range=0..0.001),
    tolerance_xaxis_deg=number_slider_2,
    tolerance_yaxis_deg=Slider(1, range=1..360),
    tolerance_zaxis_deg=Slider(1, range=1..360))  # -> goal_constraints
# ---------- python_2: Python ----------
import math
from compas.geometry import Frame



frame_WCF = Frame(goal_plane.Origin, goal_plane.XAxis, goal_plane.YAxis)
frame_RCF = robot.to_local_coordinates(frame_WCF, group=None)

if robot.attached_tool:
    frame_RCF = robot.from_tcf_to_t0cf([frame_RCF])[0]

tolerances_axes = [math.radians(tolerance_xaxis_deg), math.radians(tolerance_yaxis_deg), math.radians(tolerance_zaxis_deg)]

if robot:
    goal_constraints = robot.constraints_from_frame(frame_RCF, tolerance_position, tolerances_axes, group)
# ---------- end python_2 ----------
start_configuration_3 = Data(inverse.configuration)
list_13 = ValueList({"don't use attached collision mesh": 0, "use attached collision mesh": 1}, selected="use attached collision mesh")
list_14 = ValueList({"0", "1"}, selected="0")
filter_6 = StreamFilter(Gate=list_14, Stream0=start_configuration_3, Stream1=py_16)
filter_7 = StreamFilter(Gate=list_13, Stream1=attached.acm)
list_15 = ValueList({"RRT", "RRT*": "RRTStar", "EST", "PRM": "RPM", "PRM*": "RPMStar", "SPARS"}, selected="RRT")
start_2 = Button()
reset_3 = Button()
step_2 = Button()

# ----
plan_motion = PythonScript(
    robot=robot_2,
    group=group_2,
    start_configuration=filter_6,
    goal_constraints=python_2,
    planner_id=list_15,
    attached_collision_meshes=filter_7,
    compute=compute)  # -> out, trajectory; inputs goal_constraints: list, attached_collision_meshes: list
# ---------- plan_motion: Python ----------
"""Calculates a motion path.
    Inputs:
        robot: The robot
        group: str, optional
            The planning group used for calculation. Defaults to the robot's
            main planning group.
        start_configuration: :class:`compas_fab.robots.Configuration`, optional
            The robot's full configuration, i.e. values for all configurable
            joints of the entire robot cell, at the starting position. Defaults
            to the all-zero configuration.
        goal_constraints: list of :class:`compas_fab.robots.Constraint`
            The goal to be achieved, defined in a set of constraints.
            Constraints can be very specific, for example defining value domains
            for each joint, such that the goal configuration is included,
            or defining a volume in space, to which a specific robot link (e.g.
            the end-effector) is required to move to.
        planner_id: str
            The name of the algorithm used for path planning. Defaults to 'RRT'.
        attached_collision_meshes: list of :class:`compas_fab.robots.AttachedCollisionMesh`
            Defaults to None.
        compute: bool
            Press to calculate solution.
    Output:
        :class:`compas_fab.robots.JointTrajectory`
            The calculated trajectory.
"""
from __future__ import print_function
import logging
import scriptcontext as sc

guid = str(ghenv.Component.InstanceGuid)
response_key = "response_" + guid
if response_key not in sc.sticky:
    sc.sticky[response_key] = None

LOGGER = logging.getLogger('roslibpy')

if robot and robot.client and start_configuration and compute:
    if robot.client.is_connected:
        """
        sc.sticky[response_key] = robot.plan_motion(goal_constraints,
                                                    start_configuration,
                                                    group,
                                                    options={
                                                        'planner_id': str(planner_id),
                                                        'attached_collision_meshes': list(attached_collision_meshes),
                                                    })"""
        sc.sticky[response_key] = robot.plan_motion(goal_constraints,
                                                    start_configuration,
                                                    group,
                                                    planner_id=str(planner_id),
                                                    attached_collision_meshes=list(attached_collision_meshes),
                                                    )
    else:
        print("Robot client is not connected.")

trajectory = sc.sticky[response_key]
# ---------- end plan_motion ----------
panel_24 = Panel(plan_motion.out)

# ---- group: plan motion (continued)
vis_2 = PythonScript(response=plan_motion.trajectory)  # -> P, V, A, time
# ---------- vis_2: Python ----------
from compas_ghpython import list_to_ghtree

if response:

    positions = []
    velocities = []
    accelerations = []
    time_from_start = []

    for p in response.points:
        positions.append(p.positions)
        velocities.append(p.velocities)
        accelerations.append(p.accelerations)
        time_from_start.append(p.time_from_start.seconds)

    P = list_to_ghtree(list(zip(*positions)))
    V = list_to_ghtree(list(zip(*velocities)))
    A = list_to_ghtree(list(zip(*accelerations)))

    time = time_from_start[-1]
    print time
# ---------- end vis_2 ----------
time_s = Panel(vis_2.time)
prismatic_2 = QuickGraph(vis_2.P, SortOrder=0)
py_17 = PythonScript(robot=robot_2, group=group_2, trajectory=plan_motion.trajectory)  # -> start_configuration, configurations, full_configurations, frames, planes; same code as py_15
pline_2 = PolyLine(Vertices=py_17.planes, Closed=False)
graph_3 = QuickGraph(vis_2.V, SortOrder=0)
graph_4 = QuickGraph(vis_2.A, SortOrder=0)
preview_6 = CustomPreview(Geometry=pline_2, Material=ColourSwatch(SwatchColor=RGB(139, 59, 161)))
counter_2 = CountThroughList(L=py_17.full_configurations, start=start_2, step=step_2, reset=reset_3)  # -> item; inputs L: list, start: Boolean; same code as counter

# ----
list_16 = ValueList({"0 forward_kinematics": 0, "1 inverse_kinematics": 1, "2 cartesian motion": 2, "3 free-space motion": 3}, selected="0 forward_kinematics")
filter_8 = StreamFilter(Gate=list_16, Stream0=forward_kinematics, Stream1=inverse.configuration, Stream2=counter, Stream3=counter_2)

# ----
# Visualisation
# Select configuration input: from fk, ik, path, or from real robot
show_end_effector_frame = BooleanToggle(False)
show_base_frame = BooleanToggle(True)
show_collision = BooleanToggle(False)
show_frames = BooleanToggle(False)
show_visual = BooleanToggle(True)
show_acm = BooleanToggle(False)
visualize = PythonScript(
    robot=robot_2,
    group=main_planning_group,
    configuration=filter_8,
    redraw=[py_7, py_6],
    show_visual=show_visual,
    show_collision=show_collision,
    show_end_effector_frame=show_end_effector_frame,
    show_frames=show_frames,
    show_base_frame=show_base_frame,
    show_acm=show_acm)  # -> out, robot, visual, collision, attached_meshes, frames, ee_frame, base_frame; inputs redraw: list, attached_collision_meshes: list
# ---------- visualize: Python ----------
from compas.geometry import Vector
from compas.geometry import Point
from compas.geometry import Transformation
from compas.geometry import Frame
from compas_ghpython.artists import MeshArtist
from compas_fab.robots import Configuration

import ghpythonlib.components as ghcomp
from compas_rhino.conversions import xform_to_rhino

print(configuration)


if robot and configuration:
    
    robot.update(configuration, visual=show_visual, collision=show_collision)
    #T = robot.transformation_RCF_WCF()
    T = Transformation.from_change_of_basis(robot.model.base_frame_temp, Frame.worldXY())
    print T

    if show_visual:
        visual = robot.artist.draw_visual()
        visual += robot.model.base_geo_temp
        visual = ghcomp.Transform(visual, xform_to_rhino(T))

    if show_collision:
        collision = robot.artist.draw_collision()
        collision = ghcomp.Transform(collision, xform_to_rhino(T))
    
    if show_frames:
        axes = robot.transformed_axes(configuration)
        frames = robot.transformed_frames(configuration)
        [f.transform(T) for f in frames[1:]]

    if show_base_frame:
        #base_frame = robot.get_base_frame(group, configuration)
        base_frame = robot.model.base_frame_temp

    if show_end_effector_frame:
        ee_frame = robot.forward_kinematics(configuration, group)
        print("End-effector", ee_frame)
        ee_frame.transform(T)

    frame = robot.forward_kinematics(configuration, options=dict(solver='model', link_name=robot.attached_tool.link_name))
    robot.artist.update_tool(visual=visual, collision=collision, transformation=Transformation.from_frame_to_frame(Frame.worldXY(), frame))
    
    if show_acm:
        M = []
        for acm in attached_collision_meshes:
            frame = robot.forward_kinematics(configuration, options=dict(solver='model', link_name=acm.link_name))
            T = Transformation.from_frame_to_frame(Frame.worldXY(), frame)
            mesh = acm.collision_mesh.mesh.transformed(T)
            M.append(MeshArtist(mesh).draw())
        attached_meshes = M
# ---------- end visualize ----------
geo_2 = Geometry(visualize.collision)
geo_3 = Geometry(visualize.visual)
draw_3 = GhPythonScript(frames=[visualize.frames, visualize.ee_frame, visualize.base_frame], scale=Slider(0.2, range=0..1))  # -> P, V, C, W; inputs frames: list; same code as draw
vdisex_2 = VectorDisplayEx(Point=draw_3.P, Vector=draw_3.V, Colour=draw_3.C, Width=draw_3.W)
preview_7 = CustomPreview(Geometry=geo_3, Shader=ColourSwatch(SwatchColor=RGB(105, 105, 105)))
preview_8 = CustomPreview(Geometry=visualize.attached_meshes, Shader=ColourSwatch(SwatchColor=RGB(255, 255, 255)))

# ----
# Draw
# 1. Visualize assembly.
# 2. Visualize selected element & selected connector.
# 3. Visuilize all options.
# 4. Visuilize filtered options.
show_4 = BooleanToggle(True)
show_5 = BooleanToggle(True)
show_6 = BooleanToggle(True)
show_7 = BooleanToggle(False)
draw_4 = PythonScript(
    assembly=generate_assembly.assembly,
    show_assembly=show_4,
    show_selected=show_6,
    show_all_options=show_5,
    show_filtered_options=show_7,
    current_key=generate_assembly.current_key,
    flip=list_4,
    shift_value=shift)  # -> out, G_assembly, G_selected, G_option_human, G_option_robot, connector_planes, pr, vr, elem_option_robot; inputs current_key: Int32
# ---------- draw_4: Python ----------
import os
import sys
from scriptcontext import sticky as st
import Rhino.Geometry as rg
import rhinoscriptsyntax as rs

import math
from math import pi

from compas.artists import Artist
from compas.geometry import Frame
from compas.geometry import Transformation, Vector, Plane, Translation
from compas.geometry import distance_point_point


connector_planes = []
G_assembly = []
G_selected = []
G_option_robot = []
G_option_human = []
vr = []
pr = []
radius = assembly.globals['radius']

#shift_value = assembly.globals['shift_value']


key_index = assembly.network.key_index()
keys = [key_index[key] for key in assembly.network.nodes()]

current_element = assembly.element(current_key)
elem_options = assembly.element(current_key).options_elements(flip, radius, shift_value, angle=90)
elem_option_robot = elem_options[0] # elem for planning robot routine

if len(elem_options) != 0:
    elem_option = elem_options[0]
current_elem_type = current_element._type

robot_keys = list(assembly.network.nodes_where({'placed_by':'robot'}))
human_keys = list(assembly.network.nodes_where({'placed_by':'human'}))

robot_elements = [assembly.element(key) for key in robot_keys] 
human_elements = [assembly.element(key) for key in human_keys] 

def show(element, output_geo, color):
    mesh = Artist(element.mesh).draw(color)
    output_geo.append(mesh)

def show_multiple(elements, output_geo, color):
    for element in elements:
        mesh = Artist(element.mesh).draw(color)
        output_geo.append(mesh)

# Get all open connectors 
connectors = assembly.connectors(state = 'open')
# Visualize the open connector planes
connector_planes = [Artist(frame).draw() for elem_connectors in connectors for frame in elem_connectors]

# Visualise assembly
if show_assembly:
    for element in robot_elements:
        mesh = Artist(element.mesh).draw([0.7,0.7,0.7,0.1])
        G_assembly.append(mesh)
    for element in human_elements:
        mesh = Artist(element.mesh).draw([1.,0.7,0.65,0.1])
        G_assembly.append(mesh)

# Visualise current connector 
if show_selected:
    #show(current_element, G_selected, [0.3,0.4,1,1])
    if elem_options:
        #show_multiple(elem_options, G_options, [0.8,0.2,0.1,0.1])
        show(elem_options[0], G_option_robot, [0.8,0.2,0.1,0.1])
        show(elem_options[1], G_option_human, [0.5,0.7,0.65,0.5])
    else:
        connector_id = "no open connectors"

# Visualize all options
if show_all_options and not show_filtered_options:
    for key, origin, vector in assembly.all_options:
        vr.append(rg.Vector3d(*tuple(vector)))
        pr.append(rg.Point3d(origin.x, origin.y, origin.z))

# Visualize filtered options
if show_filtered_options and not show_all_options:
    for key, o, v in assembly.current_options:
        vr.append(rg.Vector3d(*tuple(v)))
        pr.append(rg.Point3d(o.x, o.y, o.z))
# ---------- end draw_4 ----------
mesh_7 = Mesh(draw_4.G_assembly)
mesh_8 = Mesh(draw_4.G_option_human)
pln_7 = Plane(draw_4.connector_planes)
vec = Vector(draw_4.vr)
mesh_9 = Mesh(draw_4.G_selected)
pt_7 = Point(draw_4.pr)
vdis = VectorDisplay(Anchor=pt_7, Vector=vec)
custom_preview_2 = CustomPreview(Geometry=mesh_7, Material=ColourSwatch(SwatchColor=RGB(255, 196, 196)))

mesh_10 = Mesh(draw_4.G_option_robot)
custom_preview_3 = CustomPreview(Geometry=mesh_8, Material=ColourSwatch(SwatchColor=RGBA(178, 219, 212, 164)))

preview_9 = CustomPreview(Geometry=mesh_10, Material=ColourSwatch(SwatchColor=RGB(255, 92, 92)))
