# Grasshopper definition ex7_rsrd_workflow_2_robots_la.ghx (Grasshopper 1.0.7)

# ----
# ROS client
disconnect = Button()
# ROBOT SEE - ROBOT DO
# Setting up of all starting elements such as ROSmaster,ROStopics, Robot URDF, and sound
list = ValueList({"local": 0, "linux computer": 1}, selected="local")
connect = Button()
connect_2 = PythonScript(ip=list, connect=connect, disconnect=disconnect)  # -> out, ros_client
# ---------- connect_2: Python ----------
import sys
import scriptcontext as sc
from compas_fab.backends import RosClient

key = 'rosclient_%s' % str(ghenv.Component.InstanceGuid)
previous_client = sc.sticky.get(key, None)

if previous_client and (connect or disconnect):
    previous_client.close()

if connect:
    if ip == 0: #local, own laptop
        ros_client = RosClient('127.0.0.1', 9090)
    elif ip == 1: # linux computer
        ros_client = RosClient('192.168.10.18', 9090)
    sc.sticky[key] = ros_client
    ros_client.run(5)

ros_client = sc.sticky.get(key, None)
print('ROS connected: {}'.format(ros_client.is_connected if ros_client else 'False'))
# ---------- end connect_2 ----------
is_connected = Panel(connect_2.out)
ros_client = Data(connect_2.ros_client)

# ----
# Robot
# Load robot from local package
list_2 = ValueList({"ur3.srdf", "ur5.srdf", "ur10.srdf", "ur3e.srdf", "ur5e.srdf", "ur10e.srdf"}, selected="ur10e.srdf")
py = PythonScript()  # -> DATA
# ---------- py: Python ----------
import os
import getpass
import scriptcontext as sc

HERE = os.path.dirname(ghdoc.Path)
DATA = os.path.abspath(os.path.join(HERE, "..", "data\models"))
print(DATA)
# ---------- end py ----------
list_3 = ValueList({"ur_description", "ur_e_description", "ur_setups"}, selected="ur_e_description")
list_4 = ValueList({"ur3.urdf", "ur3_rot.urdf", "ur5.urdf", "ur10.urdf", "ur3e.urdf", "ur5e.urdf", "ur10e.urdf", "ur10e_rot.urdf"}, selected="ur10e_rot.urdf")
py_2 = PythonScript(data_path=py, package=list_3, urdf_name=list_4, srdf_name=list_2)  # -> loaders, urdf_filename, srdf_filename
# ---------- py_2: Python ----------
import os
from compas.robots import LocalPackageMeshLoader

path = os.path.join(data_path, "robot_description")

#loaders
packages = ["ur_description", "ur_e_description", "ur_end_effectors", "ur_setups"]
loaders = [LocalPackageMeshLoader(path, pck) for pck in packages]

#files
package_path = os.path.join(path, package)
print package_path

urdf_filename = os.path.join(package_path, "urdf", urdf_name)
srdf_filename = os.path.join(package_path, srdf_name)

assert os.path.isfile(urdf_filename)
assert os.path.isfile(srdf_filename)
# ---------- end py_2 ----------

# ----
# Load initial assembly
# Import initial assembly (first rf unit)
# START
import = Button(ExpressionNormal="True", ExpressionPressed="False")
py_3 = PythonScript(import_from_json=import)  # -> HERE, DATA, import_from_json
# ---------- py_3: Python ----------
import os
from scriptcontext import sticky as st

HERE = os.path.dirname(ghdoc.Path)
DATA = os.path.abspath(os.path.join(HERE, "..", "data"))
print(HERE)
print(DATA)

st.clear()
st['DATA_PATH'] = DATA
# ---------- end py_3 ----------
initial_assembly = GhPythonScript(DATA=py_3.DATA, import_from_json=py_3.import_from_json)  # -> out, assembly; inputs import_from_json: Boolean
# ---------- initial_assembly: Python ----------
import os
import json
from scriptcontext import sticky

from robot_see_robot_do.assembly_reciprocal import Assembly

if import_from_json:
    filename = "rsrd/rsrd_current_assembly_2022_04_22_08_32_24.json"
    PATH = os.path.join(DATA, filename)
    assembly = Assembly.from_json(PATH)


#assembly.network.delete_node(6)

if assembly:
    counter = 1
    """
    for key, elem, data in assembly.elements(data=True):
        data['frame_id'] = counter
        counter +=1
    """
    sticky['assembly'] = assembly
    
    
# create a dictionary to store global value in 
assembly.globals = {}

# define global values
assembly.globals['radius'] = 0.01
assembly.globals['height'] = 1.0
assembly.globals['rf_unit_offset'] = 0.30
assembly.globals['rf_unit_radius'] = 0.1

print assembly.globals
# ---------- end initial_assembly ----------

units = ValueList({"m": 1, "cm": 100, "mm": 1000}, selected="m")
load = Button()
create = PythonScript(load=load, loaders=py_2.loaders, urdf_filename=py_2.urdf_filename, srdf_filename=py_2.srdf_filename, scale_factor=units)  # -> out, robot; inputs load: Boolean, loaders: list
# ---------- create: Python ----------
import os
from scriptcontext import sticky as st

import compas

from compas.robots import RobotModel
from compas.robots import LocalPackageMeshLoader

#from compas_fab.robots import Robot
from robot_see_robot_do.robot import Robot
from compas_fab.robots import RobotSemantics

from compas_fab.ghpython import RobotArtist

compas.PRECISION = '12f'

# store robot in component
guid = str(ghenv.Component.InstanceGuid)
robot_key = "robot_" + guid

if robot_key not in st:
    st[robot_key] = None

print loaders
if load:
    model = RobotModel.from_urdf_file(urdf_filename)
    
    model.load_geometry(*loaders)
    artist = RobotArtist(model)
    semantics = RobotSemantics.from_srdf_file(srdf_filename, model)
    robot = Robot(model, artist, semantics, client=None)

    
    st[robot_key] = robot

robot = st[robot_key]


if robot:
    robot.scale(scale_factor)
# ---------- end create ----------
set = PythonScript(robot=create.robot, client=ros_client)  # -> robot
# ---------- set: Python ----------
if robot and client:
    robot.client = client
# ---------- end set ----------
robot = Data(set)

# ----
# Info
info = PythonScript(robot=robot)  # -> out, main_group_name
# ---------- info: Python ----------
if robot:
    robot.info()
    main_group_name = robot.main_group_name
# ---------- end info ----------
panel = Panel(info.out)

# ----
# Element Definition
pln = Plane(Plane(origin=(0.2976344104, -0.05, -0.03759997007), x=(-0.9921147013, 0, 0.1253332336), y=(0, 1, 0)))
pln_2 = Plane(Plane(origin=(-0.2976344104, 0.05, -0.03759997007), x=(-0.9921147013, 0, -0.1253332336), y=(0, -1, 0)))
# HUMAN places an element
elem_def = GhPythonScript(assembly=initial_assembly.assembly, conn_1=pln, conn_2=pln_2)  # -> elem
# ---------- elem_def: Python ----------
import os
import sys
import json
import math

from compas.geometry import Frame, Plane, Rotation, Vector, Point
from compas.geometry import Circle, Cylinder, Translation
from compas.artists import Artist

from robot_see_robot_do.assembly_reciprocal import Element

rf_unit_offset = assembly.globals['rf_unit_offset']
rf_unit_radius = assembly.globals['rf_unit_radius']
radius = assembly.globals['radius']
height = assembly.globals['height']

cross_section_plane = Plane.from_frame(Frame.worldYZ())
cross_section = Circle(cross_section_plane, radius)
elem_geo = Cylinder(cross_section, height)

elem = Element.from_shape(elem_geo, Frame.worldXY())

elem.connector_frame_1 = Frame(conn_1.Origin, conn_1.XAxis, conn_1.YAxis)
elem.connector_frame_2 = Frame(conn_2.Origin, conn_2.XAxis, conn_2.YAxis)

#elem.connector_frame_2 = Frame(Point(0.295, -0.050, -0.075), Vector(0.992, 0.000, -0.125), Vector(0.000, 1.000, 0.000))
# ---------- end elem_def ----------

robot_unit = ValueList({"robot_1": 0, "robot_2": 1}, selected="robot_2")
ur_ip = ValueList({"192.168.10.10", "192.168.10.20", "192.168.10.11", "192.168.10.12", "127.0.0.1", "192.168.10.111"}, selected="192.168.10.11")

# ----
# ROBOT - IP Settings
server_ip = ValueList({"192.168.10.41", "192.168.10.12", "192.168.10.11", "192.168.10.22", "192.168.10.2", "127.0.0.1", "192.168.10.111"}, selected="192.168.10.41")
ur_ip_2 = ValueList({"192.168.10.10", "192.168.10.20", "192.168.10.11", "192.168.10.12", "127.0.0.1", "192.168.10.111"}, selected="192.168.10.20")
server_port = ValueList({"50000", "50002", "50003", "50004", "50005", "30003"}, selected="50005")
ur_port = ValueList({"30002", "30001"}, selected="30002")
globals = PythonScript(
    robot_selection=robot_unit,
    server_address=server_ip,
    server_port=server_port,
    ur_r1_ip=ur_ip_2,
    ur_r2_ip=ur_ip,
    ur_port=ur_port,
    robot=robot,
    clear=Button())  # inputs server_port: Int32
# ---------- globals: Python ----------
from scriptcontext import sticky as st

st["server_address"] = server_address
st["server_port"] = server_port

st["ur_ip_1"] = ur_r1_ip
st["ur_ip_2"] = ur_r2_ip

st["ur_port"] = ur_port

st["robot"] = robot



if clear:
    st.clear()
# ---------- end globals ----------

# ----
# Check robot availability
ping = Button()
py_4 = PythonScript(robot_selection=robot_unit, ip=[ur_ip_2, ur_ip], ping=ping)  # -> out, trigger; inputs ip: list
# ---------- py_4: Python ----------
from scriptcontext import sticky as st
from ur_fabrication_control.direct_control import is_available

guid = str(ghenv.Component.InstanceGuid)
txt_key = "txt_" + guid
if txt_key not in st:
    st[txt_key] = ""

if ping:
    
    if robot_selection == 0:
        ip = ip[0]
    else:
        ip = ip[1]
    available = is_available(ip)
    
    if available:
        st[txt_key] = "%s is up!" % ip
        trigger = True
    else:
        st[txt_key] = "%s is down!" % ip
        trigger = False

print(st[txt_key])
# ---------- end py_4 ----------
panel_2 = Panel(py_4.out)

element_manual_01 = Plane(Plane(origin=(0.9704890646, -0.2116662262, 0.6746542656), x=(0.4086249013, 0.3179904199, 0.8555160915), y=(-0.8925387181, 0.3351615884, 0.3017305857)))

# ----
# 1.
# App to Rhino:
# Topic: OBJECT POSES
# 2.
subscribe_incon_object_pose = BooleanToggle(True)
subscribe = PythonScript(ros_client=ros_client, subscribe_to_topic=subscribe_incon_object_pose)  # -> out; inputs subscribe_to_topic: Boolean
# ---------- subscribe: Python ----------
import time
import logging
import datetime
import Grasshopper
from roslibpy import Topic
from scriptcontext import sticky

LOGGER = logging.getLogger('roslibpy')
key = 'listener_obj_pose'
#print key

if subscribe_to_topic:
    if ros_client and ros_client.is_connected:
        print("subscribed to topic")
        #listener = Topic(ros_client, '/incon/object_pose', 'geometry_msgs/PoseStamped', compression=None, latch=False, throttle_rate=0, queue_size=15, queue_length=3)
        listener = Topic(ros_client, '/incon/object_poses', 'incon_msgs/PoseStampedArray')
        sticky[key] = listener
    else:
        sticky[key] = None
else:
    sticky[key] = None
# ---------- end subscribe ----------
panel_3 = Panel(subscribe)

python = GhPythonScript(plane=element_manual_01)  # -> frame
# ---------- python: Python ----------
from compas.geometry import Frame

frame = Frame(plane.Origin, plane.XAxis, plane.YAxis)
# ---------- end python ----------

# ----
# TOPIC LISTENER AND PUBLISHER
start_timer = Button()
bang = Button()
stop_timer = Button()
listening_and_publishing = GhPythonScript(bang=bang, start_timer=start_timer, stop_timer=stop_timer)  # -> out, added_elem_frame, frame_id, bang_sound
# ---------- listening_and_publishing: Python ----------
from scriptcontext import sticky
from compas_ghpython.utilities import update_component
from compas.geometry import Frame

assembly = sticky['assembly']


guid = str(ghenv.Component.InstanceGuid)
timer_running_key = "timer_running_" + guid
counter_key = "counter_" + guid

if stop_timer or timer_running_key not in sticky:
    sticky[timer_running_key] = False
    sticky[counter_key] = 0

if start_timer:
    sticky[timer_running_key] = True
    sticky[counter_key] = 0
    

if sticky[timer_running_key]:
    update_component(ghenv, 1000)
    
    sticky[counter_key] += 1
    print(sticky[counter_key])

def handle_object_options():
    options = assembly.current_options
    float_array = []
    for option in options:
        float_array += option
    size_array = len(float_array) / 1
    return float_array, len(options), size_array

def receive_message_object_poses(message):
    #sticky['message'] = str(datetime.datetime.now()) + ': ' + str(message)
    print("receiving")
    sticky['incon_msg_obj_pose'] = message


        
if 'publisher_options' in sticky:
    if sticky['publisher_options']:
        
        publisher_options = sticky['publisher_options']
        float_array, float_size, size_array = handle_object_options()
        
        float_array, float_size, size_array = handle_object_options()
        msg = {'layout': {'dim': [{'label': 'x', 'size': int(float_size), 'stride':int(len(float_array)) }, {'label': 'x', 'size': int(size_array), 'stride':int(size_array)}], 'data_offset': 0}, 'data': float_array}
        publisher_message_options = publisher_options.publish(msg)
        print('++ Publishing OBJECT OPTIONS')
        #print(msg)
    else:
        print('NOT publishing OBJECT OPTIONS')

if 'listener_obj_pose' in sticky:
    if sticky['listener_obj_pose']:
    
        listener_obj_pose = sticky['listener_obj_pose']
        listener_obj_pose.subscribe(receive_message_object_poses)
    
        if 'incon_msg_obj_pose' in sticky and sticky['incon_msg_obj_pose']:
            #bang = True 
            
            incon_msg_obj_poses = sticky['incon_msg_obj_pose']
            print("amount of object placed:" + " " + str(len(incon_msg_obj_poses['poses'])))
            if len(incon_msg_obj_poses['poses']):
                last_element = incon_msg_obj_poses['poses'][0]
                p = last_element ['pose']
                frame_id = eval(last_element['header']['frame_id'])
                added_elem_frame = Frame.from_quaternion([p['orientation']['w'],p['orientation']['x'], p['orientation']['y'], p['orientation']['z']], point = [p['position']['x'], p['position']['y'], p['position']['z']] )

                print('++ Listening to INCON MSG OBJECT POSE')
                print('frame_id: ', frame_id)
    
        else:
            bang = False
            print('NOT receiving INCON MSG OBJECT POSE')
    else:
        print('NOT listening to INCON MSG OBJECT POSE')

    
print added_elem_frame
# ---------- end listening_and_publishing ----------
panel_4 = Panel(listening_and_publishing.out)

panel_5 = Panel("Unload libraries")
bang_2 = Button()
unload = PythonScript(bang=bang_2)
# ---------- unload: Python ----------
from compas_rhino.utilities.misc import get_tolerance
from compas_rhino.utilities.misc import unload_modules

unload_modules("robot_see_robot_do")
# ---------- end unload ----------

x_axis = Curve(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)
y_axis = Curve(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)
plane = PythonScript(plane_axes=[x_axis, y_axis])  # -> plane; inputs plane_axes: list of Curve
# ---------- plane: Python ----------
import Rhino.Geometry as rg

x_axis, y_axis = plane_axes

x_axis = rg.Line(x_axis.PointAtStart, x_axis.PointAtEnd)
y_axis = rg.Line(y_axis.PointAtStart, y_axis.PointAtEnd)

if x_axis.From.DistanceTo(y_axis.From) < 0.01:
    origin = x_axis.From
    xvec = x_axis.Direction
    yvec = y_axis.Direction
elif x_axis.To.DistanceTo(y_axis.To) < 0.01:
    origin = x_axis.To
    xvec = -x_axis.Direction
    yvec = -y_axis.Direction
elif x_axis.From.DistanceTo(y_axis.To) < 0.01:
    origin = x_axis.From
    xvec = x_axis.Direction
    yvec = -y_axis.Direction
elif x_axis.To.DistanceTo(y_axis.From) < 0.01:
    origin = x_axis.To
    xvec = -x_axis.Direction
    yvec = y_axis.Direction

plane = rg.Plane(origin, xvec, yvec)
# ---------- end plane ----------

# ----
# Controls
rotate2 = Slider(0, range=0..360)
t = Slider(85, range=0..180)
human_adds = Button()
robot_adds = Button()
element = Button()
aggregate = Button()
element_2 = Button()
reset_key = Button()
add_two = Button()
list_5 = ValueList({"1-1": "AA", "1-2": "AB", "2-1": "BA", "2-2": "BB"}, selected="1-1")
pts = Point([Point(0.6575132187, 2.950100609, 1.820186629), Point(3.312696095, 1.886344314, 0.1857535972)])
angle1 = Number(120)

# ----
# Robot 2
x_axis_2 = Curve(<curve referenced from the Rhino model>)
x_axis_3 = Curve(<curve referenced from the Rhino model>)
y_axis_2 = Curve(<curve referenced from the Rhino model>)
y_axis_3 = Curve(<curve referenced from the Rhino model>)
plane_2 = PythonScript(plane_axes=[x_axis_3, y_axis_2])  # -> plane; inputs plane_axes: list of Curve; same code as plane
plane_3 = PythonScript(plane_axes=[x_axis_2, y_axis_3])  # -> plane; inputs plane_axes: list of Curve; same code as plane

# ----
# Robot 1
x_axis_4 = Curve(<curve referenced from the Rhino model>)
y_axis_4 = Curve(<curve referenced from the Rhino model>)
x_axis_5 = Curve(<curve referenced from the Rhino model>)
y_axis_5 = Curve(<curve referenced from the Rhino model>)
plane_4 = PythonScript(plane_axes=[x_axis_5, y_axis_5])  # -> plane; inputs plane_axes: list of Curve; same code as plane
plane_5 = PythonScript(plane_axes=[x_axis_4, y_axis_4])  # -> plane; inputs plane_axes: list of Curve; same code as plane

# ----
# Move Cartesian
add = Button()
list_6 = ValueList({"send all positions": 0, "send only one position": 1, "from inverse": 2}, selected="send only one position")
clear = Button()
idx = Slider(0, range=0..100)
crv = Curve(<curve referenced from the Rhino model>)
hframes = HorizontalFrames(Curve=crv, Count=10)  # -> Frames, Parameters
rec_car = PythonScript(rec=add, clear=clear)  # -> rec
# ---------- rec_car: Python ----------
from scriptcontext import sticky as st

guid = str(ghenv.Component.InstanceGuid)
recorded_key =  "recorded_" + guid
just_cleared_key = "just_cleared_" + guid


if recorded_key not in st:
    st[recorded_key] = []

if just_cleared_key not in st:
    st[just_cleared_key] = False

if clear:
    st[recorded_key] = []
    st[just_cleared_key] = True
else:
    if len(msg):
        if msg != [None] and not st[just_cleared_key] and rec:
            st[recorded_key].append(msg)
    st[just_cleared_key] = False
        


rec = st[recorded_key]

print rec
# ---------- end rec_car ----------
item = ListItem(List=hframes.Frames, Index=idx, Wrap=True)
filter = StreamFilter(Gate=list_6, Stream0=hframes.Frames, Stream1=item, Stream2=rec_car)
radius = Slider(0.5, range=0..0.5)
movel = PythonScript(planes_WCS=filter, velocity=Slider(0.075, range=0..0.5), radius=radius)  # -> urscript; inputs planes_WCS: list
# ---------- movel: Python ----------
import Rhino.Geometry as rg
from compas.geometry import Frame
from compas.geometry import Transformation, Rotation
from compas_ghpython import draw_frame
from compas_fab.robots import robot
from ur_fabrication_control import direct_control 
import math

from scriptcontext import sticky as st
from ur_fabrication_control.direct_control import URScript

robot = st["robot"]

# retrieve the current tool frame in axis angle format
if robot.attached_tool:
    tool_angle_axis = list(robot.attached_tool.frame.point) + list(robot.attached_tool.frame.axis_angle_vector)
else:
    tool0_frame = Frame([0, 0, 0], [1, 0, 0], [0, 1, 0])
    tool_angle_axis = list(tool0_frame.point) + list(tool0_frame.axis_angle_vector)

frames_RCS = []
for plane_WCS in planes_WCS:
    frame_WCS = Frame(plane_WCS.Origin, plane_WCS.XAxis, plane_WCS.YAxis)
    frame_RCS = robot.to_local_coordinates(frame_WCS)
    frames_RCS.append(frame_RCS)

urscript = URScript()
urscript.start()
urscript.moves_linear(frames_RCS, velocity, radius)
urscript.end()

urscript = urscript.generate()

print(urscript)
# ---------- end movel ----------
send = Button()
send_2 = GhPythonScript(urscript=movel, send=send)  # -> out; inputs send: Boolean
# ---------- send_2: Python ----------
from scriptcontext import sticky as st
from ur_fabrication_control.direct_control import send_script

ur_ip = st["ur_ip"]
ur_port = st["ur_port"]

if send:
    send_script(urscript, ur_ip, ur_port)
# ---------- end send_2 ----------

# ----
# Set Digital Out
number = Slider(1, range=0..10)
value = BooleanToggle(True)
digital_out = PythonScript(number=number, value=value)  # -> urscript; inputs number: Int32, value: Boolean
# ---------- digital_out: Python ----------
from ur_fabrication_control.direct_control import URScript

urscript = URScript()
urscript.start()
urscript.add_line("\tset_digital_out({}, {})".format(number, value))
urscript.end()
urscript = urscript.generate()

print(urscript)
# ---------- end digital_out ----------
send_3 = Button()
send_4 = GhPythonScript(urscript=digital_out, send=send_3)  # -> out; inputs send: Boolean; same code as send_2

# ----
# Stop
stop = Button()
stop_2 = PythonScript(stop=stop)
# ---------- stop_2: Python ----------
from scriptcontext import sticky as st
from ur_fabrication_control.direct_control.common import send_stop

ur_ip = st["ur_ip"]
ur_port = st["ur_port"]

if stop:
    send_stop(ur_ip, ur_port)
# ---------- end stop_2 ----------

# ----
# ROBOT places an element
# Robotic setup
# Tool
panel_6 = Panel("Attach a custom tool")
list_7 = ValueList({"measurement_tip": 0, "air_pick_15mm": 1, "area_gripper": 2, "parallel_gripper": 3}, selected="parallel_gripper")
show = BooleanToggle(False)
python_2 = PythonScript(data_path=py, tool=list_7, show=show)  # -> tool, M, compas_mesh
# ---------- python_2: Python ----------
import os, math
from compas.geometry import Frame, Rotation
from compas.datastructures import Mesh
from compas_ghpython.artists import MeshArtist
from compas_fab.robots import Tool

tolerance = 0


#if tool == 0:
#    filename = 'measurement_tool_zaxis.stl'
#    ee_frame = Frame([0, 0, 0.109], [1, 0, 0], [0, 1, 0])
    
if tool == 0:
    filename = 'measurement_tip_zaxis.stl'
    ee_frame = Frame([0, 0, 0.1680], [1, 0, 0], [0, 1, 0])

elif tool == 1:
    filename = 'airpick_15.stl'
    ee_frame = Frame([0, 0, 0.158 + tolerance], [1, 0, 0], [0, 1, 0])
    
elif tool == 2:
    filename = 'area_gripper_zaxis.stl'
    ee_frame = Frame([0, 0, 0.10219 + tolerance], [1, 0, 0], [0, 1, 0])

elif tool == 3:
    filename = 'parallel_gripper_iaac.stl'
    ee_frame = Frame([0, 0, 0.1135 + tolerance], [1, 0, 0], [0, 1, 0])    
    
data_path = os.path.join(data_path, "tool_geometry")
fullfilename = os.path.join(data_path, filename)
print fullfilename

ee_mesh = Mesh.from_stl(fullfilename)

#R = Rotation.from_axis_and_angle(ee_frame.zaxis, math.radians(180), point=ee_frame.point)
#ee_frame.transform(R)

if show:
    artist = MeshArtist(ee_mesh)
    M = artist.draw()

tool = Tool(ee_mesh, ee_frame)
compas_mesh = ee_mesh
# ---------- end python_2 ----------
py_5 = PythonScript(robot=robot, tool=python_2.tool, attach=Toggle(True))  # -> a
# ---------- py_5: Python ----------
if attach:
    robot.attach_tool(tool)
else:
    robot.detach_tool()
# ---------- end py_5 ----------

table_robot2 = Brep([<brep referenced from the Rhino model> x85])

# ----
# Base
table_robot1 = Geometry([<brep referenced from the Rhino model> x39])
base = PythonScript(
    robot_selection=robot_unit,
    base_plane_robot1=plane_4,
    pickup_plane_robot1=plane_5,
    base_plane_robot2=plane_2,
    pickup_plane_robot2=plane_3)  # -> base_frame, picking_frame
# ---------- base: Python ----------
from compas.geometry import Frame
from compas.geometry import Transformation, Rotation
from compas_ghpython import draw_frame
import math
import Rhino.Geometry as rg


if robot_selection == 0:
    base_plane = base_plane_robot1
    picking_frame = pickup_plane_robot1
    pickup_plane = pickup_plane_robot1
else:
    base_plane = base_plane_robot2
    picking_frame = pickup_plane_robot2
    pickup_plane = pickup_plane_robot2
    
base_frame = Frame(base_plane.Origin, base_plane.XAxis, base_plane.YAxis)
picking_frame = Frame(pickup_plane.Origin, pickup_plane.XAxis, pickup_plane.YAxis)
# ---------- end base ----------
py_6 = PythonScript(
    robot=robot,
    robot_selection=robot_unit,
    origin_frame=base.base_frame,
    base_geometry_robot1=table_robot1,
    base_geometry_robot2=table_robot2,
    picking_frame=base.picking_frame,
    set_to_origin_frame=Toggle(True))  # -> a, picking_plane_WCF; inputs base_geometry_robot1: list, base_geometry_robot2: list, set_to_origin_frame: Boolean
# ---------- py_6: Python ----------
from compas_ghpython import draw_frame
from compas.geometry import Frame, Point, Vector, Transformation
from compas.datastructures import Mesh
from compas_rhino.geometry import RhinoMesh
from compas_fab.robots import CollisionMesh



if set_to_origin_frame == True:
    robot.set_origin_frame(origin_frame)
else:
    robot.set_origin_frame(Frame.worldXY())

if robot_selection ==0:
    if len(base_geometry_robot1):
        robot.set_base_geometry(base_geometry_robot1)

if robot_selection ==1:
    if len(base_geometry_robot2):
        robot.set_base_geometry(base_geometry_robot2)
        
if picking_frame:
    picking_frame_WCF = robot.to_world_coordinates_origin(picking_frame)
    robot.set_picking_frame(picking_frame_WCF)
    picking_plane_WCF = draw_frame(picking_frame_WCF)
# ---------- end py_6 ----------

# ----
# Planning scene
scene = PythonScript(robot=robot)  # -> scene
# ---------- scene: Python ----------
from scriptcontext import sticky as st

from compas_fab.robots import PlanningScene

# store scene in component
guid = str(ghenv.Component.InstanceGuid)
scene_key = "scene_" + guid

if scene_key not in st:
    st[scene_key] = None

if robot:
    scene = PlanningScene(robot)
    scene.cm = []
    scene.acm = []
    scene.bcm = None
    st[scene_key] = scene

scene = st[scene_key]
# ---------- end scene ----------
mesh = PythonScript()  # -> elems_compas_meshes, elem_compas_mesh
# ---------- mesh: Python ----------
from compas.geometry import Frame, Transformation
from compas.artists import Artist

elems_compas_meshes = []

for key, elem in assembly.elements():
    m = elem.mesh
    elems_compas_meshes.append(m)

elem = assembly.element(0)
T = Transformation.from_change_of_basis(Frame.worldXY(), elem.frame)
mesh_transformed = elem.mesh.transformed(T)
elem_compas_mesh = mesh_transformed
# ---------- end mesh ----------

panel_7 = Panel("base collision mesh")
brep = Geometry(<brep referenced from the Rhino model>)
mesh_2 = Mesh(brep)
mesh_3 = PythonScript(mesh=mesh_2)  # -> compas_mesh
# ---------- mesh_3: Python ----------
from compas.datastructures import Mesh
from compas_rhino.geometry import RhinoMesh

compas_mesh = RhinoMesh.from_guid(mesh).to_compas()
# ---------- end mesh_3 ----------
remove = Button()
scale = BooleanToggle(False)
add_2 = Button()
collision = PythonScript(robot=robot, scene=scene, compas_mesh=mesh_3, scale=scale, id="base_cm", add=add_2, remove=remove)  # -> out, a
# ---------- collision: Python ----------
from compas_fab.robots import CollisionMesh


cm = CollisionMesh(compas_mesh, id)


if scene:
    if add:
        scene.add_collision_mesh(cm, scale)
        scene.bcm = cm
    if remove:
        scene.remove_collision_mesh(id)
        scene.bcm = None
# ---------- end collision ----------
panel_8 = Panel(collision.out)

panel_9 = Panel("assembly collision mesh")
add_3 = Button()
remove_2 = Button()
collision_2 = PythonScript(robot=robot, scene=scene, compas_meshes=mesh.elems_compas_meshes, add=add_3, remove=remove_2)  # -> out, a; inputs compas_meshes: list
# ---------- collision_2: Python ----------
from compas_fab.robots import CollisionMesh



T = robot.transformation_WCF_OCF()

cms_OCF = []
for i, compas_mesh in enumerate(compas_meshes):
    id = 'element_' + str(i)
    compas_mesh_OCF = compas_mesh.transformed(T)
    cm_OFC = CollisionMesh(compas_mesh_OCF, id)
    cms_OCF.append(cm_OFC)


if scene:
    if add:
        for cm in cms_OCF:
            scene.add_collision_mesh(cm)
            scene.cm.append(cm)
    if remove:
        for cm in cms_OCF:
            scene.remove_collision_mesh(id)
            scene.cm.remove(scene.cm[-1])
# ---------- end collision_2 ----------
panel_10 = Panel(collision_2.out)

# ----
# Parallel Gripper Switch
open = BooleanToggle(False)
digital_out_2 = PythonScript(open=open)  # -> urscript
# ---------- digital_out_2: Python ----------
from ur_fabrication_control.direct_control import URScript
from ur_fabrication_control.direct_control.mixins import ParallelGripMixins

class URScript_ParallelGrip(URScript, ParallelGripMixins):
    pass

urscript = URScript_ParallelGrip()
urscript.start()

if open:
    # Open State
    urscript.parallelgrip_open()
else: 
    # Closed State
    urscript.parallelgrip_close()

urscript.end()
urscript = urscript.generate()
print(urscript)
# ---------- end digital_out_2 ----------
send_5 = Button()
send_6 = GhPythonScript(urscript=digital_out_2, send=send_5)  # -> out; inputs send: Boolean; same code as send_2

# ----
# Attach an collision object
# Select link name to attach
# Select the links the object is allowed to touch
number_slider = Slider(7, range=0..7)
idxs = Data([3, 4, 5, 6, 7])
py_7 = PythonScript(robot=robot, idx=number_slider)  # -> link_name; inputs idx: Int32
# ---------- py_7: Python ----------
if robot:
    link_names = robot.get_link_names()
    #print link_names
    link_name = link_names[idx]
# ---------- end py_7 ----------
panel_11 = Panel(py_7)
py_8 = PythonScript(robot=robot, idxs=idxs)  # -> touch_links; inputs idxs: list of Int32
# ---------- py_8: Python ----------
if robot:
    link_names = robot.get_link_names()
    touch_links = [link_names[i] for i in idxs]
# ---------- end py_8 ----------
panel_12 = Panel(py_8)
scale_2 = BooleanToggle(False)
add_4 = Button()
remove_3 = Button()
attached = PythonScript(
    scene=scene,
    compas_mesh=mesh.elem_compas_mesh,
    scale=scale_2,
    id="tip",
    link_name=py_7,
    touch_links=py_8,
    add=add_4,
    remove=remove_3)  # -> acm, out; inputs touch_links: list
# ---------- attached: Python ----------
from compas_fab.robots import CollisionMesh
from compas_fab.robots import AttachedCollisionMesh

cm = CollisionMesh(compas_mesh, id)
acm = AttachedCollisionMesh(cm, link_name, touch_links)

if scene:
    if add:
        scene.add_attached_collision_mesh(acm, scale)
        scene.acm.append(acm)
    if remove:
        scene.remove_attached_collision_mesh(id)
        scene.remove_collision_mesh(id)
        scene.acm.remove(scene.acm[-1])
# ---------- end attached ----------

# ----
# Get Pose Joint
get = Button()
pose = PythonScript(get=get)  # -> configuration, pose_joints
# ---------- pose: Python ----------
from scriptcontext import sticky as st
from ur_fabrication_control.online_control.ur_direct import get_current_pose_joints
from compas_fab.robots import Configuration


robot = st["robot"]

server_address = st["server_address"]
server_port = st["server_port"]
ur_port = st["ur_port"]
ur_ip = st["ur_ip"]


guid = str(ghenv.Component.InstanceGuid)
pose_joints_key = "pose_joints" + guid

# retrieve the current tool frame in axis angle format
if robot.attached_tool:
    tool_angle_axis = list(robot.attached_tool.frame.point) + list(robot.attached_tool.frame.axis_angle_vector)
else:
    tool0_frame = Frame([0, 0, 0], [1, 0, 0], [0, 1, 0])
    tool_angle_axis = list(tool0_frame.point) + list(tool0_frame.axis_angle_vector)

print(tool_angle_axis)

# send script to the robot to receive the current joint configuration
if get:
    st[pose_joints_key] = get_current_pose_joints(server_address, server_port, ur_ip, tool_angle_axis)

print (st[pose_joints_key])
configuration = Configuration.from_revolute_values(st[pose_joints_key])
pose_joints = configuration.joint_values
"""
if pose_joints_key not in st:
    configuration = Configuration.from_revolute_values([0,0,0,0,0,0])
else:
    configuration = Configuration.from_revolute_values(st[pose_joints_key])

pose_joints = configuration.values
"""
# ---------- end pose ----------
panel_13 = Panel(pose.pose_joints)

# ----
# Get Pose Cartesian
get_2 = Button()
pose_2 = PythonScript(get=get_2)  # -> pose_cartesian_meter
# ---------- pose_2: Python ----------
from scriptcontext import sticky as st
from ur_fabrication_control.online_control.ur_direct import get_current_pose_cartesian
from compas.geometry import Frame
from compas_ghpython import draw_frame

robot = st["robot"]

server_address = st["server_address"]
server_port = st["server_port"]
ur_port = st["ur_port"]
ur_ip = st["ur_ip"]
pose_cartesian_meter = []

# retrieve the current tool frame in axis angle format
if robot.attached_tool:
    print ("attached")
    tool_angle_axis = list(robot.attached_tool.frame.point) + list(robot.attached_tool.frame.axis_angle_vector)
    
else:
    tool0_frame = Frame([0, 0, 0], [1, 0, 0], [0, 1, 0])
    tool_angle_axis = list(tool0_frame.point) + list(tool0_frame.axis_angle_vector)

print(tool_angle_axis)

guid = str(ghenv.Component.InstanceGuid)
pose_cartesian_key = "pose_cartesian" + guid


if get:
    print ("getting pose")
    #st[pose_cartesian_key] = get_current_pose_cartesian(tool_angle_axis, server_address, server_port, ur_ip, ur_port, send=True)
    st[pose_cartesian_key] = get_current_pose_cartesian(server_address, server_port, ur_ip, tool_angle_axis)
    

if pose_cartesian_key not in st:
    pose_cartesian_mm = []
    pose_cartesian_meter = []
else:
    pose_cartesian = st[pose_cartesian_key]

print(pose_cartesian)

for i in pose_cartesian:
    new_c = i / 1000
    pose_cartesian_meter.append(new_c)

print (pose_cartesian_meter)
# ---------- end pose_2 ----------
panel_14 = Panel(pose_2)

# ----
# Pose Estimations Robot 1
plane_init_guess_pose_1 = Plane(Plane(origin=(0.4062162518, -0.394819783, 0.6042883433), x=(0, -1, 0), y=(1, 0, 0)))
# Pose Estimations Robot 2
estimation_pose_1 = Plane(Plane(origin=(1.549981, 0.933387, 0.635228), x=(0.004938001513, 0.9999863063, 0.001733000531), y=(-0.999975766, 0.004946439546, -0.0048989981)))

# ----
# Calculate Basis - 3-Point Method
# Measure basis:
# 1. Clear the recorded poses
# 2. Move robot to origin and press "get pose"
# 3. Move robot to point in positive x-axis and press "get pose"
# 4. Move robot to an other point in your basis and press "get pose"
# (The further away these positions are, the better)
# 
# 5. Alternatively change the order in the component calc base
# 6. Copy output into base component (TODO: check if it has to be inverted)
list_8 = ValueList({"o, pos.x-axis, xy pl": 0, "o, pos.y-axis, xy pl": 1}, selected="o, pos.x-axis, xy pl")
clear_2 = Button()
rec = PythonScript(msg=pose_2, rec=get_2, clear=clear_2)  # -> rec; inputs msg: list; same code as rec_car
calc_base = PythonScript(poses=rec, input_type=list_8)  # -> out, base_plane; inputs poses: list
# ---------- calc_base: Python ----------
import Rhino.Geometry as rg
import math


if len(poses) > 2:
    
    O = poses[0]
    P1 = poses[1]
    P2 = poses[2]
    
    if input_type == 0:
        # origin, pt on positive x-axis, pt in xy plane
        origin = rg.Point3d(O[0], O[1], O[2])
        pt_on_xaxis = rg.Point3d(P1[0], P1[1], P1[2])
        pt_in_xyplane = rg.Point3d(P2[0], P2[1], P2[2])
        
        xaxis = pt_on_xaxis - origin
        xaxis.Unitize()
        
        v = pt_in_xyplane - origin
        zaxis = rg.Vector3d.CrossProduct(v, xaxis)
        zaxis.Unitize()
        
        # zaxis must look up!
        if math.acos(rg.Vector3d.ZAxis * zaxis) > math.acos(rg.Vector3d.ZAxis * -zaxis):
            zaxis = -zaxis
        
        yaxis = rg.Vector3d.CrossProduct(zaxis, xaxis)
    
    elif input_type == 1:
        # origin, pt on positive y-axis, pt in xy plane
        origin = rg.Point3d(O[0], O[1], O[2])
        pt_on_yaxis = rg.Point3d(P1[0], P1[1], P1[2])
        pt_in_xyplane = rg.Point3d(P2[0], P2[1], P2[2])
        
        yaxis = pt_on_yaxis - origin
        yaxis.Unitize()
        
        v = pt_in_xyplane - origin
        zaxis = rg.Vector3d.CrossProduct(v, yaxis)
        zaxis.Unitize()
        
        # zaxis must look up!
        if math.acos(rg.Vector3d.ZAxis * zaxis) > math.acos(rg.Vector3d.ZAxis * -zaxis):
            zaxis = -zaxis
        
        xaxis = rg.Vector3d.CrossProduct(yaxis, zaxis)
        
        
    print "Copy the following into base component:"
    print " "
    print "origin = [%.2f, %.2f, %.2f]" % tuple(list(origin))
    print "xaxis = [%.5f, %.5f, %.5f]" % tuple(list(xaxis))
    print "yaxis = [%.5f, %.5f, %.5f]" % tuple(list(yaxis))
    

#print rg.Vector3d.CrossProduct(rg.Vector3d.YAxis, rg.Vector3d.ZAxis)
#print rg.Vector3d.CrossProduct(rg.Vector3d.ZAxis, rg.Vector3d.XAxis)

    base_plane = rg.Plane(origin, xaxis, xaxis)
# ---------- end calc_base ----------
panel_15 = Panel(rec)
panel_16 = Panel(calc_base.out)

# ----
# Direct UR Control
config = GhPythonScript()  # -> out, joint_configs
# ---------- config: Python ----------
from compas_fab.robots import Configuration

values=[-0.737876, -1.64531, 1.740348, -0.367801, -0.37385, -0.110741]
joint_configs = [Configuration.from_revolute_values(values)]
# ---------- end config ----------
pln_3 = Plane(calc_base.base_plane)

# ----
# Move Joints
clear_3 = Button()
add_5 = Button()
idx_2 = Slider(0, range=0..100)
list_9 = ValueList({"send all positions": 0, "send only one position": 1, "from inverse": 2}, selected="from inverse")
rec_joints = PythonScript(msg=pose.configuration, rec=add_5, clear=clear_3)  # -> rec
# ---------- rec_joints: Python ----------
from scriptcontext import sticky as st

guid = str(ghenv.Component.InstanceGuid)
recorded_key =  "recorded_" + guid
just_cleared_key = "just_cleared_" + guid


if recorded_key not in st:
    st[recorded_key] = []

if just_cleared_key not in st:
    st[just_cleared_key] = False

if clear:
    st[recorded_key] = []
    st[just_cleared_key] = True
else:
    if msg != [None] and not st[just_cleared_key] and rec:
        st[recorded_key].append(msg)
    st[just_cleared_key] = False
        


rec = st[recorded_key]

print rec
# ---------- end rec_joints ----------
item_2 = ListItem(List=config.joint_configs, Index=idx_2, Wrap=True)
filter_2 = StreamFilter(Gate=list_9, Stream0=config.joint_configs, Stream1=item_2, Stream2=rec_joints)
movej = PythonScript(joint_configurations=filter_2, velocity=Slider(0.032, range=0..0.5))  # -> urscript, values; inputs joint_configurations: list
# ---------- movej: Python ----------
from ur_fabrication_control.direct_control import URScript
import math


"""
for c in joint_configurations:
    for i,v in enumerate(c.values):
        #print v
        if v>math.pi:
            v-=2*math.pi
        if v<-math.pi:
            v+=2*math.pi
        c.values[i]=v
print joint_configurations
values = joint_configurations[0].values
print([math.degrees(v) for v in values])
"""

#joint_config = ["movej({}, v={})".format(c.values, velocity/10) for c in joint_configurations]

urscript = URScript()
urscript.start()
for jc in joint_configurations:
    urscript.move_joint(jc, velocity)
urscript.end()

urscript = urscript.generate()

print(urscript)
# ---------- end movej ----------
send_7 = Button()
send_8 = GhPythonScript(urscript=movej.urscript, send=send_7)  # -> out; inputs send: Boolean; same code as send_2

element_manual_01_2 = Plane(Plane(origin=(0.9704890646, -0.2116662262, 0.6746542656), x=(0.4086249013, 0.3179904199, 0.8555160915), y=(-0.8925387181, 0.3351615884, 0.3017305857)))

# ----
# Input
pt = Point(Point(0.7211807741, -0.1545737349, 1.000500623))
pt_2 = Point(Point(1.098861287, -0.4457378483, 0.7248230535))
panel_17 = Panel("Start plane")
panel_18 = Panel("End plane")
py_9 = GhPythonScript(pt=pt)  # -> pln
# ---------- py_9: Python ----------
import Rhino.Geometry as rg

pln = rg.Plane(pt, -rg.Vector3d.ZAxis)
# ---------- end py_9 ----------
py_10 = GhPythonScript(pt=pt_2)  # -> pln; same code as py_9

list_10 = ValueList({"UR Robot 1": "robot_1", "UR Robot 2": "robot_2"}, selected="UR Robot 1")
global = GhPythonScript(robot=list_10)  # -> out, a
# ---------- global: Python ----------
from scriptcontext import sticky as st


if robot == "robot_1":
    st["ur_ip"] = st["ur_1_ip"]
    st["robot"] = st["robot_1"]
else:
    st["ur_ip"] = st["ur_2_ip"]
    st["robot"] = st["robot_2"]
# ---------- end global ----------

# ---- group: forward kinematics
a1 = Slider(-90, range=-360..360)
a3 = Slider(90, range=-360..360)
a4 = Slider(-90, range=-360..360)
a5 = Slider(-90, range=-360..360)
a6 = Slider(90, range=-360..360)
a2 = Slider(-90, range=-360..360)
jp = GhPythonScript()  # -> joint_positions
# ---------- jp: Python ----------
import math

joint_positions = [-90,-90,90,-90,-90,90]
joint_positions = [math.radians(a) for a in joint_positions]
#joint_positions = [-3.136, -0.328, -1.218, 3.129, 0.852, 0.008]
#joint_positions = [0] * 6

print joint_positions
# ---------- end jp ----------
forward_kinematics = PythonScript(robot=robot, set_joint_positions=Button(), joint_positions=jp, a1=a1, a2=a2, a3=a3, a4=a4, a5=a5, a6=a6)  # -> full_configuration; inputs joint_positions: list
# ---------- forward_kinematics: Python ----------
import math
import Grasshopper
from compas.robots import Joint
from compas_fab.robots import Configuration

if set_joint_positions:

    j = 0
    for i in range(ghenv.Component.Params.Input.Count):
        nslider = ghenv.Component.Params.Input[i].Sources[0]
        if nslider.GetType() == Grasshopper.Kernel.Special.GH_NumberSlider:
            nslider.TrySetSliderValue(math.degrees(joint_positions[j]))
            j += 1

if robot:
    joint_positions = [a1, a2, a3, a4, a5, a6]
    joint_types = robot.get_configurable_joint_types()
    for i, joint_type in enumerate(joint_types):
        if joint_type == Joint.REVOLUTE:
            joint_positions[i] = math.radians(joint_positions[i])
    full_configuration = Configuration(joint_positions, joint_types)

print(full_configuration)
# ---------- end forward_kinematics ----------

# ----
# 4.
# 4b.
# 4c.
estimation_pose_1_2 = Plane(Plane(origin=(1.549981, 0.933387, 0.635228), x=(0.004938001513, 0.9999863063, 0.001733000531), y=(-0.999975766, 0.004946439546, -0.0048989981)))
joint_configuration = Data(forward_kinematics)

# ----
# Calculate Basis - Point fitting method via RPC
toggle = BooleanToggle(False)
plane_init_guess = Plane(Plane(origin=(1.496149166, 0.7631375631, 0.6140144187), x=(-1.055618178e-11, 1, 0), y=(-1, -1.055618178e-11, 0)))
pt_3 = Point([<point referenced from the Rhino model> x4])
calc_base_2 = PythonScript(poses=rec, pts_cad=pt_3, base_plane_init_guess=estimation_pose_1_2, calc=toggle)  # -> out, pts_mtip_init_guess, pts_mtip_fit, base_plane_fit; inputs poses: list, pts_cad: list of Point3d, base_plane_init_guess: Plane
# ---------- calc_base_2: Python ----------
import ghpythonlib.components as ghcomp
import Rhino.Geometry as rg
from scriptcontext import sticky as st
from compas.geometry import Frame
import math as m
import sys
from compas.rpc import Proxy # for calling the numpy function in CPython

#icp_func = Proxy('ur_fabrication_control.optimisation.icp', python = 'C://Users//doerf//.conda//envs//rsrd_22//python.exe') #C:\Users\doerf\.conda\envs\rsrd_22
#print icp_func._python
#print poses
poses_estimation_1 = [[-0.52897499999999997, -0.51097899999999996, -0.62637199999999993, -0.00259867, 0.00166124, -0.00047402699999999997], [-0.93892399999999998, 0.52012900000000006, -0.61947699999999994, -0.00128827, 0.0021785199999999998, 0.00053505499999999999], [-0.440556, 0.52178999999999998, -0.624884, -0.00082253200000000006, 0.0027548, -0.000222504], [0.46294200000000002, 1.0241099999999999, -0.62009100000000006, 0.000672946, 0.0026381999999999998, 0.000130681]]
if len(poses):
    
    # get points from poses
    pts_mtip = [rg.Point3d(p[0], p[1], p[2]) for p in poses]
    
    T_W_R_init_guess = rg.Transform.PlaneToPlane(rg.Plane.WorldXY, base_plane_init_guess)
    pts_mtip_init_guess = [ghcomp.Transform(pt, T_W_R_init_guess) for pt in pts_mtip]
    
    # format Rhino transformation
    T_W_R_init_guess_flattened = [float(f) for f in T_W_R_init_guess.ToFloatArray(True)]
    T_W_R_init_guess_list = [T_W_R_init_guess_flattened[i:(i + 4)] for i in range(0, len(T_W_R_init_guess_flattened), 4)]  

    # format ptsA and ptsB
    dataB = [list(pt) for pt in pts_cad]
    dataA = [list(pt) for pt in pts_mtip]
    
    # call the function
    max_iterations = 100
    
    if calc:
        #icp_func = Proxy('ur_fabrication_control.optimisation.icp', python = 'C://Users//lidet//anaconda3//envs//ur_fab//python.exe')
        icp_func = Proxy('ur_fabrication_control.optimisation.icp', python = 'C://Users//doerf//.conda//envs//rsrd_22//python.exe') #C:\Users\doerf\.conda\envs\rsrd_22
        
        
        print icp_func._python

        transformation, distances = icp_func.icp(dataA, dataB, init_guess=T_W_R_init_guess_list, max_iterations=max_iterations, tolerance=0.000001)
        
        print "distances", distances
        
        # format result
        T = rg.Transform.Identity
        for i in range(4):
            for j in range(4):
                code = "T.M%i%i = %f" % (i, j, transformation[i][j])
                print code
                exec(code)
        #print T
        
        # now transform the points with the transformation calculated
        pts_mtip_fit = [ghcomp.Transform(pt, T) for pt in pts_mtip]
        base_plane_fit = ghcomp.Transform(rg.Plane.WorldXY, T)
        
        
        #f = Frame(base_plane_fit)
        #print f.get_pose_quaternion()
        
        # correct the zvalue
        #base_plane_fit = ghcomp.Transform(base_plane_fit, rg.Transform.Translation(0,0,-3))
# ---------- end calc_base_2 ----------
pt_4 = Point(calc_base_2.pts_mtip_fit)
pt_5 = Point(calc_base_2.pts_mtip_init_guess)
pln_4 = Plane(calc_base_2.base_plane_fit)

# ----
# 5b.
# Service: REMOVE OBJECTS
list_11 = ValueList({"by keys": 0, "by frame id": 1}, selected="by frame id")
keys = Integer([0, 1, 2])
frame_ids = Integer([5, 6])
filter_3 = StreamFilter(Gate=list_11, Stream0=keys, Stream1=frame_ids)
ros_service_request = PythonScript(ros_client=ros_client, assembly=initial_assembly.assembly, keys=filter_3, key_type=list_11, send=Button())  # -> out, assembly, bang; inputs keys: list of Int32, key_type: Int32, send: Boolean
# ---------- ros_service_request: Python ----------
import logging
import roslibpy
from roslibpy import Topic
from roslibpy import ServiceRequest
from roslibpy import Service
from roslibpy import Message
from scriptcontext import sticky


LOGGER = logging.getLogger('roslibpy') 

def ros_msg_remove_objects(keys):
    ros_msg = {}
    if key_type == 0: #by keys
        frame_ids = []
        for key in keys:
            id = assembly.network.node_attribute(key, 'frame_id')
            print id
            if id:
                frame_ids.append(id)
    else:
        frame_ids = keys
    ros_msg = {'object_ids':frame_ids}
    #print ros_msg
    return ros_msg

if send:
    print("send")
    if ros_client:
            message = ros_msg_remove_objects(keys) 
            #print (message)  
            if len(msg['object_ids']):
                service_name = '/incon/remove_objects'
                service_type = '/incon_msgs/remove_objects'
                service = roslibpy.Service(ros_client, service_name, service_type)
                request = ServiceRequest(message)
                result = service.call(request, timeout=1) #sending of message
                sticky['result_remove_objects'] = result
                if result:
                    success, num_objects_processed = (result['success'], result['num_objects_processed'])                    
                    bang = True if result['success'] == True else False
            
if 'result_remove_objects' in sticky:
    print sticky['result_remove_objects']

msg = ros_msg_remove_objects(keys)
#print len(msg['object_ids'])
print msg
# ---------- end ros_service_request ----------
panel_19 = Panel(ros_service_request.out)

# ----
# Rhino to App:
# Service: ADD INIT OBJECTS
button = Button()
# 5a.
ros_service_request_2 = PythonScript(ros_client=ros_client, assembly=initial_assembly.assembly, send=button)  # -> out, assembly, bang; inputs send: Boolean
# ---------- ros_service_request_2: Python ----------
import logging
import roslibpy
from roslibpy import Topic
from roslibpy import ServiceRequest
from roslibpy import Service
from roslibpy import Message
from scriptcontext import sticky


LOGGER = logging.getLogger('roslibpy') 


len_elems = len(list(assembly.elements()))
print len_elems
if "key_threshold" not in sticky:
    sticky["key_threshold"] = len_elems - 1

sticky["key_threshold"] = len_elems - 1
print sticky["key_threshold"]

def ros_msg_add_objects():
    ros_msg = {}
    pose_stamped_array = []
    for key, element in assembly.elements():
            x,y,z,qw,qx,qy,qz = element.get_pose_quaternion()
            pose_stamped_array.append({'header':{'seq': 0, 'stamp':{'secs': 0, 'nsecs': 0}, 'frame_id': "world"},'object_id':{'data': 5}, 'object_type':{'data': "cylinder_for_iaac_workshop.obj"}, 'pose': {'position': {'x': x, 'y': y, 'z': z}, 'orientation': {'x': qx, 'y': qy, 'z': qz, 'w': qw}}})
    ros_msg['objects'] = pose_stamped_array
    return ros_msg


if send:
    print("send")
    if ros_client:
            message = ros_msg_add_objects() #geometry_msgs/PoseStamped[]                
            service_name = '/incon/add_objects'
            service_type = '/incon_msgs/add_objects'
            service = roslibpy.Service(ros_client, service_name, service_type)
            request = ServiceRequest(message)
            print ("service request is sent")
            result = service.call(request, timeout=1) #sending of message
            sticky['result_add_objects'] = result
            
            
            if result:
                # set the frame_id as received from the app
                added_keys, added_ids = (result['added_keys'], result['added_ids'])
                #for key, id in zip(added_keys, added_ids):
                    #assembly.network.node_attribute(key, 'frame_id', id)
                    
                bang = True if result['success'] == True else False
            
if 'result_add_objects' in sticky:
    print sticky['result_add_objects']



"""
for key in sticky['result_add_objects']['added_keys']:
    print assembly.element(key, data=True)
"""

#for key, element, data in assembly.elements(data=True):
    #print data['frame_id']
# ---------- end ros_service_request_2 ----------
panel_20 = Panel(ros_service_request_2.out)

# ----
# Rhino receive and add
button_2 = Button()
pt_6 = Point([Point(-0.3511781962, 0.3142760018, 0), Point(0.2904568947, 0.3172813184, 0)])
num = Number(120)
import_object_pose = GhPythonScript(
    assembly=ros_service_request_2.assembly,
    elem=elem_def,
    add_new_elem=button_2,
    added_elem_frame=python,
    targets=pt_6,
    angle_threshold=num,
    frame_id=listening_and_publishing.frame_id)  # -> out, planes, added_elem_geo, assembly, add_new_elem; inputs targets: list of Point3d
# ---------- import_object_pose: Python ----------
import os
import sys
import Rhino.Geometry as rg
import ast

from scriptcontext import sticky

from compas.geometry import Frame, Plane, Point
from compas.geometry import Transformation, Translation
from compas.artists import Artist

planes = []
all_options = []
min_dist = 0.25
object_poses = []


#print(list(assembly.network.nodes()))
#print(list(assembly.network.nodes_where({'key':0})))
#print(((assembly.element(0, data=True))))

if 'assembly' not in sticky:
    sticky['assembly'] = assembly

# visualise the geo of newly received pose
if added_elem_frame:
    T = Transformation.from_frame(added_elem_frame)
    #print(type(added_elem_frame))
    added_elem = elem.transformed(T)
    added_elem_geo = Artist(added_elem.mesh).draw()
    elem_plane = Artist(added_elem_frame).draw()


# check if frame_id exists:
key_frame_id = []
if frame_id:
    
    #key_frame_id = list(assembly.network.nodes_where({'frame_id': frame_id})) #[key for key in assembly.network.nodes_where({'frame_id': frame_id})]
    key_frame_id = [key for key in assembly.network.nodes_where({'frame_id': frame_id})]
    
    print "frame_id, key_frame_id: ", frame_id, key_frame_id
    #print assembly.element(key_frame_id[0])
    #print list(assembly.network.nodes())
    #assembly.network.node_attribute(key_frame_id[0], name='frame_est', value=added_elem_frame)
    #print assembly.network.node_attribute(key_frame_id[0], 'frame_est')
   

#if not len(key_frame_id) and frame_id and add_new_elem: # if frame_id does not yet exist in the assembly
if len(key_frame_id)<2 and frame_id and add_new_elem: # if frame_id does not yet exist in the assembly
    print('hello')
    
    frame_id = frame_id
#    p = added_elem_frame.point
#    
#    
#    #add a new module based on the tracked element's location
#    assembly.p_key = assembly.parent_key(p, min_dist) # compute parent key
#    current_key = assembly.p_key
#    print('current_key', current_key)
#    e = assembly.element(current_key)
#    current_type = e._type
#    print('type:', current_type)
#    #compute direction
#    axis_map = {'X': 0, 'Y': 1, 'Z': 2}
#    if p[axis_map[current_type]] < e.frame.point[axis_map[current_type]]:
#        direction = 0
#        connector_frame = e.connector_frame_2
#    else:
#        direction = 1
#        connector_frame = e.connector_frame_1
#
#    a = connector_frame.point[axis_map[current_type]]
#    b = p[axis_map[current_type]]
#
#    if current_type == 'Z':
#        b -= e._source.xsize/2.
#        
#    if abs(a) > abs(b): 
#        shift_value = abs(a - b)
#    else:
#        shift_value = -abs(a - b)
#        
#    #print(shift_value)
#    
#    if current_type == 'Y':
#        c = connector_frame.point.x - added_elem_frame.point.x
#        print (c)
#        T = Translation(added_elem_frame.xaxis*-c)
#        new_elem_x = elem_x.transformed(T)
#    else:
#        new_elem_x = elem_x
#    

    assembly.add_element(added_elem, placed_by='human', frame_id=frame_id)
    #assembly.add_element_(elem, current_key, direction=0, shift_value=0, placed_by='robot', on_ground=False, module_index=0, frame_id=None, frame_est=None)
# ---------- end import_object_pose ----------
pln_5 = Plane(import_object_pose.planes)
mesh_4 = Mesh(import_object_pose.added_elem_geo)

# ----
# Export .json
# END
export = Button()
export_2 = Button()
pt_7 = Point([<point referenced from the Rhino model> x3])
python_3 = GhPythonScript(
    DATA=py_3.DATA,
    assembly=import_object_pose.assembly,
    export_to_json=export_2,
    export_for_start=export,
    add_new_elem=import_object_pose.add_new_elem,
    QR_code=pt_7)  # -> out; inputs export_to_json: Boolean, QR_code: list of Point3d
# ---------- python_3: Python ----------
import os
import compas

from datetime import datetime
now = datetime.now() # current date and time

date_time = now.strftime("%Y_%m_%d_%H_%M_%S")
filename = "rsrd/rsrd_current_assembly_{}.json".format(date_time)

QRcodes= []
if QR_code == True:
    for p in QR_code:
        QRcodes.append(compas.geometry.Frame(p, (1, 0, 0),(0, 1, 0)))


if export_for_start:
    filename = "rsrd/rsrd_start_assembly_{}.json".format(date_time)
    print (filename)
    PATH = os.path.join(DATA, filename)
    assembly.export_to_json_incon(PATH, QRcodes, True)

if export_to_json or add_new_elem:
    filename = "rsrd/rsrd_current_assembly_{}.json".format(date_time)
    print (filename)
    PATH = os.path.join(DATA, filename)
    assembly.to_json(PATH, True)
# ---------- end python_3 ----------
filename = Panel(python_3)

panel_21 = Panel(import_object_pose.out)

# ----
# Sound
button_3 = Button()
sound = GhPythonScript(init=Button())  # -> out, ps
# ---------- sound: Python ----------
from threading import Thread, Condition
import time

from scriptcontext import sticky as st
import winsound
import os


sounds = {'add_objects': "add.wav", 'remove_objects': "remove.wav", 'receive_objects': "receive.wav", 'accept_new_object': "accept.wav", 'end': "end.wav"}
DATA = st['DATA_PATH']
print (DATA)

class PlaySound():
    
    def __init__(self, sounds, path):
        self.sounds = sounds
        self.path = path
        self.sound = sounds['add_objects']
        self.log_messages = []
        self.log_messages_length = 10

        self.iterations = 0        
        self.run_thread_flag = True
        self.log("INIT")
        self.reset()
        self.log("RESET")

    def reset(self):
        self.run_thread_flag = True
        self.t = Thread(target = self.run)
        self.t.daemon = True  # OK for main to exit even if instance is still running
        self.t.paused = True  # start out paused
        self.t.state = Condition()
        
    def resume(self):
        with self.t.state:
            self.t.paused = False
            self.t.state.notify()  # unblock self if waiting

    def pause(self):
        with self.t.state:
            self.t.paused = True  # make self block and wait
    
    def start(self):
        self.t.start()
    
    def join(self):
        self.t.join()
    
    def is_paused(self):
        return self.t.paused
    
    def is_alive(self):
        return self.t.is_alive()
    
    def set_sound(self, sound):
        self.sound = self.sounds[sound]
    
    def run(self):
        self.resume() 
        while True:
            with self.t.state:
                if self.t.paused:
                    self.t.state.wait() # block until notified
                
                if self.run_thread_flag == False:
                    break
                
                ok = self.perform_task()
                
            self.iterations += 1
            
            if self.run_thread_flag == False:
                break

    def perform_task(self):
        """ This method has to be overwitten ... """
        
        self.log("TASK START: ---->>>>>")
        
        # do something
        self.log(self.sound)
        path = os.path.join(DATA, self.sound)
        winsound.PlaySound(path, winsound.SND_FILENAME)
        ok = True
        
        if not ok:
            return False
        
        self.log("----<<<<< TASK FINISHED")
        
        self.run_thread_flag = False
        self.log("run_thread_flag to FALSE")
        return True
    
    def log(self, msg):
        self.log_messages.append("SOUND: " + str(msg))
        if len(self.log_messages) > self.log_messages_length:
            self.log_messages = self.log_messages[-self.log_messages_length:] 
    
    def get_log_messages(self):       
        return "\n".join(self.log_messages)
        

ps = PlaySound(sounds, DATA)
# ---------- end sound ----------
play = GhPythonScript(
    ps=sound.ps,
    sound_add_objects=ros_service_request_2.bang,
    sound_remove=ros_service_request.bang,
    sound_receive=button_3,
    sound_end=Button(),
    stop=Button())  # -> out
# ---------- play: Python ----------
if sound_add_objects:
    ps.reset()
    ps.set_sound('add_objects')
    ps.run_thread_flag = True
    ps.start()
    
    
if sound_remove:
    ps.reset()
    ps.set_sound('remove_objects')
    ps.run_thread_flag = True
    ps.start()

if sound_receive:
    ps.reset()
    ps.set_sound('receive_objects')
    ps.run_thread_flag = True
    ps.start()

if sound_accept_new_object:
    ps.reset()
    ps.set_sound('accept_new_object')
    ps.run_thread_flag = True
    ps.start()

if sound_end:
    ps.reset()
    ps.set_sound('end')
    ps.run_thread_flag = True
    ps.start()
    
    
if stop:
    ps.run_thread_flag = False
    ps.join()
    
print(ps.get_log_messages())
# ---------- end play ----------

# ----
# Transform Assembly
pt_8 = Point(Point(0.8066418178, -0.2191574706, 0.4222242235))
x = Curve(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)
y = Curve(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)
pl = ConstructPlane(Origin=pt_8, XAxis=x, YAxis=y)
transform = GhPythonScript(assembly=import_object_pose.assembly, transform=Toggle(False), trnsf_plane=pl)  # -> out, assembly, planes
# ---------- transform: Python ----------
from compas.geometry import Frame
from compas.geometry import Transformation

from compas.artists import Artist

planes = []

if transform:
    T = Transformation.from_frame_to_frame(Frame.worldXY(), Frame(trnsf_plane.Origin, trnsf_plane.XAxis, trnsf_plane.YAxis))
    assembly.transform(T)
    assembly.network.transform(T)
    
    
for key, element in assembly.elements():
    planes.append(Artist(element.frame).draw())
print (assembly)
# ---------- end transform ----------

# ----
# Add support
toggle_2 = BooleanToggle(True)
pln_6 = Plane(Plane(origin=(0.8284965546, -0.116329934, 0.3446181635), x=(0.5836778286, 0.5396858127, -0.6066790058), y=(0.6788954185, -0.7342349834, 0)))
support = GhPythonScript(assembly=transform.assembly, add_support=toggle_2, elem=elem_def, support_plane=pln_6)  # -> out, support_geo, assembly
# ---------- support: Python ----------
from compas.geometry import Frame, Transformation
from compas.artists import Artist

T_support = Transformation.from_frame(Frame(support_plane.Origin, support_plane.XAxis, support_plane.YAxis))
added_support_elem = elem.transformed(T_support)

if add_support:
    support_geo = Artist(added_support_elem.mesh).draw()
# ---------- end support ----------
mesh_5 = Mesh(support.support_geo)

generate_assembly = GhPythonScript(
    assembly=support.assembly,
    robot_base_plane=plane,
    angle_threshold=t,
    targets=pts,
    element_up=element,
    element_down=element_2,
    reset=reset_key,
    flip=list_5,
    angle1=angle1,
    angle2=rotate2,
    add_two=add_two,
    robot_adds=robot_adds,
    human_adds=human_adds,
    aggregate=aggregate)  # -> out, assembly, current_key, coll_mesh, tool_planes; inputs robot_base_plane: Plane, targets: list of Point3d
# ---------- generate_assembly: Python ----------
import Rhino.Geometry as rg
import rhinoscriptsyntax as rs
import math
import random
from scriptcontext import sticky as st
import sys

import ghpythonlib.components as ghcomp

from compas.geometry import Frame, Box, Point
from compas.geometry import Vector, Translation, angle_vectors
from compas.datastructures import mesh_offset
from compas.artists import Artist


from compas.rpc import Proxy

tool_planes = []                     # Tool planes
filtered_keys = []
#options = []
all_options = []

L = list(assembly.elements())

robot_base_frame = Frame(robot_base_plane.Origin, robot_base_plane.XAxis, robot_base_plane.YAxis)

def range_filter(options, robot_base_plane):
    ur_range_max = 1.2
    ur_range_min = 0.75
        
    robot_base_point= Point(robot_base_plane.Origin.X, robot_base_plane.Origin.Y, robot_base_plane.Origin.Z)
    filtered_options = []
    for key, elem_origin, option_vector in options:
        v = Vector.from_start_end(elem_origin, robot_base_point)
        dist = v.length
        if ur_range_min <= dist <= ur_range_max:
            filtered_options.append((key, elem_origin, option_vector))
    return filtered_options

def filter_options(all_options, target_points):
    tps = [Point(p.X, p.Y, p.Z) for p in target_points]
    filtered_options = []
    for tp in tps:
        for key, elem_origin, option_vector in all_options:
            v = Vector.from_start_end(elem_origin, tp)
            angle = angle_vectors(option_vector, v, deg=True)
            if angle < angle_threshold:
                filtered_options.append((key, elem_origin, option_vector))
    return filtered_options

for key, element in assembly.elements():
    for origin, vector in element.options_vectors(-0.40):
        all_options.append((key, origin, vector))

assembly.all_options = all_options

filtered_options = filter_options(all_options, targets)

#for option in filtered_options:
#    filtered_keys.append(option[0])

for option in all_options:
    filtered_keys.append(option[0])
    
filtered_keys = list(set(filtered_keys))
print 'Filtered keys:', filtered_keys

assembly.current_options = filtered_options

# store data in component
guid = str(ghenv.Component.InstanceGuid)
element_key = "elem_" + guid

if element_key not in st:
    st[element_key] = 0

if reset:
    st[element_key] = 0

if element_up:
    if st[element_key] < len(filtered_keys) - 1:
        st[element_key] += 1

if element_down:
    if st[element_key] <= len(filtered_keys) - 1:
        st[element_key] -= 1

    if st[element_key] < 1:
        st[element_key] = 0

print filtered_keys

if len(filtered_keys):
    current_key = filtered_keys[st[element_key]]
    current_elem = assembly.network.node[current_key]['element']
else:
    current_key = None
    current_elem = None


# Robot adds first element
if robot_adds:
    assembly.add_unit_element(current_key, flip, angle1, angle2, placed_by ='robot', on_ground=False, unit_index=0)
    
# Human adds second element element
if human_adds:
    assembly.add_unit_element(current_key, flip, angle1, angle2, placed_by ='human', on_ground=False, unit_index=1)

# Add two elements
if add_two:
    assembly.close_unit(current_key, flip, angle1, angle2, on_ground = False)

# random growth
if aggregate:
    for i in range (20):
        key_index = assembly.network.key_index()
        keys = [key_index[key] for key in assembly.network.nodes()]
        index = random.randint(0, len(keys)-1)
        current_key = keys[index]
        current_elem = assembly.network.node[current_key]['element']
        elem_connector = assembly.element(current_key).connectors(state='open')
        if current_elem.connector_1_state or current_elem.connector_2_state:
            flip_index = random.randint(0, 3)
            flip = ['AA', 'AB', 'BA', 'BB'][flip_index]
            random_angle1 = random.uniform(0., 360.)
            random_angle2 = random.uniform(0., 360.)
            #random_angle1 = 0
            #random_angle2 = 0
            assembly.close_unit(current_key, flip, random_angle1, random_angle2, on_ground = False)
            #assembly.range_filter(robot_base_frame)
        else:
            print 'No open connectors'

key_index = assembly.network.key_index()
keys = [key_index[key] for key in assembly.network.nodes()]
new_keys = keys[-2:]
print 'Last added keys:', new_keys

for key in keys:
    element = assembly.element(key)
    tool_planes.append(Artist(element.tool_frame).draw())


"""
#Collision_check test
T = Translation.from_vector([0.1, -0.024 , 0])
new_elem = elem_x.transformed(T)
coll_mesh = Artist(new_elem.mesh).draw()

c = assembly.collision_check(new_elem, tolerance = -0.001)
#print c


### UNSOLVED: Error loading compas_cgal intersection module's .dll file ###

collision_func = Proxy('assembly_information_model.assembly.collision', python = 'C://Users//lidet//anaconda3//envs//cgal//python.exe')

print collision_func._python

collision_func.stop_server()
collision_func.start_server()

test = collision_func.collision_check_cgal(assembly, new_elem)
print test
"""
# ---------- end generate_assembly ----------
pln_7 = Plane(generate_assembly.tool_planes)
mesh_6 = Mesh(generate_assembly.coll_mesh)

# ----
# Visualization
# 1. Visualize assembly.
# 2. Visualize selected connector.
# 3. Visuilize all options.
# 4. Visuilize filtered options.
toggle_3 = BooleanToggle(True)
show_2 = BooleanToggle(True)
show_3 = BooleanToggle(True)
show_4 = BooleanToggle(True)
show_5 = BooleanToggle(False)
draw = PythonScript(
    assembly=generate_assembly.assembly,
    show_assembly=show_2,
    show_selected=show_3,
    show_all_options=show_4,
    show_filtered_options=show_5,
    current_key=generate_assembly.current_key,
    flip=list_5,
    angle1=angle1,
    angle2=rotate2,
    flip_robot_human=toggle_3)  # -> out, G_initial, G_built_by_human, G_built_by_robot, G_selected, G_option_human, G_option_robot, connector_planes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; inputs current_key: Int32
# ---------- draw: Python ----------
import os
import sys
from scriptcontext import sticky as st
import Rhino.Geometry as rg

import math
from math import pi

from compas.artists import Artist

connector_planes = []
G_initial = []
G_built_by_human = []
G_built_by_robot = []
G_selected = []
G_option_robot = []
G_option_human = []
vr = []
pr = []

radius = assembly.globals['radius']

def show(element, output_geo, color):
    mesh = Artist(element.mesh).draw(color)
    output_geo.append(mesh)

def show_multiple(elements, output_geo, color):
    for element in elements:
        mesh = Artist(element.mesh).draw(color)
        output_geo.append(mesh)
        
if current_key:
    current_element = assembly.element(current_key)
    elem_options = assembly.element(current_key).options_elements(flip, angle1, angle2)
else:
    current_element = None
    elem_options = []

if len(elem_options) != 0:
    elem_option = elem_options[0]
    
print current_key

if flip_robot_human:
    elem_options.reverse()

robot_keys = list(assembly.network.nodes_where({'placed_by':'robot'}))
human_keys = list(assembly.network.nodes_where({'placed_by':'human'}))
initial_keys = list(assembly.network.nodes_where({'placed_by':'initial'}))

robot_elements = [assembly.element(key) for key in robot_keys] 
human_elements = [assembly.element(key) for key in human_keys] 
initial_elements = [assembly.element(key) for key in initial_keys] 

# Visualize the open connector planes
connector_planes = [Artist(frame).draw() for elem_connectors in assembly.connectors(state = 'open') for frame in elem_connectors]

# Visualise assembly
if show_assembly:
    for element in robot_elements:
        mesh = Artist(element.mesh).draw([0.7,0.7,0.75,0.1])
        G_built_by_robot.append(mesh)
    for element in human_elements:
        mesh = Artist(element.mesh).draw([1.,0.7,0.65,0.1])
        G_built_by_human.append(mesh)
    for element in initial_elements:
        mesh = Artist(element.mesh).draw([0.8,0.8,0.8,0.1])
        G_initial.append(mesh)

# Visualise current connector 
if show_selected:
    if elem_options:
        show(elem_options[0], G_option_robot, [0.7,0.9,0.9,0.8])
        show(elem_options[1], G_option_human, [0.8,0.2,0.1,0.1])
    else:
        print('No open connectors')

# Visualize all options
if show_all_options and not show_filtered_options:
    for key, origin, vector in assembly.all_options:
        vr.append(rg.Vector3d(*tuple(vector)))
        pr.append(rg.Point3d(origin.x, origin.y, origin.z))

# Visualize filtered options
if show_filtered_options and not show_all_options:
    for key, o, v in assembly.current_options:
        vr.append(rg.Vector3d(*tuple(v)))
        pr.append(rg.Point3d(o.x, o.y, o.z))

if len(elem_options):
    elem_option_robot = elem_options[0] # elem for planning robot routine
else:
    elem_option_robot = None
# ---------- end draw ----------
vec = Vector(draw.vr)
mesh_7 = Mesh(draw.G_initial)
mesh_8 = Mesh(draw.G_built_by_human)
mesh_9 = Mesh(draw.G_built_by_robot)
mesh_10 = Mesh(draw.G_selected)
mesh_11 = Mesh(draw.G_option_human)
mesh_12 = Mesh(draw.G_option_robot)
pln_8 = Plane(draw.connector_planes)
pt_9 = Point(draw.pr)
vdis = VectorDisplay(Anchor=pt_9, Vector=vec)
custom_preview = CustomPreview(Geometry=mesh_7, Material=ColourSwatch(SwatchColor=RGBA(189, 189, 189, 197)))
custom_preview_2 = CustomPreview(Geometry=mesh_8, Material=ColourSwatch(SwatchColor=RGB(255, 196, 196)))
custom_preview_3 = CustomPreview(Geometry=mesh_9, Material=ColourSwatch(SwatchColor=RGBA(154, 196, 212, 164)))
preview = CustomPreview(Geometry=mesh_11, Material=ColourSwatch(SwatchColor=RGB(255, 92, 92)))
custom_preview_4 = CustomPreview(Geometry=mesh_12, Material=ColourSwatch(SwatchColor=RGBA(178, 219, 212, 164)))

# ----
# 3.
# Design Generation
current_key = Panel(generate_assembly.current_key)
status_update = Panel(generate_assembly.out)

# ----
# Network Viz
number_slider_2 = Slider(0, range=0..47)
show_6 = BooleanToggle(False)
network_viz = GhPythonScript(assembly=generate_assembly.assembly, show_network=show_6, key=number_slider_2)  # -> out, nodes, edges, current_node, current_node_neighbors; inputs key: Int32
# ---------- network_viz: Python ----------
import sys, os
import ghpythonlib.components as ghcomp
from compas.datastructures import Network
from compas_ghpython.artists import NetworkArtist
from compas_rhino.geometry import RhinoLine

import compas_ghpython
import Rhino.Geometry as rg


data = assembly.network.to_data()
network = Network.from_data(data)

print assembly.network.number_of_nodes()

def draw_network(network):
    """Draw a network in Grasshopper.
    """
    points = []
    for key, attr in network.nodes(True):
        points.append({
            'pos': network.node_coordinates(key),
        })

    lines = []
    for (u, v), attr in network.edges(True):
        lines.append({
            'start': network.node_coordinates(u),
            'end': network.node_coordinates(v),
        })

    points_rg = compas_ghpython.draw_points(points)
    lines_rg = compas_ghpython.draw_lines(lines)

    return points_rg, lines_rg

if show_network:
    nodes, edges = draw_network(network)
    
    current_node = {'pos': network.node_coordinates(key), 'radius': 0.03}
    current_node = compas_ghpython.draw_spheres([current_node])
    
    current_node_neighbors_keys = network.neighbors(key)
    current_node_neighbors = [{'pos': network.node_coordinates(key), 'radius': 0.02} for key in current_node_neighbors_keys]
    current_node_neighbors = compas_ghpython.draw_spheres(current_node_neighbors)
# ---------- end network_viz ----------
brep_2 = Brep(network_viz.current_node_neighbors)
pt_10 = Point(network_viz.nodes)
line = Line(network_viz.edges)
brep_3 = Brep(network_viz.current_node)
preview_2 = CustomPreview(Geometry=[brep_3, line], Material=ColourSwatch(SwatchColor=RGB(0, 0, 0)))
preview_3 = CustomPreview(Geometry=brep_2, Material=ColourSwatch(SwatchColor=RGB(255, 207, 207)))

flip = BooleanToggle(False)
python_4 = GhPythonScript(robot=robot, element=draw.elem_option_robot, rotation_angle=Slider(120, range=-90..120))  # -> out, picking_plane_WCF, placing_plane_WCF, picking_plane_safe_WCF, placing_plane_safe_WCF
# ---------- python_4: Python ----------
import math
from compas.geometry import Frame, Transformation
from compas_ghpython import draw_frame
import Rhino.Geometry as rg

picking_frame_WCF = robot.get_picking_frame()
picking_plane_WCF = draw_frame(picking_frame_WCF)

placing_frame_WCF = element.tool_frame
placing_plane_WCF = draw_frame(placing_frame_WCF)
placing_plane_WCF.Rotate(math.radians(rotation_angle), placing_plane_WCF.XAxis)


picking_plane_safe_WCF = rg.Plane(picking_plane_WCF)
picking_plane_safe_WCF.Translate(picking_plane_WCF.ZAxis*-0.10)

placing_plane_safe_WCF = rg.Plane(placing_plane_WCF)
placing_plane_safe_WCF.Translate(placing_plane_WCF.ZAxis*-0.10)
# ---------- end python_4 ----------

# ----
# 4a.
placing_plane = Plane(python_4.placing_plane_WCF)
start_plane = Plane(python_4.picking_plane_safe_WCF)
end_plane = Plane(python_4.placing_plane_safe_WCF)

# ---- group: inverse kinematics
py_11 = PythonScript(robot=robot)  # -> configuration
# ---------- py_11: Python ----------
from compas_fab.robots import Configuration

if robot:
    types = robot.get_configurable_joint_types()
    values = [0] * len(types)
    configuration = Configuration(values, types)
    print configuration
    print robot.get_configurable_joint_names()
# ---------- end py_11 ----------
start_configuration = Data(forward_kinematics)
list_12 = ValueList({"start": 0, "end": 1}, selected="start")
list_13 = ValueList({"0", "1"}, selected="0")
filter_4 = StreamFilter(Gate=list_13, Stream0=start_configuration, Stream1=py_11)
filter_5 = StreamFilter(Gate=list_12, Stream0=start_plane, Stream1=end_plane)

# ----
# Configuration
# TODO Example:
# Add path constraints
main_planning_group = Text(info.main_group_name)
compute = Button()

# ---- group: inverse kinematics (continued)
inverse = PythonScript(robot=robot, group=main_planning_group, start_configuration=filter_4, plane=filter_5, compute=Toggle(True))  # -> out, configuration
# ---------- inverse: Python ----------
import scriptcontext as sc
import logging

from compas.geometry import Frame

from compas_fab.backends.ros import RosError
from compas_fab.robots import Configuration

LOGGER = logging.getLogger('roslibpy')

frame_WCF = Frame(plane.Origin, plane.XAxis, plane.YAxis)
frame_OCF = robot.to_local_coordinates_origin(frame_WCF) # express within the robot frame
if robot.attached_tool:
    frame_OCF = robot.from_tcf_to_t0cf([frame_OCF])[0]

if robot:
    if robot.client and compute:
        if robot.client.is_connected:
            configuration = robot.inverse_kinematics(frame_OCF, start_configuration, group)
            print(configuration)
        else:
            print("Robot is not connected")
# ---------- end inverse ----------
panel_22 = Panel(inverse.out)

# ---- group: forward kinematics
forward = PythonScript(robot=robot, group=main_planning_group, full_configuration=forward_kinematics)  # -> out, frame_WCF
# ---------- forward: Python ----------
"""Calculate the robot's forward kinematic.
    Inputs:
        robot: :class:`compas_fab.robots.Robot`
            The robot.
        group: str, optional
            The planning group used for calculation. Defaults to the robot's
            main planning group.
        full_configuration : :class:`compas_fab.robots.Configuration`
            The full configuration to calculate the forward kinematic for. If no
            full configuration is passed, the zero-joint state for the other
            configurable joints is assumed.
    Output:
        :class:`Frame`
            The frame in the world coordinate frame (WCF).
"""
from __future__ import print_function
import logging

import compas_fab
print(compas_fab.__version__)

LOGGER = logging.getLogger('roslibpy')

if robot and robot.client and full_configuration:
    if robot.client.is_connected:
        frame_WCF = robot.forward_kinematics(full_configuration, group, options={'backend':'model'})
        #frame_WCF = robot.forward_kinematics(full_configuration, group, backend='model')
        print(frame_WCF)
    else:
        print("Robot is not connected")
# ---------- end forward ----------
panel_23 = Panel(forward.out)

# ---- group: plan motion
# Plan motion
# If you specify the tolerance vector with [360, 1, 1], it means that
#     the frame's y-axis and z-axis are allowed to rotate about the x-axis by an
#     angle of 360 degrees, whereas the x-axis can only change 1 degree.
number_slider_3 = Slider(1, range=1..360)
group = Data(main_planning_group)
list_14 = ValueList({"don't use attached collision mesh": 0, "use attached collision mesh": 1}, selected="use attached collision mesh")
list_15 = ValueList({"0", "1"}, selected="0")
py_12 = PythonScript(robot=robot)  # -> configuration
# ---------- py_12: Python ----------
from compas_fab.robots import Configuration

if robot:
    types = robot.get_configurable_joint_types()
    values = [0] * len(types)

    configuration = Configuration(values, types)
    print configuration
# ---------- end py_12 ----------
start_configuration_2 = Data(inverse.configuration)
python_5 = PythonScript(
    robot=robot,
    group=group,
    goal_plane=end_plane,
    tolerance_position=Slider(0.001, range=0..0.001),
    tolerance_xaxis_deg=Slider(1, range=1..360),
    tolerance_yaxis_deg=number_slider_3,
    tolerance_zaxis_deg=Slider(1, range=1..360))  # -> goal_constraints
# ---------- python_5: Python ----------
import math
from compas.geometry import Frame

frame_WCF = Frame(goal_plane.Origin, goal_plane.XAxis, goal_plane.YAxis)
frame_OCF = robot.to_local_coordinates_origin(frame_WCF)
if robot.attached_tool:
    frame_OCF = robot.from_tcf_to_t0cf([frame_OCF])[0]

tolerances_axes = [math.radians(tolerance_xaxis_deg), math.radians(tolerance_yaxis_deg), math.radians(tolerance_zaxis_deg)]

if robot:
    goal_constraints = robot.constraints_from_frame(frame_OCF, tolerance_position, tolerances_axes, group)
# ---------- end python_5 ----------
list_16 = ValueList({"RRT", "RRT*": "RRTStar", "EST", "PRM": "RPM", "PRM*": "RPMStar", "SPARS"}, selected="RRT")
filter_6 = StreamFilter(Gate=list_15, Stream0=start_configuration_2, Stream1=py_12)
filter_7 = StreamFilter(Gate=list_14, Stream1=attached.acm)
panel_24 = Panel("positions")
panel_25 = Panel("velocities")
panel_26 = Panel("accelerations")
start = Button()
reset = Button()
step = Button()

# ----
plan_motion = PythonScript(
    robot=robot,
    group=group,
    start_configuration=filter_6,
    goal_constraints=python_5,
    planner_id=list_16,
    attached_collision_meshes=filter_7,
    compute=compute)  # -> out, trajectory; inputs goal_constraints: list, attached_collision_meshes: list
# ---------- plan_motion: Python ----------
"""Calculates a motion path.
    Inputs:
        robot: The robot
        group: str, optional
            The planning group used for calculation. Defaults to the robot's
            main planning group.
        start_configuration: :class:`compas_fab.robots.Configuration`, optional
            The robot's full configuration, i.e. values for all configurable
            joints of the entire robot cell, at the starting position. Defaults
            to the all-zero configuration.
        goal_constraints: list of :class:`compas_fab.robots.Constraint`
            The goal to be achieved, defined in a set of constraints.
            Constraints can be very specific, for example defining value domains
            for each joint, such that the goal configuration is included,
            or defining a volume in space, to which a specific robot link (e.g.
            the end-effector) is required to move to.
        planner_id: str
            The name of the algorithm used for path planning. Defaults to 'RRT'.
        attached_collision_meshes: list of :class:`compas_fab.robots.AttachedCollisionMesh`
            Defaults to None.
        compute: bool
            Press to calculate solution.
    Output:
        :class:`compas_fab.robots.JointTrajectory`
            The calculated trajectory.
"""
from __future__ import print_function
import logging
import scriptcontext as sc

guid = str(ghenv.Component.InstanceGuid)
response_key = "response_" + guid
if response_key not in sc.sticky:
    sc.sticky[response_key] = None

LOGGER = logging.getLogger('roslibpy')

if robot and robot.client and start_configuration and compute:
    if robot.client.is_connected:
        
        sc.sticky[response_key] = robot.plan_motion(goal_constraints,
                                                    start_configuration,
                                                    group,
                                                    options={
                                                        'planner_id': str(planner_id),
                                                        'attached_collision_meshes': list(attached_collision_meshes),
                                                    })
    else:
        print("Robot client is not connected.")

trajectory = sc.sticky[response_key]
# ---------- end plan_motion ----------
panel_27 = Panel(plan_motion.out)

# ----
# Generate and send 'pick and place' urscript
radius_2 = Slider(0.01, range=0..0.1)
list_17 = ValueList({"pick_place_hold": 0, "release_and_move_home": 1, "test": 2}, selected="pick_place_hold")
send_9 = Button()

# ---- group: plan motion (continued)
vis = PythonScript(response=plan_motion.trajectory)  # -> P, V, A, time
# ---------- vis: Python ----------
from compas_ghpython import list_to_ghtree

if response:

    positions = []
    velocities = []
    accelerations = []
    time_from_start = []

    for p in response.points:
        positions.append(p.positions)
        velocities.append(p.velocities)
        accelerations.append(p.accelerations)
        time_from_start.append(p.time_from_start.seconds)

    P = list_to_ghtree(list(zip(*positions)))
    V = list_to_ghtree(list(zip(*velocities)))
    A = list_to_ghtree(list(zip(*accelerations)))

    time = time_from_start[-1]
    print time
# ---------- end vis ----------
time_s = Panel(vis.time)
prismatic = QuickGraph(vis.P, SortOrder=0)
graph = QuickGraph(vis.V, SortOrder=0)
graph_2 = QuickGraph(vis.A, SortOrder=0)

# ----
list_18 = ValueList({"0 forward_kinematics": 0, "1 inverse_kinematics": 1, "2 cartesian motion": 2, "3 free-space motion": 3}, selected="0 forward_kinematics")

list_19 = ValueList({"0 forward_kinematics": 0, "1 inverse_kinematics": 1, "2 cartesian motion": 2, "3 free-space motion": 3}, selected="0 forward_kinematics")

# ----
# Visualisation Robot  2
# Select configuration input: from fk, ik, path, or from real robot
show_end_effector_frame = BooleanToggle(False)
show_picking_frame = BooleanToggle(True)
show_origin_frame = BooleanToggle(True)
show_base_frame = BooleanToggle(False)
show_collision = BooleanToggle(False)
show_in_world = BooleanToggle(True)
show_frames = BooleanToggle(False)
show_visual = BooleanToggle(True)
show_bcm = BooleanToggle(True)
show_acm = BooleanToggle(True)
show_cm = BooleanToggle(True)

# ----
# Visualisation Robot 1
# Select configuration input: from fk, ik, path, or from real robot
show_end_effector_frame_2 = BooleanToggle(False)
show_picking_frame_2 = BooleanToggle(True)
show_origin_frame_2 = BooleanToggle(True)
show_base_frame_2 = BooleanToggle(False)
show_collision_2 = BooleanToggle(False)
show_in_world_2 = BooleanToggle(True)
show_frames_2 = BooleanToggle(False)
show_visual_2 = BooleanToggle(True)
show_bcm_2 = BooleanToggle(True)
show_acm_2 = BooleanToggle(True)
show_cm_2 = BooleanToggle(True)

# ---- group: plan motion (continued)
py_13 = PythonScript(robot=robot, group=group, trajectory=plan_motion.trajectory, in_world=show_in_world_2)  # -> start_configuration, configurations, full_configurations, frames, planes
# ---------- py_13: Python ----------
from compas.geometry import Transformation
from compas.geometry import Frame
from compas_ghpython import draw_frame
from compas_rhino.conversions import xform_to_rhino

import ghpythonlib.components as ghcomp

joint_positions = []

if in_world:
    T = robot.transformation_OCF_WCF()
else:
    T = Transformation()


if trajectory:
    configurations = trajectory.points
    start_configuration = trajectory.start_configuration
    fraction = trajectory.fraction
    time = trajectory.time_from_start
    full_configurations = [robot.merge_group_with_full_configuration(c, trajectory.start_configuration, group) for c in configurations]
    frames = [robot.forward_kinematics(c, group, options=dict(solver='model')) for c in full_configurations]
    if robot.attached_tool:
        frames = [robot.from_t0cf_to_tcf([frame])[0] for frame in frames]
        
    planes = [draw_frame(frame) for frame in frames]
    planes = ghcomp.Transform(planes, xform_to_rhino(T))
# ---------- end py_13 ----------
pline = PolyLine(Vertices=py_13.planes, Closed=False)
preview_4 = CustomPreview(Geometry=pline, Material=ColourSwatch(SwatchColor=RGB(139, 59, 161)))
counter = CountThroughList(L=py_13.full_configurations, start=start, step=step, reset=reset)  # -> item; inputs L: list, start: Boolean
# ---------- counter: Python ----------
from scriptcontext import sticky as st
from compas_ghpython.utilities import update_component


interval = 1

# store data in component
guid = str(ghenv.Component.InstanceGuid)
counter_key = "counter_" + guid
running_key = "running_" + guid

if counter_key not in st:
    st[counter_key] = 0

if running_key not in st:
    st[running_key] = False

if start:
    st[running_key] = True

if step:
    if st[counter_key] < len(L) - 1:
        st[counter_key] += 1
    
if len(L):
    item = L[st[counter_key]]

if st[running_key]:
    if st[counter_key] < len(L) - 1:
        st[counter_key] += 1
        update_component(ghenv, interval)
    else:
        st[counter_key] = 0
        st[running_key] = False
# ---------- end counter ----------

# ----
joint_configurations = Data(py_13.full_configurations)
rsrd_ur_script = PythonScript(
    robot=robot,
    picking_plane_WCF=python_4.picking_plane_WCF,
    picking_plane_safe_WCF=python_4.picking_plane_WCF,
    joint_configuration=joint_configuration,
    joint_configurations=joint_configurations,
    placing_plane_safe_WCF=python_4.placing_plane_safe_WCF,
    placing_plane_WCF=python_4.placing_plane_WCF,
    routine=list_17,
    velocity=Slider(1, range=0..200),
    radius=radius_2,
    in_world=show_in_world_2)  # -> out, urscript; inputs joint_configurations: list, routine: Int32
# ---------- rsrd_ur_script: Python ----------
from ur_fabrication_control.direct_control import URScript
from ur_fabrication_control.direct_control.mixins import ParallelGripMixins

import math
from scriptcontext import sticky as st
import Rhino.Geometry as rg

from compas.geometry import Frame, Transformation

class URScript_RSRD(URScript, ParallelGripMixins):
    pass

#robot = st["robot_6e25a56a-ecab-4ebc-a3bd-f9966f8a8dbc"]

tool_angle_axis = list(robot.attached_tool.frame.point) + list(robot.attached_tool.frame.axis_angle_vector)
sleep = 1.0

def plane_to_frame(plane_WCS):
    frame_WCS = Frame(plane_WCS.Origin, plane_WCS.XAxis, plane_WCS.YAxis)
    if in_world:
        T = robot.transformation_WCF_OCF()
    else:
        T = Transformation()
    frame_WCS.transform(T)
    return frame_WCS

joint_config_place = joint_configurations[:-1]
print joint_configurations
print joint_config_place
joint_config_place += joint_configurations[-1:]
##joint_config_start = "movej({}, v={}, r={})".format(joint_positions.values, velocity/10, 0.0)
joint_config_reversed = list(reversed(joint_configurations))[:-1]
joint_config_reversed += list(reversed(joint_configurations))[-1:]


#commands
picking_frame = plane_to_frame(picking_plane_WCF) 
picking_frame_safe = plane_to_frame(picking_plane_safe_WCF)
placing_frame = plane_to_frame(placing_plane_WCF)
placing_frame_safe = plane_to_frame(placing_plane_safe_WCF)

# pick, place and hold routine
if routine == 0:
    commands = URScript_RSRD()
    commands.start()
    commands.set_tcp(tool_angle_axis)
    commands.move_linear(picking_frame_safe)
    commands.parallelgrip_open()    
    commands.add_line("\tsleep({})".format(sleep))                   
    commands.move_linear(picking_frame) 
    commands.parallelgrip_close() 
    commands.add_line("\tsleep({})".format(sleep))
    commands.move_linear(picking_frame_safe)                         
    commands.moves_joint(joint_configurations, velocity)                                  
    commands.move_joint(joint_configuration, velocity)                                
    commands.end()      

# release and move to home
if routine == 1:
    commands = URScript_RSRD()
    commands.start()
    commands.set_tcp(tool_angle_axis)
    commands.parallelgrip_open()  
    commands.add_line("\tsleep({})".format(sleep))
    commands.move_linear(placing_frame_safe)
    commands.parallelgrip_close() 
    commands.moves_joint(list(reversed(joint_configurations)), velocity)  
    commands.move_linear(picking_frame)
    commands.end()

# test routine
if routine == 2:
    commands = URScript_RSRD()
    commands.start()
    commands.set_tcp(tool_angle_axis)
    #commands.move_linear(pick_up_safe_frame)                        
    ##commands.move_linear(pick_up_gripper_open_frame)
    #commands.add_line("\tsleep({})".format(sleep))
    #commands.parallelgrip_open()    
    commands.move_linear(picking_frame) 
    commands.parallelgrip_open() 
    commands.add_line("\tsleep({})".format(sleep))
    commands.move_linear(picking_frame_safe)                         
    #commands.moves_joint(joint_configurations, velocity)               
    #commands.move_linear(place_frame)                                
    commands.end()      

urscript = commands.generate()
print(urscript)
# ---------- end rsrd_ur_script ----------
send_10 = GhPythonScript(urscript=rsrd_ur_script.urscript, send=send_9)  # -> out; inputs send: Boolean; same code as send_2
panel_28 = Panel(rsrd_ur_script.out)

filter_8 = StreamFilter(Gate=list_18, Stream0=forward_kinematics, Stream1=inverse.configuration, Stream3=counter)

filter_9 = StreamFilter(Gate=list_19, Stream0=forward_kinematics, Stream1=inverse.configuration, Stream3=counter)

visualize = PythonScript(
    robot=robot,
    group=main_planning_group,
    scene=scene,
    configuration=filter_8,
    redraw=[py_5, py_6.a, collision_2.a, collision.a],
    show_visual=show_visual,
    show_collision=show_collision,
    show_end_effector_frame=show_end_effector_frame,
    show_robot_frames=show_frames,
    show_base_frame=show_base_frame,
    show_origin_frame=show_origin_frame,
    show_picking_frame=show_picking_frame,
    show_cm=show_cm,
    show_bcm=show_bcm,
    show_acm=show_acm,
    in_world=show_in_world)  # -> out, robot, visual, collision_meshes_robot, collision_mesh_base, collision_meshes_obstacles, collision_meshes_attached, frames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; inputs redraw: list, attached_collision_meshes: list
# ---------- visualize: Python ----------
from compas.geometry import Vector
from compas.geometry import Point
from compas.geometry import Transformation
from compas.geometry import Frame
from compas_ghpython.artists import MeshArtist
from compas_fab.robots import Configuration

import ghpythonlib.components as ghcomp
from compas_rhino.conversions import xform_to_rhino


if robot and configuration:
    
    robot.update(configuration, visual=show_visual, collision=show_collision)
    if in_world:
        T = robot.transformation_OCF_WCF()
    else:
        T = Transformation()

    if show_visual:
        visual = robot.artist.draw_visual()
        visual += robot.base_geometry
        visual = ghcomp.Transform(visual, xform_to_rhino(T))

    if show_collision:
        collision_meshes_robot = robot.artist.draw_collision()
        collision_meshes_robot = ghcomp.Transform(collision_meshes_robot, xform_to_rhino(T))
    
    if show_end_effector_frame:
        ee_frame = robot.get_end_effector_frame(group=group, full_configuration=configuration)
        if robot.attached_tool:
            ee_frame = robot.from_t0cf_to_tcf([ee_frame])[0]
        ee_frame = ee_frame.transformed(T)
    
    if show_robot_frames:
        frames = robot.transformed_frames(configuration)
        [f.transform(T) for f in frames]

    if show_base_frame:
        base_frame = robot.get_base_frame(group, configuration)
        base_frame = base_frame.transformed(T)
    
    if show_origin_frame:
        origin_frame = robot.get_origin_frame()

    if show_picking_frame:
        picking_frame = robot.get_picking_frame()
        #picking_frame = picking_frame.transformed(T)
    
    if show_cm:
        M = []
        for cm in scene.cm:
            mesh = cm.mesh
            M.append(MeshArtist(mesh).draw())
        collision_meshes_obstacles = M
        collision_meshes_obstacles = ghcomp.Transform(collision_meshes_obstacles, xform_to_rhino(T))
    
    if show_bcm:
        if scene.bcm:
            collision_mesh_base = MeshArtist(scene.bcm.mesh).draw()
            collision_mesh_base = ghcomp.Transform(collision_mesh_base, xform_to_rhino(T))
    
    if show_acm:
        M = []
        for acm in scene.acm:
            ee_frame = robot.get_end_effector_frame(group=group, full_configuration=configuration)
            if robot.attached_tool:
                ee_frame = robot.from_t0cf_to_tcf([ee_frame])[0]
            T_ee = Transformation.from_frame_to_frame(Frame.worldXY(), ee_frame)
            mesh = acm.collision_mesh.mesh.transformed(T_ee)
            M.append(MeshArtist(mesh).draw())
            
        collision_meshes_attached = M
        collision_meshes_attached = ghcomp.Transform(collision_meshes_attached, xform_to_rhino(T))
# ---------- end visualize ----------
draw_2 = GhPythonScript(
    frames=[visualize.frames, visualize.ee_frame, visualize.base_frame, visualize.origin_frame, visualize.picking_frame],
    scale=Slider(0.2, range=0..1))  # -> P, V, C, W; inputs frames: list
# ---------- draw_2: Python ----------
from System.Drawing import Color
from compas_ghpython.utilities import draw_frame

red = Color.FromArgb(255, 0, 0)
green = Color.FromArgb(0, 255, 0)
blue = Color.FromArgb(0, 0, 255)

P = []
V = []
C = []

scale = float(scale)

for frame in frames:
    if not frame:
        continue
    plane = draw_frame(frame)
    P += [plane.Origin] * 3
    V.append(plane.XAxis * scale)
    V.append(plane.YAxis * scale)
    V.append(plane.ZAxis * scale)
    C += [red, green, blue]

W = 3
# ---------- end draw_2 ----------
geo = Geometry(visualize.collision_meshes_robot)
geo_2 = Geometry(visualize.collision_meshes_attached)
geo_3 = Geometry(visualize.collision_mesh_base)
geo_4 = Geometry(visualize.collision_meshes_obstacles)
geo_5 = Geometry(visualize.visual)
preview_5 = CustomPreview(Geometry=geo_5, Shader=ColourSwatch(SwatchColor=RGB(105, 105, 105)))
preview_6 = CustomPreview(Geometry=[geo, geo_4, geo_2, geo_3], Shader=ColourSwatch(SwatchColor=RGB(108, 79, 255)))
vdisex = VectorDisplayEx(Point=draw_2.P, Vector=draw_2.V, Colour=draw_2.C, Width=draw_2.W)

visualize_2 = PythonScript(
    robot=robot,
    group=main_planning_group,
    scene=scene,
    configuration=filter_9,
    redraw=[py_5, py_6.a, collision_2.a, collision.a],
    show_visual=show_visual_2,
    show_collision=show_collision_2,
    show_end_effector_frame=show_end_effector_frame_2,
    show_robot_frames=show_frames_2,
    show_base_frame=show_base_frame_2,
    show_origin_frame=show_origin_frame_2,
    show_picking_frame=show_picking_frame_2,
    show_cm=show_cm_2,
    show_bcm=show_bcm_2,
    show_acm=show_acm_2,
    in_world=show_in_world_2)  # -> out, robot, visual, collision_meshes_robot, collision_mesh_base, collision_meshes_obstacles, collision_meshes_attached, frames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; inputs redraw: list, attached_collision_meshes: list; same code as visualize
draw_3 = GhPythonScript(
    frames=[visualize_2.frames, visualize_2.ee_frame, visualize_2.base_frame, visualize_2.origin_frame, visualize_2.picking_frame],
    scale=Slider(0.2, range=0..1))  # -> P, V, C, W; inputs frames: list; same code as draw_2
geo_6 = Geometry(visualize_2.collision_meshes_robot)
geo_7 = Geometry(visualize_2.collision_meshes_attached)
geo_8 = Geometry(visualize_2.collision_mesh_base)
geo_9 = Geometry(visualize_2.collision_meshes_obstacles)
geo_10 = Geometry(visualize_2.visual)
preview_7 = CustomPreview(Geometry=geo_10, Shader=ColourSwatch(SwatchColor=RGB(105, 105, 105)))
preview_8 = CustomPreview(Geometry=[geo_6, geo_9, geo_7, geo_8], Shader=ColourSwatch(SwatchColor=RGB(108, 79, 255)))
vdisex_2 = VectorDisplayEx(Point=draw_3.P, Vector=draw_3.V, Colour=draw_3.C, Width=draw_3.W)
