# Grasshopper definition robot_see_robot_do.ghx (Grasshopper 1.0.7)
# plug-ins: Weaverbird

panel = Panel("Unload libraries")
# 1.
# Load initial assembly
bang = Button()
unload = PythonScript(bang=bang)
# ---------- unload: Python ----------
from compas_rhino.utilities.misc import get_tolerance
from compas_rhino.utilities.misc import unload_modules

unload_modules("compas")
unload_modules("compas_fab")
unload_modules("ur_fabrication_control")
unload_modules("robot_see_robot_do")
# ---------- end unload ----------

import = Button(ExpressionNormal="True", ExpressionPressed="False")
# Import initial assembly (first module)
py = PythonScript(import_from_json=import)  # -> HERE, DATA, import_from_json
# ---------- py: Python ----------
import os
from scriptcontext import sticky as st

HERE = os.path.dirname(ghdoc.Path)
DATA = os.path.abspath(os.path.join(HERE, "..", "data"))
print(HERE)
print(DATA)

st.clear()
st['DATA_PATH'] = DATA
# ---------- end py ----------
initial_assembly = GhPythonScript(DATA=py.DATA, import_from_json=py.import_from_json)  # -> out, assembly; inputs import_from_json: Boolean
# ---------- initial_assembly: Python ----------
import os
import json
from scriptcontext import sticky

from robot_see_robot_do.assembly import Assembly
from robot_see_robot_do.assembly import Element

#assembly = Assembly()

if import_from_json:
    #filename = "hrca/hrcassembly_initial_origin.json"
    #filename = "hrca_aggregation_3.json"
    filename = "json/hrca_current_assembly_2020_09_22_19_32_25.json"
    PATH = os.path.join(DATA, filename)
    assembly = Assembly.from_json(PATH)


#assembly.network.delete_node(6)

if assembly:
    counter = 1
    for key, elem, data in assembly.elements(data=True):
        data['frame_id'] = counter
        counter +=1
    
    sticky['assembly'] = assembly
# ---------- end initial_assembly ----------

# ----
# Elements
# Create an instance of the Element class by inputing a box geometry
rf_unit_radius = Slider(0.06, range=0..0.1)
# 2.
number_slider = Slider(0.0125, range=0..0.1)
show = BooleanToggle(True)
elem_def = GhPythonScript(
    radius=number_slider,
    length=Slider(0.6, range=0..1),
    rf_unit_offset=Slider(0.2, range=0..1),
    rf_unit_radius=rf_unit_radius)  # -> out, elem_x, elem_y, elem_z
# ---------- elem_def: Python ----------
import os
import sys
import json
import math

from compas.geometry import Frame, Plane, Rotation, Translation, Vector
from compas.geometry import Box, Circle, Cylinder
from compas.datastructures import Mesh
from robot_see_robot_do.assembly import Element



def create_rod(frame, ref_name):
    cross_section_plane = Plane.from_frame(Frame(frame.point, frame.yaxis, frame.zaxis))
    cross_section = Circle(cross_section_plane, radius)
    elem_geo = Cylinder(cross_section, length)
    
    T_tool = Translation.from_vector([0,0,radius])
    T_conn_1 = Translation.from_vector(frame.xaxis*(rf_unit_offset+rf_unit_radius)+frame.zaxis*radius)
    T_conn_2 = Translation.from_vector(frame.xaxis*-(rf_unit_offset+rf_unit_radius)+frame.zaxis*-radius)
    
    elem_tool_frame = frame.transformed(T_tool)
    elem_conn_frame_1 = frame.transformed(T_conn_1)
    elem_conn_frame_2 = frame.transformed(T_conn_2)
    
    R_conn_frame_1 = Rotation.from_axis_and_angle(elem_conn_frame_1.zaxis, math.radians(120), elem_conn_frame_1.point)
    R_conn_frame_2 = Rotation.from_axis_and_angle(elem_conn_frame_2.zaxis, math.radians(240), elem_conn_frame_2.point)
    
    elem_conn_frame_1.transform(R_conn_frame_1)
    elem_conn_frame_2.transform(R_conn_frame_2)
    
    elem = Element.from_shape(elem_geo, frame)
    
    elem.tool_frame = elem_tool_frame
    elem.connector_frame_1 = elem_conn_frame_1
    elem.connector_frame_2 = elem_conn_frame_2
    elem._type = ref_name
    elem._base_frame = Frame([0, 0, 0], [1, 0, 0], [0, 1, 0])
    
    R = Rotation.from_axis_and_angle(frame.yaxis, math.radians(15), frame.point)
    elem.transform(R)
    return elem


R1 = Rotation.from_axis_and_angle(Vector.Zaxis(), math.radians(120), [0,0,0])
R2 = Rotation.from_axis_and_angle(Vector.Zaxis(), math.radians(240), [0,0,0])

f1 = Frame([-rf_unit_offset, rf_unit_radius/2., 0], [1, 0, 0], [0, -1, 0]) #center of the box frame 
f2 = f1.transformed(R1)
f3 = f1.transformed(R2)

elem_x = create_rod(f1, 'X')
elem_y = create_rod(f2, 'Z')
elem_z = create_rod(f3, 'Y')



"""
################### element X ################### 
elem_x_frame = Frame([-rf_unit__offset, rf_unit_radius/2., 0], [1, 0, 0], [0, -1, 0]) #center of the box frame 

R_x = Rotation.from_axis_and_angle(elem_x_frame.yaxis, math.radians(8), elem_x_frame.point)

plane = Plane.from_frame(Frame(elem_x_frame.point, elem_x_frame.yaxis, elem_x_frame.zaxis))
circle = Circle(plane, radius)
elem_x_geo = Cylinder(circle, height)

T_tool = Translation.from_vector(elem_x_frame.xaxis*0)
#T_conn_1 = Translation.from_vector(elem_x_frame.xaxis*-height/2.)
T_conn_1 = Translation.from_vector(Vector(0, 0., 0))
#Translation.from_vector(Vector(pt.x*-height/2.,pt.y, pt.z*-radius/2.))
#T_conn_2 = Translation.from_vector(elem_x_frame.xaxis*height/2.)
T_conn_2 = Translation.from_vector(Vector(0.2, 0., 0))

elem_x_tool_frame =  elem_x_frame.transformed(T_tool)
elem_x_conn_frame_1 = elem_x_frame.transformed(T_conn_1)
elem_x_conn_frame_2 = elem_x_frame.transformed(T_conn_2)

elem_x = Element.from_shape(elem_x_geo, elem_x_frame)

#assign attributes
elem_x.tool_frame = elem_x_tool_frame
elem_x.connector_frame_1 = elem_x_conn_frame_1
elem_x.connector_frame_2 = elem_x_conn_frame_2
elem_x._type = 'X'
elem_x._base_frame = Frame([0, 0, 0], [1, 0, 0], [0, 1, 0])

elem_x.transform(R_x)

R1 = Rotation.from_axis_and_angle(center_frame.zaxis, math.radians(120), center_frame.point)
R2 = Rotation.from_axis_and_angle(center_frame.zaxis, math.radians(240), center_frame.point)

################### element Y ################### 
elem_y_frame = elem_x_frame.transformed(R1) #center of the box frame 

plane = Plane.from_frame(Frame(elem_y_frame.point, elem_y_frame.yaxis, elem_y_frame.zaxis))
plane.transform(R1)
circle = Circle(plane, radius)
elem_y_geo = Cylinder(circle, height)

elem_y_tool_frame =  elem_x_tool_frame.transformed(R1)
elem_y_conn_frame_1 = elem_x_conn_frame_1.transformed(R1)
elem_y_conn_frame_2 = elem_x_conn_frame_2.transformed(R1)

elem_y = Element.from_shape(elem_y_geo, elem_y_frame)

#assign attributes
elem_y.tool_frame = elem_y_tool_frame
elem_y.connector_frame_1 = elem_y_conn_frame_1
elem_y.connector_frame_2 = elem_y_conn_frame_2
elem_y._type = 'Y'
elem_y._base_frame = Frame([0, 0, 0], [1, 0, 0], [0, 1, 0])

elem_x.transform(R_x)

################### element Z ################### 
elem_z_frame = elem_x_frame.transformed(R2)

plane = Plane.from_frame(Frame(elem_z_frame.point, elem_z_frame.yaxis, elem_z_frame.zaxis))
plane.transform(R2)
circle = Circle(plane, radius)
elem_z_geo = Cylinder(circle, height)

elem_z_tool_frame =  elem_x_tool_frame.transformed(R2)
elem_z_conn_frame_1 = elem_x_conn_frame_1.transformed(R2)
elem_z_conn_frame_2 = elem_x_conn_frame_2.transformed(R2)

elem_z = Element.from_shape(elem_z_geo, elem_z_frame)

# assign attributes
elem_z.tool_frame = elem_z_tool_frame
elem_z.connector_frame_1 = elem_z_conn_frame_1
elem_z.connector_frame_2 = elem_z_conn_frame_2
elem_z._type = 'Z'
elem_z._base_frame = Frame([0, 0, 0], [1, 0, 0], [0, 1, 0])
"""
# ---------- end elem_def ----------
draw = PythonScript(elements=[elem_def.elem_x, elem_def.elem_y, elem_def.elem_z], show=show)  # -> M, F, C, T; inputs elements: list
# ---------- draw: Python ----------
from compas.geometry import Transformation
from compas.geometry import Frame
from compas.datastructures import mesh_transformed
from compas_ghpython.artists import MeshArtist

from compas_ghpython import draw_frame

M = []
C = []
F = []
T = []
connectors = []




if show:
    for elem in elements:
        connectors.append(elem.connector_frame_1)
        connectors.append(elem.connector_frame_2)
        artist = MeshArtist(elem.mesh)
        M += [artist.draw_mesh()]
        C += [draw_frame(frame) for frame in connectors]
        F += [draw_frame(elem.frame)]
        T += [draw_frame(elem.tool_frame)]
# ---------- end draw ----------
mesh = Mesh(draw.M)
pln = Plane(draw.F)
pln_2 = Plane(draw.C)
pln_3 = Plane(draw.T)

x_axis = Curve(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)
y_axis = Curve(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)
plane = PythonScript(plane_axes=[x_axis, y_axis])  # -> plane; inputs plane_axes: list of Curve
# ---------- plane: Python ----------
import Rhino.Geometry as rg

x_axis, y_axis = plane_axes

x_axis = rg.Line(x_axis.PointAtStart, x_axis.PointAtEnd)
y_axis = rg.Line(y_axis.PointAtStart, y_axis.PointAtEnd)

if x_axis.From.DistanceTo(y_axis.From) < 0.01:
    origin = x_axis.From
    xvec = x_axis.Direction
    yvec = y_axis.Direction
elif x_axis.To.DistanceTo(y_axis.To) < 0.01:
    origin = x_axis.To
    xvec = -x_axis.Direction
    yvec = -y_axis.Direction
elif x_axis.From.DistanceTo(y_axis.To) < 0.01:
    origin = x_axis.From
    xvec = x_axis.Direction
    yvec = -y_axis.Direction
elif x_axis.To.DistanceTo(y_axis.From) < 0.01:
    origin = x_axis.To
    xvec = -x_axis.Direction
    yvec = y_axis.Direction

plane = rg.Plane(origin, xvec, yvec)
# ---------- end plane ----------

number_slider_2 = Slider(0, range=0..360)

# ----
# 3.
# Assembly
toggle = BooleanToggle(False)
cp = Plane(PlaneXY(0, 0, 0))
ct = Plane(PlaneXY(0, 0, -0.0245))
initial_configuration = GhPythonScript(centerplane=cp, transform=toggle, ptransf=ct, elem_x=elem_def.elem_x, elem_y=elem_def.elem_y, elem_z=elem_def.elem_z)  # -> out, assembly, connector_planes, pr, vr, test; inputs transform: Boolean
# ---------- initial_configuration: Python ----------
import Rhino.Geometry as rg
import math
from scriptcontext import sticky as st

from compas.geometry import Frame
from compas.geometry import Transformation
from compas.geometry import Rotation, Vector
from compas.geometry import Translation
from compas.geometry import Point

from compas_ghpython import draw_frame
from compas_ghpython.artists import MeshArtist
from robot_see_robot_do.assembly import Assembly


# initialize an empty assembly class
assembly = Assembly()

# just for vizualisation
connector_planes = []

cp = centerplane

cf = Frame(cp.Origin, cp.XAxis, cp.YAxis)

my_elem_x = elem_x.copy()
my_elem_y = elem_y.copy()
my_elem_z = elem_z.copy()

my_elem_x.connector_1_state = False
my_elem_y.connector_1_state = False
my_elem_z.connector_1_state = False

my_elem_x.transform(Transformation.from_frame(cf))
my_elem_y.transform(Transformation.from_frame(cf))
my_elem_z.transform(Transformation.from_frame(cf))

assembly.add_element(my_elem_x, elem_type = 'X', placed_by = 'human', frame_id=None)
assembly.add_element(my_elem_y, elem_type = 'Y', placed_by = 'human', frame_id=None)
assembly.add_element(my_elem_z, elem_type = 'Z', placed_by = 'human', frame_id=None)

assembly.network.add_edge(0, 1, edge_of = 'parent')
assembly.network.add_edge(0, 2, edge_of = 'parent')
assembly.network.add_edge(1, 2, edge_of = 'parent')


if transform:
    T = Transformation.from_frame_to_frame(cf, Frame(ptransf.Origin, ptransf.XAxis, ptransf.YAxis))
    assembly.transform(T)


options = assembly.element(1).options_vectors(0.4)


vr=[]
pr=[]

print options
for o, v in options:
    start = assembly.element(0).frame.point
    vr.append(rg.Vector3d(*tuple(v)))
    pr.append(rg.Point3d(o.x, o.y, o.z))

#print assembly.options_vectors()

elems = assembly.element(0).options_elements(elem_x, elem_y, elem_z)
test = []
print(elems)
print assembly.connectors(state='open')

for element in elems:
    artist = MeshArtist(element.mesh)
    mesh = artist.draw_mesh()
    test.append(mesh)
# ---------- end initial_configuration ----------
panel_2 = Panel("Initial assembly")
move = Slider(0, range=0..0.3)
t = Slider(85, range=0..180)
direction = Button()
_1_x_human = Button()
aggregate = Button()
element = Button()
element_2 = Button()
_2_x_robot = Button()
reset = Button()
add = Button()
mesh_2 = Mesh(initial_configuration.test)
vdis = VectorDisplay(Anchor=initial_configuration.pr, Vector=initial_configuration.vr)
pln_4 = Plane(initial_configuration.connector_planes)
pts = Point([Point(-1.291415192, 0.8486937884, 1.820186629), Point(1.363271809, 0.9810094658, 0.1857535972)])
generate_assembly = GhPythonScript(
    assembly=initial_configuration.assembly,
    elem_x=elem_def.elem_x,
    elem_y=elem_def.elem_y,
    elem_z=elem_def.elem_z,
    base_plane=plane,
    angle_threshold=t,
    targets=pts,
    elem_up=element,
    elem_down=element_2,
    reset=reset,
    set_direction=direction,
    shift_value=move,
    rotate=number_slider_2,
    add_module=add,
    human_adds=_1_x_human,
    robot_adds=_2_x_robot,
    aggregate=aggregate)  # -> out, assembly, current_key, direction, connector_key, coll_mesh, tool_planes, base_planes; inputs base_plane: Plane, targets: list of Point3d
# ---------- generate_assembly: Python ----------
import Rhino.Geometry as rg
import rhinoscriptsyntax as rs
import math
import random
from scriptcontext import sticky as st
import sys

import ghpythonlib.components as ghcomp

from compas.geometry import Frame, Box, Point
from compas.geometry import Vector, Translation, angle_vectors
from compas.datastructures import mesh_offset
from compas_ghpython import draw_frame
from compas_ghpython.artists import MeshArtist


from compas.rpc import Proxy

tool_planes = []                     # Tool planes
base_planes = [] 
filtered_keys = []
options = []

#bp = base_plane
#base_frame = Frame(bp.Origin, bp.XAxis, bp.YAxis)

L = list(assembly.elements())

def range_filter(options, base_plane):
    ur_range_max = 1.2
    ur_range_min = 0.75
        
    base_point= Point(base_plane.Origin.X, base_plane.Origin.Y, base_plane.Origin.Z)
    filtered_options = []
    for key, elem_origin, option_vector in options:
        v = Vector.from_start_end(elem_origin, base_point)
        dist = v.length
        if ur_range_min <= dist <= ur_range_max:
            filtered_options.append((key, elem_origin, option_vector))
    return filtered_options

def filter_options(all_options, target_points):
    tps = [Point(p.X, p.Y, p.Z) for p in target_points]
    filtered_options = []
    for tp in tps:
        for key, elem_origin, option_vector in all_options:
            v = Vector.from_start_end(elem_origin, tp)
            angle = angle_vectors(option_vector, v, deg=True)
            if angle < angle_threshold:
                filtered_options.append((key, elem_origin, option_vector))
    return filtered_options

all_options = []

for key, element in assembly.elements():
    for origin, vector in element.options_vectors(0.1):
        all_options.append((key, origin, vector))

assembly.all_options = all_options

filtered_options = filter_options(all_options, targets)
filtered_keys_ = []
for option in filtered_options:
    filtered_keys_.append(option[0])
    
filtered_keys = list(set(filtered_keys_))
print filtered_keys

assembly.current_options = filtered_options

# store data in component
guid = str(ghenv.Component.InstanceGuid)
element_key = "elem_" + guid
connector_key = "connector_" + guid

if element_key not in st:
    st[element_key] = 0

if connector_key not in st:
    st[connector_key] = 0

if reset:
    st[element_key] = 0

if elem_up:
    if st[element_key] < len(filtered_keys) - 1:
        st[element_key] += 1
        st[connector_key] = 0

if elem_down:
    if st[element_key] <= len(filtered_keys) - 1:
        st[element_key] -= 1
        st[connector_key] = 0
    if st[element_key] < 1:
        st[element_key] = 0
        st[connector_key] = 0

if set_direction:
    if st[connector_key] == len(elem_connectors)-1:
        st[connector_key] = 0
    elif st[connector_key] < len(elem_connectors)-1:
        st[connector_key] = 1
    elif st[connector_key] > len(elem_connectors)-1:
        st[connector_key] = 0

current_key = filtered_keys[st[element_key]]
current_elem = assembly.network.node[current_key]['element']
elem_connectors = current_elem.connectors(state = 'open')

connector_key = st[connector_key]

current_elem_type = assembly.network.node_attribute(current_key, 'elem_type')
type_map = {'X': elem_x, 'Y': elem_y, 'Z': elem_z}
direction = assembly.direction(current_key, connector_key)

# Human adds an element to the assembly
if human_adds:
    elem = type_map[current_elem_type]
    assembly.add_element_(elem, current_key, direction, shift_value, placed_by = 'human', on_ground = False, module_index = 0)

# Robot adds two elements to the assembly
if robot_adds:
    sequence = assembly.sequence(current_elem_type)
    sequence.pop(0)
    for i,s in enumerate(sequence):
        assembly.add_element_(type_map[s], current_key, direction, shift_value, placed_by = 'robot', on_ground = False, module_index = i+1)

# Add module to the assembly
if add_module:
    assembly.add_module(elem_x, elem_y, elem_z, current_key, direction, shift_value, on_ground = False)

if aggregate:
    for i in range (20):
        key_index = assembly.network.key_index()
        keys = [key_index[key] for key in assembly.network.nodes()]
        index = random.randint(0, len(keys)-1)
        shift_value = random.uniform(0, 0.40)
        current_key = keys[index]
        current_elem = assembly.network.node[current_key]['element']
        elem_connectors = assembly.element(current_key).connectors(state='open')
        if len(elem_connectors):
            if len(elem_connectors) == 1:
                if current_elem.connector_1_state == True:
                    direction = 1
                elif current_elem.connector_2_state == True:
                    direction = 0                
            if len(elem_connectors) == 2:
                direction = random.randint(0, 1)
            assembly.add_module(elem_x, elem_y, elem_z, current_key, direction, shift_value, on_ground = False)
            #assembly.range_filter(base_frame)
        else:
            print 'No open connectors'

key_index = assembly.network.key_index()
keys = [key_index[key] for key in assembly.network.nodes()]

for key in keys:
    element = assembly.element(key)
    base_planes.append(draw_frame(element._base_frame))
    tool_planes.append(draw_frame(element.tool_frame))
    #print key, ':', assembly.network.node_attribute(key, 'elem_type')

"""

#Collision_check test
T = Translation.from_vector([0.1, -0.024 , 0])
new_elem = elem_x.transformed(T)
artist1 = MeshArtist(new_elem.mesh)
coll_mesh = artist1.draw()

c = assembly.collision_check(new_elem, tolerance = -0.001)
#print c



### UNSOLVED: Error loading compas_cgal intersection module's .dll file ###

collision_func = Proxy('assembly_information_model.assembly.collision', python = 'C://Users//lidet//anaconda3//envs//cgal//python.exe')

print collision_func._python

collision_func.stop_server()
collision_func.start_server()

test = collision_func.collision_check_cgal(assembly, new_elem)
print test
"""
# ---------- end generate_assembly ----------
current_key = Panel(generate_assembly.current_key)
connector_key = Panel(generate_assembly.connector_key)
direction_2 = Panel(generate_assembly.direction)
pln_5 = Plane(generate_assembly.base_planes)
mesh_3 = Mesh(generate_assembly.coll_mesh)
pln_6 = Plane(generate_assembly.tool_planes)

# ---- group: Export buiding plan
# Export
export = Button()
draw_2 = PythonScript(assembly=generate_assembly.assembly, export_building_plan=export)  # -> out
# ---------- draw_2: Python ----------
if export_building_plan:
    assembly.export_building_plan()
# ---------- end draw_2 ----------

# ----
# Export .json
export_2 = Button()
export_3 = Button()
py_2 = PythonScript()  # -> HERE, DATA
# ---------- py_2: Python ----------
import os

HERE = os.path.dirname(ghdoc.Path)
DATA = os.path.abspath(os.path.join(HERE, "..", "data"))
print(HERE)
print(DATA)
# ---------- end py_2 ----------
export_4 = PythonScript(DATA=py_2.DATA, assembly=generate_assembly.assembly, export_to_json=export_2, export_to_json_unity=export_3)
# ---------- export_4: Python ----------
import os
from compas.datastructures.mesh import mesh_quads_to_triangles
from compas.datastructures.mesh import mesh_unify_cycles

if export_to_json:
    
    filename = "hrca_current_assembly_3.json"
    PATH = os.path.join(DATA, filename)
    
    # the assembly has to be serialized such that it can be called from CPython, True to enable pretty print
    assembly.to_json(PATH, True)
    

if export_to_json_unity:
    
    for key, e in assembly.elements():
    
        #convert to trimesh
        mesh_quads_to_triangles(e._mesh, check_angles=False)
        #mesh_unify_cycles(e._mesh)
        #print e._mesh.faces
        #print e._mesh.face_vertices(list(e._mesh.faces())[0])

    filename = "hrcassembly_ex1_unity.json"
    PATH = os.path.join(DATA, filename)
    assembly.to_json(PATH)
# ---------- end export_4 ----------

# ----
# Network Viz
number_slider_3 = Slider(0, range=0..47)
show_2 = BooleanToggle(False)
network_viz = GhPythonScript(assembly=generate_assembly.assembly, show_network=show_2, key=number_slider_3)  # -> out, nodes, edges, current_node, current_node_neighbors; inputs key: Int32
# ---------- network_viz: Python ----------
import sys, os
import ghpythonlib.components as ghcomp
import compas
from compas.datastructures import Network
from compas_ghpython.artists import NetworkArtist
from compas_rhino.geometry import RhinoLine

import compas_ghpython
import Rhino.Geometry as rg


data = assembly.network.to_data()
network = Network.from_data(data)

print assembly.network.number_of_nodes()

def draw_network(network):
    """Draw a network in Grasshopper.
    """
    points = []
    for key, attr in network.nodes(True):
        points.append({
            'pos': network.node_coordinates(key),
        })

    lines = []
    for (u, v), attr in network.edges(True):
        lines.append({
            'start': network.node_coordinates(u),
            'end': network.node_coordinates(v),
        })

    points_rg = compas_ghpython.draw_points(points)
    lines_rg = compas_ghpython.draw_lines(lines)

    return points_rg, lines_rg

if show_network:
    nodes, edges = draw_network(network)
    
    current_node = {'pos': network.node_coordinates(key), 'radius': 0.03}
    current_node = compas_ghpython.draw_spheres([current_node])
    
    current_node_neighbors_keys = network.neighbors(key)
    current_node_neighbors = [{'pos': network.node_coordinates(key), 'radius': 0.02} for key in current_node_neighbors_keys]
    current_node_neighbors = compas_ghpython.draw_spheres(current_node_neighbors)
# ---------- end network_viz ----------
line = Line(network_viz.edges)
pt = Point(network_viz.nodes)
brep = Brep(network_viz.current_node)
brep_2 = Brep(network_viz.current_node_neighbors)
preview = CustomPreview(Geometry=brep_2, Material=ColourSwatch(SwatchColor=RGB(255, 207, 207)))
preview_2 = CustomPreview(Geometry=brep, Material=ColourSwatch(SwatchColor=RGB(0, 0, 0)))

# ----
# Draw
# 1. Visualize assembly.
# 2. Visualize selected element & selected connector.
# 3. Visuilize all options.
# 4. Visuilize filtered options.
show_3 = BooleanToggle(True)
show_4 = BooleanToggle(True)
show_5 = BooleanToggle(True)
show_6 = BooleanToggle(True)
draw_3 = PythonScript(
    assembly=generate_assembly.assembly,
    elem_x=elem_def.elem_x,
    elem_y=elem_def.elem_y,
    elem_z=elem_def.elem_z,
    show_assembly=show_3,
    show_selected=show_4,
    show_all_options=show_5,
    show_filtered_options=show_6,
    rotate=number_slider_2,
    shift_value=move,
    current_key=generate_assembly.current_key,
    connector_key=generate_assembly.connector_key,
    direction=generate_assembly.direction)  # -> out, G_assembly, G_elem, G_connector, connector_planes, pr, vr; inputs current_key: Int32
# ---------- draw_3: Python ----------
import os
import sys
from scriptcontext import sticky as st
import Rhino.Geometry as rg
import rhinoscriptsyntax as rs

import math
from math import pi

from compas_ghpython.artists import MeshArtist
from compas.geometry import Frame
from compas.geometry import Transformation, Vector, Plane, Translation, Rotation
from compas.geometry import distance_point_point
from compas_ghpython import draw_frame


connector_planes = []

G_assembly = []
G_elem = []
G_connector = []

key_index = assembly.network.key_index()
keys = [key_index[key] for key in assembly.network.nodes()]
elements = [assembly.element(key) for key in keys] 

current_element = assembly.element(current_key)
elem_options = assembly.element(current_key).options_elements(elem_x, elem_y, elem_z)
current_elem_type = current_element._type

def show(element, output_geo):
    artist = MeshArtist(element.mesh)
    mesh = artist.draw_mesh()
    output_geo.append(mesh)

def show_multiple(elements, output_geo):
    for element in elements:
        artist = MeshArtist(element.mesh)
        mesh = artist.draw_mesh()
        output_geo.append(mesh)

# Visualise assembly
if show_assembly:
    for element in elements:
        artist = MeshArtist(element.mesh)
        mesh = artist.draw_mesh()
        G_assembly.append(mesh)

# Visualise current connector 
if show_selected:
    show(current_element, G_elem)
    if elem_options:
        current_option = elem_options[connector_key]
        orient_map = {'X': current_option._base_frame.xaxis, 'Y': current_option._base_frame.yaxis, 'Z': current_option._base_frame.zaxis}
        axis = orient_map[current_elem_type]
        if direction == 1:
            a = -1
        elif direction == 0:
            a = 1
        T = Translation.from_vector(axis*shift_value*a)
        R = Rotation.from_axis_and_angle(current_element.frame.xaxis, math.radians(rotate), current_option.frame.point)
        current_option_transformed = current_option.transformed(T*R)
        show(current_option_transformed, G_connector)
    else:
        connector_id = "no open connectors"

connectors = assembly.connectors(state = 'open')
connector_planes = [draw_frame(frame) for elem_connectors in connectors for frame in elem_connectors]

vr = []
pr = []

fields_viz = []

if show_all_options and not show_filtered_options:
    for key, origin, vector in assembly.all_options:
        vr.append(rg.Vector3d(*tuple(vector)))
        pr.append(rg.Point3d(origin.x, origin.y, origin.z))


if show_filtered_options and not show_all_options:
    for key, o, v in assembly.current_options:
        vr.append(rg.Vector3d(*tuple(v)))
        pr.append(rg.Point3d(o.x, o.y, o.z))

"""
if show_all_options and not show_filtered_options:
    for key, o, v in assembly.all_options:
        elem_origin = element.frame.point
        elem_vectors = element.options_vectors()
        for v in elem_vectors:
            #T = Translation(v*v.length
            T = Translation(v*0.5)
            start = elem_origin.transformed(T)
            vr.append(rg.Vector3d(*tuple(v)))
            pr.append(rg.Point3d(start.x, start.y, start.z))
"""
# ---------- end draw_3 ----------
pln_7 = Plane(draw_3.connector_planes)
pt_2 = Point(draw_3.pr)
vec = Vector(draw_3.vr)
vdis_2 = VectorDisplay(Anchor=pt_2, Vector=vec)
preview_3 = CustomPreview(Material=ColourSwatch(SwatchColor=RGBA(252, 101, 101, 42)))

mesh_4 = Mesh(draw_3.G_assembly)
mesh_5 = Mesh(draw_3.G_elem)
mesh_6 = Mesh(draw_3.G_connector)
wbtriangles = WeaverbirdsSplitTrianglesSubdivision(MeshCurves=mesh_4, Level=1)

edges = BrepEdges(Brep=mesh_6)  # -> Naked, Interior, NonManifold
custom_preview = CustomPreview(Geometry=wbtriangles, Material=ColourSwatch(SwatchColor=RGB(255, 255, 212)))
preview_4 = CustomPreview(Geometry=mesh_5, Material=ColourSwatch(SwatchColor=RGB(255, 92, 92)))
