# Grasshopper definition stick_support.gh (Grasshopper 1.0.7)
# plug-ins: Heteroptera

panel = Panel("phone measured stick")
pln = Plane()
panel_2 = Panel("""-0.4975
0.4975""")
deplane = DeconstructPlane(Plane=pln)  # -> Origin, XAxis, YAxis, ZAxis
amp = Amplitude(Vector=deplane.XAxis, Amplitude=panel_2)
move = Move(Geometry=deplane.Origin, Motion=amp)  # -> Geometry, Transform
dispatch = Dispatch(List=move.Geometry, DispatchPattern=[True, False])  # -> ListA, ListB
ln = Line(StartPoint=dispatch.ListA, EndPoint=dispatch.ListB)
pipe = Pipe(Curve=ln, Radius=Slider(0.01, range=0..1), Caps=Slider(1, range=0..1))
qb = QuickBaker(Geometry=pipe, Layer="phone_measurement", Bake=Button())
panel_3 = Panel(qb)

panel_4 = Panel("robot measured stick")
pt = Point(<point referenced from the Rhino model>)
point_3 = Point(<point referenced from the Rhino model>)
point_2 = Point(<point referenced from the Rhino model>)
point_4 = Point(<point referenced from the Rhino model>)
panel_5 = Panel("""-0.4975
0.4975""")
circle = Circle3Pt(PointA=point_2, PointB=point_3, PointC=point_4)  # -> Circle, Plane, Radius
fcircle = CircleFit(Points=[point_2, point_3, point_4])  # -> Circle, Radius, Deviation
vec2pt = Vector2Pt(PointA=pt, PointB=circle.Plane, Unitize=False)  # -> Vector, Length
panel_6 = Panel([circle.Radius, fcircle.Radius])
amp_2 = Amplitude(Vector=vec2pt.Vector, Amplitude=panel_5)
move_2 = Move(Geometry=circle.Plane, Motion=amp_2)  # -> Geometry, Transform
dispatch_2 = Dispatch(List=move_2.Geometry, DispatchPattern=[True, False])  # -> ListA, ListB
ln_2 = Line(StartPoint=dispatch_2.ListA, EndPoint=dispatch_2.ListB)
midpt = CurveMiddle(Curve=ln_2)
pipe_2 = Pipe(Curve=ln_2, Radius=Slider(0.01, range=0..1), Caps=Slider(1, range=0..1))
ln_3 = Line(StartPoint=midpt, EndPoint=dispatch_2.ListA)
lnpt = LinePt(Line=ln_3, Point=point_2)
qb_2 = QuickBaker(Geometry=pipe_2, Layer="robot_measurement", Bake=Button())
pln_2 = Plane(lnpt)
panel_7 = Panel(qb_2)
